# Grasshopper definition 3D_Automation_fromPlan.gh (Grasshopper 1.0.7)

geometry_pipeline = GeometryPipeline(
    GroupByLayer=False,
    GroupByType=False,
    IncludeHidden=True,
    IncludeLocked=True,
    LayerFilter="Door",
    NameFilter="*",
    SublayerFiltering=True,
    TypeFilter=4)
geometry_pipeline_2 = GeometryPipeline(
    GroupByLayer=False,
    GroupByType=False,
    IncludeHidden=True,
    IncludeLocked=True,
    LayerFilter="Wall Cut",
    NameFilter="*",
    SublayerFiltering=True,
    TypeFilter=4)
geometry_pipeline_3 = GeometryPipeline(
    GroupByLayer=False,
    GroupByType=False,
    IncludeHidden=True,
    IncludeLocked=True,
    LayerFilter="Wall Uncut",
    NameFilter="*",
    SublayerFiltering=True,
    TypeFilter=4)

geometry_pipeline_4 = GeometryPipeline(
    GroupByLayer=False,
    GroupByType=False,
    IncludeHidden=True,
    IncludeLocked=True,
    LayerFilter="Window",
    NameFilter="*",
    SublayerFiltering=True,
    TypeFilter=4)
curve = Curve(geometry_pipeline_4)
deconstruct_brep = DeconstructBrep(Brep=curve)  # -> Faces, Edges, Vertices
length = Length(Curve=deconstruct_brep.Edges)
sort_list = SortList(Keys=length, ValuesValuesA=deconstruct_brep.Edges)  # -> Keys, ValuesValuesA

area = Area(Geometry=curve)  # -> Area, graft(Centroid)
list_item = ListItem(List=sort_list.ValuesValuesA, Index=0, Wrap=True)
curve_middle = CurveMiddle(Curve=list_item)
unit_z = UnitZ(Factor=Slider(120, range=0..180))
move = Move(Geometry=curve_middle, Motion=unit_z)  # -> Geometry, Transform
rectangle_3pt = Rectangle3Pt(PointA=area.Centroid, PointB=curve_middle, PointC=move.Geometry)  # -> Rectangle, Length
radians = Radians(Degrees=Slider(180, range=0..1000))
xy_plane = XYPlane(Origin=area.Centroid)
rotate = Rotate(Geometry=rectangle_3pt.Rectangle, Angle=radians, Plane=xy_plane)  # -> Geometry, Transform
flip_curve = FlipCurve(Curve=rotate.Geometry)  # -> Curve, Flag
curve_2 = Curve(flatten([rectangle_3pt.Rectangle, flip_curve.Curve]))
boundary_surfaces = BoundarySurfaces(Edges=curve_2)
offset_on_srf = OffsetOnSrf(Curve=curve_2, Distance=Slider(2.5, range=0..10), Surface=boundary_surfaces)  # -> flatten(Curve)
split_brep = SplitBrep(Brep=boundary_surfaces, Cutter=offset_on_srf)

list_item_2 = ListItem(List=split_brep, Index=0, Wrap=True)
list_item_3 = ListItem(List=split_brep, Index=Slider(1, range=0..1), Wrap=True)
amplitude = Amplitude(Vector=list_item_3, Amplitude=Slider(1, range=0..10))
multiplication = Multiplication(A=Slider(2, range=0..10), B="-1")
amplitude_2 = Amplitude(Vector=list_item_2, Amplitude=Slider(0.21, range=0..2))
move_2 = Move(Geometry=list_item_3, Motion=amplitude)  # -> Geometry, Transform
amplitude_3 = Amplitude(Vector=list_item_3, Amplitude=multiplication)
extrude = Extrude(Base=list_item_2, Direction=amplitude_2)
extrude_2 = Extrude(Base=move_2.Geometry, Direction=amplitude_3)
custom_preview = CustomPreview(Geometry=extrude, Material=ColourSwatch(SwatchColor=RGBA(0, 0, 0, 68)))
custom_preview_2 = CustomPreview(Geometry=extrude_2, Material=ColourSwatch(SwatchColor=RGB(66, 66, 66)))

geometry_pipeline_5 = GeometryPipeline(
    GroupByLayer=False,
    GroupByType=False,
    IncludeHidden=True,
    IncludeLocked=True,
    LayerFilter="Column",
    NameFilter="*",
    SublayerFiltering=True,
    TypeFilter=4)
unit_z_2 = UnitZ(Factor=Slider(120, range=0..150))
unit_z_3 = UnitZ(Factor=Slider(120, range=0..150))
unit_z_4 = UnitZ(Factor=Slider(84, range=0..150))
curve_3 = Curve(geometry_pipeline)
curve_4 = Curve(geometry_pipeline_2)
curve_5 = Curve(geometry_pipeline_3)
unit_z_5 = UnitZ(Factor=Slider(120, range=0..150))
curve_6 = Curve(geometry_pipeline_5)
extrude_3 = Extrude(Base=curve_3, Direction=unit_z_2)
extrude_4 = Extrude(Base=curve_4, Direction=unit_z_3)
extrude_5 = Extrude(Base=curve_5, Direction=unit_z_4)
extrude_6 = Extrude(Base=curve_6, Direction=unit_z_5)
cap_holes = CapHoles(Brep=extrude_3)
cap_holes_2 = CapHoles(Brep=extrude_4)
cap_holes_3 = CapHoles(Brep=extrude_5)
cap_holes_4 = CapHoles(Brep=extrude_6)
custom_preview_3 = CustomPreview(Geometry=cap_holes_4, Material=ColourSwatch(SwatchColor=RGB(255, 255, 255)))
custom_preview_4 = CustomPreview(Geometry=cap_holes_2, Material=ColourSwatch(SwatchColor=RGB(255, 255, 255)))
custom_preview_5 = CustomPreview(Geometry=cap_holes_3, Material=ColourSwatch(SwatchColor=RGB(255, 255, 255)))
custom_preview_6 = CustomPreview(Geometry=cap_holes, Material=ColourSwatch(SwatchColor=RGBA(71, 71, 71, 21)))
