# Grasshopper definition Auditorium_Section.gh (Grasshopper 1.0.8)
# plug-ins: Parakeet

# ----
# EARLY REFLECTION
# CALCULATION
number_slider = Slider(131, range=0..10000)
# SOUND SOURCE
construct_point = ConstructPoint(XCoordinate=number_slider, YCoordinate=Slider(0, range=0..10000), ZCoordinate=Slider(48, range=0..10000))

# ----
# GALLERY SECTION
# POINT OF PERFORMANCE
number_slider_2 = Slider(131, range=0..1000)
construct_point_2 = ConstructPoint(XCoordinate=number_slider_2, YCoordinate=0, ZCoordinate=Slider(48, range=-120..120))

curve = Curve(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)

number_slider_3 = Slider(261, range=0..1200)
number_slider_4 = Slider(59, range=-1200..1200)

# ----
# STEP HEIGHT
number_slider_5 = Slider(5, range=-36..36)
# NO. OF ROWS
number_slider_6 = Slider(11, range=0..20)

number_slider_7 = Slider(-1.612, range=-15..15)
number_slider_8 = Slider(2, range=0..10)
number_slider_9 = Slider(-18, range=-30..30)
number_slider_10 = Slider(-18, range=-36..36)
number_slider_11 = Slider(4, range=0..10)
# ERGONOMICS
number_slider_12 = Slider(-6, range=-36..36)

construct_point_3 = ConstructPoint(XCoordinate=number_slider_3, YCoordinate=0, ZCoordinate=number_slider_4)
absolute = Absolute(Value=number_slider_9)
addition = Addition(A=number_slider_3, B=Slider(5, range=-12..12))
subtraction = Subtraction(A=number_slider_4, B=number_slider_11)
curve_2 = Curve(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)
curve_3 = Curve(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)
curve_4 = Curve(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)
curve_5 = Curve(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)
number_slider_13 = Slider(94, range=0..10000)
subtraction_2 = Subtraction(A=number_slider_4, B=number_slider_11, C=absolute, D=number_slider_12)
addition_2 = Addition(A=number_slider_3, B=Slider(-2, range=-36..36))
subtraction_3 = Subtraction(A=number_slider_4, B=number_slider_11, C=absolute)
xz_plane = XZPlane(Origin=construct_point_3)
curve_6 = Curve(graft([curve_2, curve_3, curve_4, curve_5]))
construct_point_4 = ConstructPoint(XCoordinate=number_slider_3, YCoordinate=0, ZCoordinate=subtraction_3)
construct_point_5 = ConstructPoint(XCoordinate=addition_2, YCoordinate=0, ZCoordinate=subtraction_2)
construct_point_6 = ConstructPoint(XCoordinate=addition, YCoordinate=0, ZCoordinate=subtraction)
rectangle = Rectangle(Plane=xz_plane, XSize=number_slider_13, YSize=number_slider_13, Radius=0)  # -> Rectangle, Length
xz_plane_2 = XZPlane(Origin=construct_point_6)
xz_plane_3 = XZPlane(Origin=construct_point_4)
mirror_curve = MirrorCurve(Geometry=construct_point, Curve=curve_6, Tangent=True)
end_points = EndPoints(Curve=curve_6)  # -> Start, End
rectangle_2 = Rectangle(Plane=xz_plane_2, XSize=number_slider_7, YSize=number_slider_9, Radius=number_slider_8)  # -> Rectangle, Length
rectangle_3 = Rectangle(Plane=xz_plane_3, XSize=number_slider_9, YSize=number_slider_7, Radius=number_slider_8)  # -> Rectangle, Length
# SECTION PLANE
xz_plane_4 = XZPlane(Origin=construct_point)
curve_middle = CurveMiddle(Curve=curve_6)
area = Area(Geometry=rectangle_3.Rectangle)  # -> Area, Centroid
rectangle_4 = Rectangle(Plane=xz_plane_4, XSize=Slider(607, range=0..3000), YSize=Slider(250, range=0..3000), Radius=0)  # -> Rectangle, Length
line = Line(StartPoint=mirror_curve, EndPoint=[end_points.Start, end_points.End])
absolute_2 = Absolute(Value=number_slider_10)
point = Point(mirror_curve)
point_2 = Point(curve_middle)
radians = Radians(Degrees=Slider(-12, range=-360..360))
radians_2 = Radians(Degrees=Slider(-8, range=-360..360))
line_2 = Line(StartPoint=xz_plane_4, EndPoint=[end_points.Start, end_points.End])
xz_plane_5 = XZPlane(Origin=area.Centroid)
xz_plane_6 = XZPlane(Origin=construct_point_5)
extend_on_surface = ExtendOnSurface(Curve=line, Surface=rectangle_4.Rectangle)
subtraction_4 = Subtraction(A=number_slider_4, B=number_slider_11, C=absolute, D=number_slider_12, E=absolute_2)
point_list = PointList(Points=flatten(point), Size=Slider(12, range=0..100))
point_list_2 = PointList(Points=flatten(point_2), Size=Slider(12, range=0..100))
rotate = Rotate(Geometry=rectangle_2.Rectangle, Angle=radians, Plane=xz_plane_2)  # -> Geometry, Transform
rotate_2 = Rotate(Geometry=rectangle_3.Rectangle, Angle=radians_2, Plane=xz_plane_5)  # -> Geometry, Transform
construct_point_7 = ConstructPoint(XCoordinate=number_slider_3, YCoordinate=0, ZCoordinate=subtraction_4)
rectangle_5 = Rectangle(Plane=xz_plane_6, XSize=Slider(-10, range=-36..36), YSize=number_slider_10, Radius=0)  # -> Rectangle, Length
line_3 = Line(StartPoint=point, EndPoint=point_2)
circle = Circle(Plane=xz_plane, Radius=Slider(2.777, range=0..10))
number_slider_14 = Slider(-36, range=-60..60)

# ----
# REFLECTIONS
extend_on_surface_2 = ExtendOnSurface(Curve=line_3, Surface=rectangle_4.Rectangle)
custom_preview = CustomPreview(Geometry=line_2, Material=ColourSwatch(SwatchColor=RGB(222, 210, 47)))
custom_preview_2 = CustomPreview(Geometry=extend_on_surface, Material=ColourSwatch(SwatchColor=RGB(214, 141, 58)))

area_2 = Area(Geometry=circle)  # -> Area, Centroid
absolute_3 = Absolute(Value=number_slider_14)
series = Series(Start=0, Step=number_slider_14, Count=number_slider_6)
multiplication = Multiplication(A=number_slider_5, B=Slider(-1, range=-1..1))
multiplication_2 = Multiplication(A=absolute_3, B=2)
unit_z = UnitZ(Factor=multiplication)
unit_x = UnitX(Factor=number_slider_14)
absolute_4 = Absolute(Value=series)
length = Length(Curve=extend_on_surface_2)  # -> flatten(Length)
unit_x_2 = UnitX(Factor=multiplication_2)
multiplication_3 = Multiplication(A=number_slider_5, B=2)
unit_x_3 = UnitX(Factor=absolute_4)
move = Move(Geometry=construct_point_7, Motion=unit_x)  # -> Geometry, Transform
move_2 = Move(Geometry=move.Geometry, Motion=unit_z)  # -> Geometry, Transform
expression = Expression(x=length, Expression="(x*.0254)*1000/342")
move_3 = Move(Geometry=area_2.Centroid, Motion=unit_x_2)  # -> Geometry, Transform
unit_z_2 = UnitZ(Factor=multiplication_3)
line_4 = Line(StartPoint=move.Geometry, EndPoint=move_2.Geometry)
line_5 = Line(StartPoint=construct_point_7, EndPoint=move.Geometry)
# SINGLE
# SITTING
geometry = Geometry(flatten([circle, rotate.Geometry, rotate_2.Geometry, rectangle_5.Rectangle, construct_point_7, line_5, line_4]))
move_4 = Move(Geometry=graft(geometry), Motion=unit_x_3)  # -> Geometry, Transform
series_2 = Series(Start=0, Step=number_slider_5, Count=number_slider_6)
move_5 = Move(Geometry=move_3.Geometry, Motion=unit_z_2)  # -> Geometry, Transform
first_reflection_ms = Panel(expression)
unit_z_3 = UnitZ(Factor=series_2)
# SECTION
move_6 = Move(Geometry=move_4.Geometry, Motion=unit_z_3)  # -> Geometry, Transform

# ----
# VISUAL
# CONNECTIVITY
line_6 = Line(StartPoint=construct_point_2, EndPoint=move_5.Geometry)
line_7 = Line(StartPoint=construct_point_2, EndPoint=area_2.Centroid)

shift_paths = ShiftPaths(Data=move_6.Geometry, Offset=Slider(1, range=-8..2))
flip_matrix = FlipMatrix(Data=shift_paths)
list_item = ListItem(List=flip_matrix, Index=Slider(5, range=0..10), Wrap=True)  # -> Item, Item1
join_curves = JoinCurves(Curves=flatten([list_item.Item, list_item.Item1]), Preserve=False)
# GALLERY
sweep1 = Sweep1(Rail=curve, Sections=join_curves, Miter=0)
