# Grasshopper definition Circular Folded Plate.gh (Grasshopper 1.0.7)

xy_plane = XYPlane(Origin=Point(0, 0, 0))
multiplication = Multiplication(A=Slider(7, range=0..20), B="2")
polygon = Polygon(Plane=xy_plane, Radius=Slider(10000, range=0..10000), Segments=multiplication, FilletRadius=0)  # -> Polygon, Length
area = Area(Geometry=polygon.Polygon)  # -> Area, Centroid
deconstruct_brep = DeconstructBrep(Brep=polygon.Polygon)  # -> Faces, Edges, Vertices
line = Line(StartPoint=area.Centroid, EndPoint=deconstruct_brep.Vertices)
dispatch = Dispatch(List=line, DispatchPattern=[True, False])  # -> ListA, ListB
line_2 = Line(dispatch.ListA)
extend_curve = ExtendCurve(Curve=line_2, Type=0, Start=Slider(1694, range=0..4000), End=Slider(621, range=0..4000))
point_on_curve = PointOnCurve(line_2, parameter=0)
point_on_curve_2 = PointOnCurve(line_2, parameter=0.398)
point_on_curve_3 = PointOnCurve(line_2, parameter=0.665)
point_on_curve_4 = PointOnCurve(line_2, parameter=0.896)
point_on_curve_5 = PointOnCurve(extend_curve, parameter=1)
line_3 = Line(dispatch.ListB)
point_on_curve_6 = PointOnCurve(line_3, parameter=0.323)
point_on_curve_7 = PointOnCurve(line_3, parameter=0.77)
point_on_curve_8 = PointOnCurve(line_3, parameter=1)
unit_z = UnitZ(Factor=Slider(4000, range=-4000..4000))
unit_z_2 = UnitZ(Factor=Slider(3165, range=-4000..4000))
unit_z_3 = UnitZ(Factor=Slider(3168, range=-4000..4000))
unit_z_4 = UnitZ(Factor=Slider(3587, range=-4000..4000))
unit_z_5 = UnitZ(Factor=Slider(2300, range=-4000..4000))
unit_z_6 = UnitZ(Factor=Slider(2975, range=-4000..4000))
unit_z_7 = UnitZ(Factor=Slider(4000, range=-4000..4000))
unit_z_8 = UnitZ(Factor=Slider(1030, range=-4000..4000))
point = Point(point_on_curve)
point_2 = Point(point_on_curve_2)
point_3 = Point(point_on_curve_3)
point_4 = Point(point_on_curve_4)
point_5 = Point(point_on_curve_5)
point_6 = Point(point_on_curve_6)
point_7 = Point(point_on_curve_7)
point_8 = Point(point_on_curve_8)
move = Move(Geometry=point, Motion=unit_z)  # -> Geometry, Transform
move_2 = Move(Geometry=point_2, Motion=unit_z_2)  # -> Geometry, Transform
move_3 = Move(Geometry=point_3, Motion=unit_z_3)  # -> Geometry, Transform
move_4 = Move(Geometry=point_4, Motion=unit_z_4)  # -> Geometry, Transform
move_5 = Move(Geometry=point_5, Motion=unit_z_8)  # -> Geometry, Transform
move_6 = Move(Geometry=point_6, Motion=unit_z_5)  # -> Geometry, Transform
move_7 = Move(Geometry=point_7, Motion=unit_z_6)  # -> Geometry, Transform
move_8 = Move(Geometry=point_8, Motion=unit_z_7)  # -> Geometry, Transform
shift_list = ShiftList(List=move_2.Geometry, Shift=1, Wrap=True)
shift_list_2 = ShiftList(List=move_3.Geometry, Shift=1, Wrap=True)
shift_list_3 = ShiftList(List=move_3.Geometry, Shift=1, Wrap=True)
shift_list_4 = ShiftList(List=move_4.Geometry, Shift=1, Wrap=True)
shift_list_5 = ShiftList(List=move_5.Geometry, Shift=1, Wrap=True)
shift_list_6 = ShiftList(List=move_4.Geometry, Shift=1, Wrap=True)
_4point_surface = _4PointSurface(CornerA=move.Geometry, CornerB=move_2.Geometry, CornerC=move_6.Geometry)
_4point_surface_2 = _4PointSurface(CornerA=move.Geometry, CornerB=move_6.Geometry, CornerC=shift_list)
_4point_surface_3 = _4PointSurface(CornerA=move_2.Geometry, CornerB=move_3.Geometry, CornerC=move_6.Geometry)
_4point_surface_4 = _4PointSurface(CornerA=move_6.Geometry, CornerB=move_7.Geometry, CornerC=move_3.Geometry)
_4point_surface_5 = _4PointSurface(CornerA=move_6.Geometry, CornerB=shift_list, CornerC=shift_list_2)
_4point_surface_6 = _4PointSurface(CornerA=shift_list_2, CornerB=move_7.Geometry, CornerC=move_6.Geometry)
_4point_surface_7 = _4PointSurface(CornerA=move_3.Geometry, CornerB=move_8.Geometry, CornerC=move_7.Geometry)
_4point_surface_8 = _4PointSurface(CornerA=move_7.Geometry, CornerB=move_8.Geometry, CornerC=shift_list_3)
_4point_surface_9 = _4PointSurface(CornerA=move_3.Geometry, CornerB=move_4.Geometry, CornerC=move_8.Geometry)
_4point_surface_10 = _4PointSurface(CornerA=move_8.Geometry, CornerB=shift_list_3, CornerC=shift_list_4)
_4point_surface_11 = _4PointSurface(CornerA=move_4.Geometry, CornerB=move_5.Geometry, CornerC=move_8.Geometry)
_4point_surface_12 = _4PointSurface(CornerA=move_8.Geometry, CornerB=shift_list_5, CornerC=shift_list_6)
