# Grasshopper definition Circular_Folded_plate.gh (Grasshopper 1.0.7)
# plug-ins: Bifocals

xy_plane = XYPlane(Origin=Point(0, 0, 0))
multiplication = Multiplication(A=Slider(15, range=0..20), B="2")
construct_domain = ConstructDomain(DomainStart=Slider(0, range=0..10), DomainEnd=Slider(8, range=0..10))
polygon = Polygon(Plane=xy_plane, Radius=Slider(1500, range=0..10000), Segments=multiplication, FilletRadius=0)  # -> Polygon, Length
panel = Panel("""1
-1""")
area = Area(Geometry=polygon.Polygon)  # -> Area, Centroid
sub_list = SubList(List=panel, Domain=construct_domain, Wrap=True)  # -> List, Index
deconstruct_brep = DeconstructBrep(Brep=polygon.Polygon)  # -> Faces, Edges, Vertices
line = Line(StartPoint=area.Centroid, EndPoint=deconstruct_brep.Vertices)
multiplication_2 = Multiplication(A=sub_list.List, B=Slider(-31, range=-600..600))
unit_z = UnitZ(Factor=multiplication_2)
dispatch = Dispatch(List=line, DispatchPattern=[True, False])  # -> ListA, ListB
unit_z_2 = UnitZ(Factor=Slider(425, range=0..600))
number_slider = Slider(14, range=0..20)
move = Move(Geometry=dispatch.ListA, Motion=unit_z_2)  # -> Geometry, Transform
shift_list = ShiftList(List=move.Geometry, Shift=1, Wrap=Toggle(True))
divide_curve = DivideCurve(Curve=move.Geometry, Count=number_slider, Kinks=False)  # -> Points, Tangents, Parameters
divide_curve_2 = DivideCurve(Curve=dispatch.ListB, Count=number_slider, Kinks=False)  # -> Points, Tangents, Parameters
divide_curve_3 = DivideCurve(Curve=shift_list, Count=number_slider, Kinks=False)  # -> Points, Tangents, Parameters
dispatch_2 = Dispatch(List=divide_curve.Points, DispatchPattern=[True, False])  # -> ListA, ListB
dispatch_3 = Dispatch(List=divide_curve_2.Points, DispatchPattern=[True, False])  # -> ListA, ListB
dispatch_4 = Dispatch(List=divide_curve_3.Points, DispatchPattern=[True, False])  # -> ListA, ListB
move_2 = Move(Geometry=dispatch_2.ListA, Motion=unit_z)  # -> Geometry, Transform
move_3 = Move(Geometry=dispatch_3.ListA, Motion=unit_z)  # -> Geometry, Transform
move_4 = Move(Geometry=dispatch_4.ListA, Motion=unit_z)  # -> Geometry, Transform
point = Point(move_2.Geometry)
point_2 = Point(move_4.Geometry)
point_3 = Point(move_3.Geometry)
shift_list_2 = ShiftList(List=point_3, Shift=1, Wrap=Toggle(False))
shift_list_3 = ShiftList(List=point, Shift=1, Wrap=Toggle(False))
shift_list_4 = ShiftList(List=point_2, Shift=1, Wrap=Toggle(False))
_4point_surface = _4PointSurface(CornerA=point, CornerB=shift_list_3, CornerC=point_3)
_4point_surface_2 = _4PointSurface(CornerA=point_2, CornerB=shift_list_4, CornerC=point_3)
_4point_surface_3 = _4PointSurface(CornerA=shift_list_3, CornerB=point_3, CornerC=shift_list_2)
_4point_surface_4 = _4PointSurface(CornerA=point_3, CornerB=shift_list_2, CornerC=shift_list_4)
