# Grasshopper definition Diagrid_Export.gh (Grasshopper 1.0.7)
# plug-ins: Bifocals, LunchBox

gene_pool = GenePool(Decimals=2, Maximum=1000, Minimum=0, Value=[0, 274.2, 565.84])
unit_z = UnitZ(Factor=gene_pool)
geometry = Geometry(<curve referenced from the Rhino model>)
move = Move(Geometry=geometry, Motion=unit_z)  # -> Geometry, Transform
gene_pool_2 = GenePool(Decimals=2, Maximum=2, Minimum=0, Value=[2, 1.16, 1.92])
area = Area(Geometry=move.Geometry)  # -> Area, Centroid
scale = Scale(Geometry=move.Geometry, Center=area.Centroid, Factor=gene_pool_2)  # -> Geometry, Transform
number_slider = Slider(34, range=0..100)
number_slider_2 = Slider(34, range=0..100)
loft = Loft(Curves=scale.Geometry, Options={Adjust=False, Closed=False, LoftEnds=0, LoftSimp=0, LoftType=0, Rebuild=10, Refit=0.01})
diamond_panels = DiamondPanels(Surface=loft, UDivisions=number_slider, VDivisions=number_slider_2)  # -> DiamondPanels, TriPanels
diagrid_structure = DiagridStructure(Surface=loft, UDivisions=number_slider, VDivisions=number_slider_2, Type=True)  # -> StructureLines, StructureNodes
pipe = Pipe(Curve=diagrid_structure.StructureLines, Radius=1, Caps=0)
panel_frame = PanelFrame(Panel=diamond_panels.DiamondPanels, ScaleFactor=Slider(0.8, range=0..1))  # -> PanelFrame, Panel
offset_surface = OffsetSurface(Surface=panel_frame.PanelFrame, Distance=Slider(1, range=0..10), Retrim=Toggle(True))
geometry_2 = Geometry(panel_frame.Panel)
