# Grasshopper definition Diagrid_in_surface.gh (Grasshopper 1.0.7)
# plug-ins: LunchBox

gene_pool = GenePool(Decimals=2, Maximum=100, Minimum=0, Value=[100, 46.91, 0])
gene_pool_2 = GenePool(Decimals=2, Maximum=100, Minimum=0, Value=[16.43, 9.16, 15.81])
number_slider = Slider(9, range=0..10)
construct_point = ConstructPoint(XCoordinate=0, YCoordinate=0, ZCoordinate=gene_pool)
circle = Circle(Plane=construct_point, Radius=gene_pool_2)
number_slider_2 = Slider(61, range=0..100)
number_slider_3 = Slider(51, range=0..100)
number_slider_4 = Slider(50, range=0..100)
loft = Loft(Curves=circle, Options={Adjust=False, Closed=False, LoftEnds=0, LoftSimp=0, LoftType=0, Rebuild=10, Refit=0.01})
number_slider_5 = Slider(0.14, range=0..1)
number_slider_6 = Slider(0.19, range=0..1)
braced_grid_1_d_structure = BracedGrid1DStructure(Surface=loft, UDivisions=Slider(22, range=0..100), VDivisions=Slider(24, range=0..100))  # -> PrimaryLines, BraceLines, StructureNodes
braced_grid_2_d_structure = BracedGrid2DStructure(Surface=loft, UDivisions=Slider(12, range=0..100), VDivisions=Slider(20, range=0..100))  # -> PrimaryLines, BraceLines, StructureNodes
offset_surface = OffsetSurface(Surface=loft, Distance=Slider(0.246, range=0..1), Retrim=True)
diagrid_structure = DiagridStructure(Surface=loft, UDivisions=number_slider_3, VDivisions=number_slider_4, Type=True)  # -> StructureLines, StructureNodes
number_slider_7 = Slider(0.19, range=0..1)
braced_grid_1_d_structure_2 = BracedGrid1DStructure(
    Surface=[<geometry referenced from the Rhino model> x4],
    UDivisions=Slider(4, range=0..100),
    VDivisions=Slider(20, range=0..100))  # -> PrimaryLines, BraceLines, StructureNodes
grid_structure = GridStructure(Surface=loft, UDivisions=Slider(23, range=0..100), VDivisions=Slider(20, range=0..100))  # -> StructureLines, StructureNodes
braced_grid_2_d_structure_2 = BracedGrid2DStructure(
    Surface=[<geometry referenced from the Rhino model> x4],
    UDivisions=Slider(3, range=0..100),
    VDivisions=Slider(20, range=0..100))  # -> PrimaryLines, BraceLines, StructureNodes
hexagonal_structure = HexagonalStructure(Surface=loft, UDivisions=Slider(88, range=0..100), VDivisions=Slider(58, range=0..100), AdjustShape=0.3, Type=False)  # -> StructureLines, StructureNodes
grid_structure_2 = GridStructure(UDivisions=Slider(9, range=0..100), VDivisions=Slider(29, range=0..100))  # -> StructureLines, StructureNodes
grid_structure_3 = GridStructure(
    Surface=<geometry referenced from the Rhino model>,
    UDivisions=Slider(29, range=0..100),
    VDivisions=Slider(33, range=0..100))  # -> StructureLines, StructureNodes
diagrid_structure_2 = DiagridStructure(
    Surface=[<geometry referenced from the Rhino model> x4],
    UDivisions=Slider(12, range=0..100),
    VDivisions=Slider(35, range=0..100),
    Type=True)  # -> StructureLines, StructureNodes
hexagonal_structure_2 = HexagonalStructure(
    Surface=[<geometry referenced from the Rhino model> x2],
    UDivisions=Slider(12, range=0..100),
    VDivisions=number_slider_2,
    AdjustShape=0.3,
    Type=False)  # -> StructureLines, StructureNodes
hexagonal_structure_3 = HexagonalStructure(
    Surface=[<geometry referenced from the Rhino model> x2],
    UDivisions=Slider(6, range=0..100),
    VDivisions=number_slider_2,
    AdjustShape=0.3,
    Type=False)  # -> StructureLines, StructureNodes
pipe = Pipe(Curve=diagrid_structure.StructureLines, Radius=Slider(0.19, range=0..1), Caps=0)
pipe_2 = Pipe(Curve=braced_grid_1_d_structure.BraceLines, Radius=number_slider_5, Caps=0)
pipe_3 = Pipe(Curve=braced_grid_1_d_structure.PrimaryLines, Radius=number_slider_6, Caps=0)
diamond_panels = DiamondPanels(Surface=offset_surface, UDivisions=number_slider_3, VDivisions=number_slider_4)  # -> DiamondPanels, TriPanels
pipe_4 = Pipe(Curve=grid_structure.StructureLines, Radius=number_slider_6, Caps=0)
pipe_5 = Pipe(Curve=braced_grid_2_d_structure.BraceLines, Radius=number_slider_5, Caps=0)
pipe_6 = Pipe(Curve=braced_grid_2_d_structure.PrimaryLines, Radius=number_slider_6, Caps=0)
pipe_7 = Pipe(Curve=grid_structure_2.StructureLines, Radius=number_slider_6, Caps=0)
pipe_8 = Pipe(Curve=hexagonal_structure.StructureLines, Radius=number_slider_6, Caps=0)
pipe_9 = Pipe(Curve=grid_structure_3.StructureLines, Radius=number_slider_6, Caps=0)
pipe_10 = Pipe(Curve=braced_grid_1_d_structure_2.BraceLines, Radius=number_slider_5, Caps=0)
pipe_11 = Pipe(Curve=braced_grid_1_d_structure_2.PrimaryLines, Radius=number_slider_7, Caps=0)
pipe_12 = Pipe(Curve=braced_grid_2_d_structure_2.BraceLines, Radius=number_slider_5, Caps=0)
pipe_13 = Pipe(Curve=diagrid_structure_2.StructureLines, Radius=number_slider_6, Caps=0)
pipe_14 = Pipe(Curve=braced_grid_2_d_structure_2.PrimaryLines, Radius=number_slider_7, Caps=0)
pipe_15 = Pipe(Curve=[hexagonal_structure_2.StructureLines, hexagonal_structure_3.StructureLines], Radius=number_slider_6, Caps=0)
panel = Panel(braced_grid_1_d_structure.PrimaryLines)
panel_2 = Panel(pipe_2)
panel_frame = PanelFrame(Panel=diamond_panels.DiamondPanels, ScaleFactor=Slider(0.79, range=0..1))  # -> PanelFrame, Panel
geometry = Geometry(panel_frame.PanelFrame)
geometry_2 = Geometry(panel_frame.Panel)
