# Grasshopper definition Elevated_Road_Geometry_from_Alignment.gh (Grasshopper 1.0.7)

# ---- group: Lane Mark
number_slider = Slider(1, range=-1..1)
multiplication = Multiplication(A=Slider(0.23, range=0..1), B=number_slider)
multiplication_2 = Multiplication(A=Slider(0.3, range=0..1), B=number_slider)
curve = Curve(<curve referenced from the Rhino model>)
multiplication_3 = Multiplication(A=Slider(3.624, range=0..20), B=number_slider)
offset_curve = OffsetCurve(Curve=curve, Distance=multiplication, Plane=PlaneXY(0, 0, 0), Corners=1)
offset_curve_2 = OffsetCurve(Curve=curve, Distance=multiplication_2, Plane=PlaneXY(0, 0, 0), Corners=1)
offset_curve_3 = OffsetCurve(Curve=curve, Distance=multiplication_3, Plane=PlaneXY(0, 0, 0), Corners=1)
surface = Surface(<surface referenced from the Rhino model>)
unit_z = UnitZ(Factor=1)
unit_z_2 = UnitZ(Factor=1)
number_slider_2 = Slider(0.035, range=0..1)
project = Project(Curve=offset_curve, Brep=surface, Direction=unit_z)
project_2 = Project(Curve=offset_curve_2, Brep=surface, Direction=unit_z_2)
project_3 = Project(Curve=offset_curve_3, Brep=surface, Direction=unit_z_2)
multiplication_4 = Multiplication(A=number_slider_2, B="1")
multiplication_5 = Multiplication(A=number_slider_2, B="-1")
offset_curve_4 = OffsetCurve(Curve=project_3, Distance=multiplication_4, Plane=PlaneXY(0, 0, 0), Corners=1)
offset_curve_5 = OffsetCurve(Curve=project_3, Distance=multiplication_5, Plane=PlaneXY(0, 0, 0), Corners=1)
edge_surface = EdgeSurface(CurveA=project, CurveB=project_2)
divide_distance = DivideDistance(Curve=offset_curve_4, Distance=Slider(1, range=0..10))  # -> Points, Tangents, Parameters
divide_distance_2 = DivideDistance(Curve=offset_curve_5, Distance=Slider(1, range=0..10))  # -> Points, Tangents, Parameters
unit_z_3 = UnitZ(Factor=Slider(0.015, range=0..0.3))
dispatch = Dispatch(List=divide_distance.Points, DispatchPattern=[True, False])  # -> ListA, ListB
dispatch_2 = Dispatch(List=divide_distance_2.Points, DispatchPattern=[True, False])  # -> ListA, ListB
point = Point(dispatch.ListA)
point_2 = Point(dispatch_2.ListB)
point_3 = Point(dispatch_2.ListA)
point_4 = Point(dispatch.ListB)
_4point_surface = _4PointSurface(CornerA=point, CornerB=point_4, CornerC=point_2, CornerD=point_3)
unit_z_4 = UnitZ(Factor=Slider(0.015, range=0..0.3))
extrude = Extrude(Base=edge_surface, Direction=unit_z_3)
extrude_2 = Extrude(Base=_4point_surface, Direction=unit_z_4)

# ----
number_slider_3 = Slider(42, range=0..100)
addition = Addition(A=number_slider_3, B="1")
curve_2 = Curve(<curve referenced from the Rhino model>)
division = Division(A=Slider(3, range=0..30), B=number_slider_3)
divide_curve = DivideCurve(Count=number_slider_3, Kinks=False)  # -> Points, Tangents, Parameters
series = Series(Start=Slider(15, range=0..100), Step=division, Count=addition)
reverse_list = ReverseList(List=series)
unit_z_5 = UnitZ(Factor=series)
move = Move(Geometry=divide_curve.Points, Motion=unit_z_5)  # -> Geometry, Transform
interpolate = Interpolate(Vertices=move.Geometry, Degree=3, Periodic=False, KnotStyle=1)  # -> Curve, Length, Domain

brep = Brep(<brep referenced from the Rhino model>)
brep_2 = Brep(<brep referenced from the Rhino model>)
solid_union = SolidUnion(Breps=[brep_2, brep])
deconstruct_brep = DeconstructBrep(Brep=solid_union)  # -> Faces, Edges, Vertices
panel = Panel(deconstruct_brep.Faces)
list_item = ListItem(List=deconstruct_brep.Edges, Index=Slider(11, range=0..20), Wrap=True)
panel_2 = Panel("""1
-1""")
offset_curve_6 = OffsetCurve(Curve=list_item, Distance=Slider(0.1, range=0..1), Plane=PlaneXY(0, 0, 0), Corners=1)
offset_curve_7 = OffsetCurve(Curve=list_item, Distance=Slider(3.7, range=0..10), Plane=PlaneXY(0, 0, 0), Corners=1)
multiplication_6 = Multiplication(A=Slider(3.3, range=0..10), B=panel_2)
divide_distance_3 = DivideDistance(Curve=offset_curve_6, Distance=Slider(2, range=0..100))  # -> Points, Tangents, Parameters
unit_z_6 = UnitZ(Factor=multiplication_6)
extrude_3 = Extrude(Base=offset_curve_7, Direction=unit_z_6)
list_item_2 = ListItem(List=deconstruct_brep.Faces, Index=Slider(5, range=0..10), Wrap=True)
surface_line = SurfaceLine(Surface=[list_item_2, extrude_3], LimitToFirst=False)  # -> Curves, Points, UVPoints, Normal

number_slider_4 = Slider(0.028, range=0..0.1)
curve_3 = Curve()
brep_3 = Brep()
multiplication_7 = Multiplication(A=number_slider_4, B="-1")
offset_curve_8 = OffsetCurve(Curve=curve_3, Distance=multiplication_7, Plane=PlaneXY(0, 0, 0), Corners=1)
offset_curve_9 = OffsetCurve(Curve=curve_3, Distance=number_slider_4, Plane=PlaneXY(0, 0, 0), Corners=1)
panel_3 = Panel("""1
-1""")
panel_4 = Panel("""1
-1""")
multiplication_8 = Multiplication(A=Slider(4.3, range=0..10), B=panel_3)
multiplication_9 = Multiplication(A=Slider(4.23, range=0..10), B=panel_4)
number_slider_5 = Slider(1, range=0..10)
offset_curve_10 = OffsetCurve(Curve=curve_3, Distance=multiplication_8, Plane=PlaneXY(0, 0, 0), Corners=1)
offset_curve_11 = OffsetCurve(Curve=curve_3, Distance=multiplication_9, Plane=PlaneXY(0, 0, 0), Corners=1)
project_4 = Project(Curve=offset_curve_8, Brep=brep_3, Direction=Vector(0, 0, 1))
project_5 = Project(Curve=offset_curve_9, Brep=brep_3, Direction=Vector(0, 0, 1))
divide_distance_4 = DivideDistance(Curve=project_4, Distance=number_slider_5)  # -> flatten(Points), Tangents, Parameters
divide_distance_5 = DivideDistance(Curve=project_5, Distance=number_slider_5)  # -> flatten(Points), Tangents, Parameters
project_6 = Project(Curve=offset_curve_11, Brep=brep_3, Direction=Vector(0, 0, 1))
project_7 = Project(Curve=offset_curve_10, Brep=brep_3, Direction=Vector(0, 0, 1))
dispatch_3 = Dispatch(List=divide_distance_5.Points, DispatchPattern=[True, False])  # -> ListA, ListB
dispatch_4 = Dispatch(List=divide_distance_4.Points, DispatchPattern=[True, False])  # -> ListA, ListB
unit_z_7 = UnitZ(Factor=Slider(0.018, range=0..1))
edge_surface_2 = EdgeSurface(CurveA=project_7, CurveB=project_6)
extrude_4 = Extrude(Base=edge_surface_2, Direction=unit_z_7)
point_5 = Point(dispatch_3.ListA)
point_6 = Point(dispatch_3.ListB)
point_7 = Point(dispatch_4.ListA)
point_8 = Point(dispatch_4.ListB)
list_item_3 = ListItem(List=point_8, Index=Slider(0, range=0..100), Wrap=True)
_4point_surface_2 = _4PointSurface(CornerA=point_5, CornerB=point_6, CornerC=point_8, CornerD=point_7)
unit_z_8 = UnitZ(Factor=Slider(0.018, range=0..0.1))
extrude_5 = Extrude(Base=_4point_surface_2, Direction=unit_z_8)

curve_4 = Curve(<curve referenced from the Rhino model>)
curve_5 = Curve(graft(<curve referenced from the Rhino model>))
number_slider_6 = Slider(0.028, range=0..0.1)
surface_2 = Surface(flatten(<surface referenced from the Rhino model>))
curve_6 = Curve(<curve referenced from the Rhino model>)
number_slider_7 = Slider(-0.23, range=-0.9..0.9)
divide_curve_2 = DivideCurve(Curve=curve_4, Count=Slider(7, range=0..1000), Kinks=False)  # -> Points, Tangents, Parameters
interpolate_2 = Interpolate(Vertices=divide_curve_2.Points, Degree=3, Periodic=False, KnotStyle=1)  # -> Curve, Length, Domain
offset_curve_12 = OffsetCurve(Curve=curve_6, Distance=Slider(-0.3, range=-0.9..0.9), Plane=PlaneXY(0, 0, 0), Corners=1)
offset_curve_13 = OffsetCurve(Curve=curve_6, Distance=Slider(-0.23, range=-0.9..0.9), Plane=PlaneXY(0, 0, 0), Corners=1)
offset_curve_14 = OffsetCurve(Curve=curve_5, Distance=Slider(-0.3, range=-0.9..0.9), Plane=PlaneXY(0, 0, 0), Corners=1)
offset_curve_15 = OffsetCurve(Curve=curve_5, Distance=number_slider_7, Plane=PlaneXY(0, 0, 0), Corners=1)
unit_z_9 = UnitZ(Factor=Slider(18, range=0..100))
panel_5 = Panel(offset_curve_13)
multiplication_10 = Multiplication(A=number_slider_6, B="-1")
move_2 = Move(Geometry=interpolate_2.Curve, Motion=unit_z_9)  # -> Geometry, Transform
project_8 = Project(Curve=offset_curve_12, Brep=surface_2, Direction=Vector(0, 0, 1))
project_9 = Project(Curve=offset_curve_13, Brep=surface_2, Direction=Vector(0, 0, 1))
project_10 = Project(Curve=offset_curve_14, Brep=surface_2, Direction=Vector(0, 0, 1))
project_11 = Project(Curve=offset_curve_15, Brep=surface_2, Direction=Vector(0, 0, 1))
edge_surface_3 = EdgeSurface(CurveA=project_9, CurveB=project_8)
number_slider_8 = Slider(83, range=0..100)
edge_surface_4 = EdgeSurface(CurveA=project_11, CurveB=project_10)
end_points = EndPoints(Curve=project_11)  # -> Start, End
end_points_2 = EndPoints(Curve=project_9)  # -> Start, End
number_slider_9 = Slider(1, range=0..10)
line = Line(StartPoint=end_points_2.Start, EndPoint=end_points.End)
curve_middle = CurveMiddle(Curve=line)
length = Length(Curve=line)
unit_z_10 = UnitZ(Factor=Slider(0.018, range=0..1))
unit_z_11 = UnitZ(Factor=Slider(0.018, range=0..1))
division_2 = Division(A=length, B="-2")
addition_2 = Addition(A=number_slider_7, B=division_2)
offset_curve_16 = OffsetCurve(Curve=curve_6, Distance=addition_2, Plane=PlaneXY(0, 0, 0), Corners=1)
project_12 = Project(Curve=offset_curve_16, Brep=surface_2, Direction=Vector(0, 0, 1))
offset_curve_17 = OffsetCurve(Curve=project_12, Distance=multiplication_10, Plane=PlaneXY(0, 0, 0), Corners=1)
offset_curve_18 = OffsetCurve(Curve=project_12, Distance=number_slider_6, Plane=PlaneXY(0, 0, 0), Corners=1)
project_13 = Project(Curve=offset_curve_17, Brep=surface_2, Direction=Vector(0, 0, 1))
project_14 = Project(Curve=offset_curve_18, Brep=surface_2, Direction=Vector(0, 0, 1))
divide_distance_6 = DivideDistance(Curve=project_13, Distance=number_slider_9)  # -> flatten(Points), Tangents, Parameters
divide_distance_7 = DivideDistance(Curve=project_14, Distance=number_slider_9)  # -> flatten(Points), Tangents, Parameters
dispatch_5 = Dispatch(List=divide_distance_7.Points, DispatchPattern=[True, False])  # -> ListA, ListB
dispatch_6 = Dispatch(List=divide_distance_6.Points, DispatchPattern=[True, False])  # -> ListA, ListB
point_9 = Point(dispatch_5.ListA)
point_10 = Point(dispatch_5.ListB)
point_11 = Point(dispatch_6.ListA)
point_12 = Point(dispatch_6.ListB)
list_item_4 = ListItem(List=point_12, Index=Slider(0, range=0..100), Wrap=True)
_4point_surface_3 = _4PointSurface(CornerA=point_9, CornerB=point_10, CornerC=point_12, CornerD=point_11)
unit_z_12 = UnitZ(Factor=Slider(0.018, range=0..0.1))
extrude_6 = Extrude(Base=_4point_surface_3, Direction=unit_z_12)
extrude_7 = Extrude(Base=edge_surface_3, Direction=unit_z_11)
extrude_8 = Extrude(Base=edge_surface_4, Direction=unit_z_10)
geometry = Geometry([extrude_7, extrude_8, extrude_6])
