# Grasshopper definition Elk_Urban_Map_OSM.gh (Grasshopper 1.0.7)
# plug-ins: ElkGHComponents

file_path = FilePath("C:\Users\SHAFI.000\Desktop\COMPETITIONS\11.Tamayouz Dewan Award 15 October\Site gen\map.osm")
file_path_2 = FilePath("C:\Users\SHAFI.000\Desktop\COMPETITIONS\11.Tamayouz Dewan Award 15 October\Site gen\map.osm")
location = Location(FilePathText=file_path)  # -> OSMPointData, OSMFile, LongitudeDomain, LatitudeDomain
location_2 = Location(FilePText=file_path_2)  # -> OSMPointData, OSMData, LongitudeDomain, LatitudeDomain
panel = Panel(location_2.LatitudeDomain)
panel_2 = Panel(location.OSMFile)
osm_data = OSMData(
    OSMPointData=location.OSMPointData,
    OSMFilePath=location.OSMFile,
    Feature="highway",
    Generate3d=True,
    IndividualOutputs=True,
    SelectedTypes=["footway", "pedestrian", "primary", "residential", "secondary", "tertiary"])  # -> Footway, Pedestrian, Primary, Residential, Secondary, Tertiary, FeatureKey
polyline = PolyLine(Vertices=osm_data.Residential, Closed=False)
polyline_2 = PolyLine(Vertices=osm_data.Secondary, Closed=False)
polyline_3 = PolyLine(Vertices=osm_data.Tertiary, Closed=False)
panel_3 = Panel(osm_data.FeatureKey)
