# Grasshopper definition Galapagos_Script_Printer_Location.gh (Grasshopper 1.0.7)

number_slider = Slider(76.365, range=35..120)
number_slider_2 = Slider(96.803, range=10..175)
point = Point([Point(14.6142933, 7.96247482, 0), Point(14.6142933, 23.33714658, 0), Point(14.6142933, 38.71181834, 0), Point(14.6142933, 54.08649011, 0), Point(14.6142933, 69.46116187, 0), Point(14.6142933, 84.83583363, 0)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])
construct_point = ConstructPoint(XCoordinate=number_slider, YCoordinate=number_slider_2, ZCoordinate=0)
line = Line(StartPoint=construct_point, EndPoint=point)
length = Length(Curve=line)
mass_addition = MassAddition(Input=length)  # -> Result, PartialResults
panel = Panel(length)
galapagos = Galapagos(fitness=mass_addition, gene=[number_slider, number_slider_2])
panel_2 = Panel(mass_addition.Result)
