# Grasshopper definition Hexagon_in_Surface_Lunchbox.gh (Grasshopper 1.0.7)
# plug-ins: LunchBox

gene_pool = GenePool(Decimals=2, Maximum=100, Minimum=0, Value=[86.21, 55.78, 60.35, 88.8])
gene_pool_2 = GenePool(Decimals=2, Maximum=1000, Minimum=0, Value=[0, 223.55, 580.94, 816.79])
point = Point(Point(0, 0, 0))
xy_plane = XYPlane(Origin=point)
circle = Circle(Plane=xy_plane, Radius=gene_pool)
unit_z = UnitZ(Factor=gene_pool_2)
move = Move(Geometry=circle, Motion=unit_z)  # -> Geometry, Transform
loft = Loft(Curves=move.Geometry, Options={Adjust=False, Closed=False, LoftEnds=0, LoftSimp=0, LoftType=0, Rebuild=10, Refit=0.01})
dimensions = Dimensions(Surface=loft)  # -> UDimension, VDimension
rectangle = Rectangle(Plane=PlaneXY(0, 0, 0), XSize=dimensions.UDimension, YSize=dimensions.VDimension, Radius=0)  # -> Rectangle, Length
boundary_surfaces = BoundarySurfaces(Edges=rectangle.Rectangle)
hexagon_cells = HexagonCells(Surface=boundary_surfaces, UDivisions=Slider(64, range=0..100), VDivisions=Slider(39, range=0..100), TParameter=0.25)  # -> HexagonCells, Centers
scale = Scale(Geometry=hexagon_cells.HexagonCells, Center=hexagon_cells.Centers, Factor=Slider(0.88, range=0..1))  # -> Geometry, Transform
boundary_surfaces_2 = BoundarySurfaces(Edges=[boundary_surfaces, scale.Geometry])  # -> flatten(Surfaces)
list_length = ListLength(List=boundary_surfaces_2)
panel = Panel(list_length)
construct_domain = ConstructDomain(DomainStart=Slider(0, range=0..100), DomainEnd=panel)
random = Random(Range=construct_domain, Number=Slider(200, range=0..200), Seed=2)
cull_index = CullIndex(List=boundary_surfaces_2, Indices=random, Wrap=True)
boundary_surfaces_3 = BoundarySurfaces(Edges=cull_index)
unit_z_2 = UnitZ(Factor=Slider(6, range=0..100))
extrude = Extrude(Base=boundary_surfaces_3, Direction=unit_z_2)
number_slider = Slider(1, range=0..1)
box = Box(extrude)
surface_morph = SurfaceMorph(
    Geometry=extrude,
    Reference=box,
    Surface=reparameterize(loft),
    UDomain=number_slider,
    VDomain=number_slider,
    WDomain=number_slider)
