# Grasshopper definition Honeybee_IAB_requirements_project01_2023.gh (Grasshopper 1.0.7)
# plug-ins: Human, Bifocals

searchconstrs = HBSearchConstructions(keywords="wall")  # -> opaque_constrs, window_constrs, shade_constrs; plug-in component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
geometry = Geometry([<brep referenced from the Rhino model> x25])
searchconstrs_2 = HBSearchConstructions(keywords="exterior")  # -> opaque_constrs, window_constrs, shade_constrs; plug-in component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
searchconstrs_3 = HBSearchConstructions(keywords="interior")  # -> opaque_constrs, window_constrs, shade_constrs; plug-in component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
searchconstrs_4 = HBSearchConstructions(keywords="exterior")  # -> opaque_constrs, window_constrs, shade_constrs; plug-in component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
searchconstrs_5 = HBSearchConstructions(keywords="exterior")  # -> opaque_constrs, window_constrs, shade_constrs; plug-in component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
hb_building_programs = HBBuildingPrograms({"LargeOffice", "MediumOffice", "SmallOffice", "MidriseApartment", "HighriseApartment", "Retail", "StripMall", "PrimarySchool", "SecondarySchool", "SmallHotel", "LargeHotel", "Hospital", "Outpatient", "Laboratory", "Warehouse", "SuperMarket", "FullServiceRestaurant", "QuickServiceRestaurant", "Courthouse", "College", "LargeDataCenterHighITE", "LargeDataCenterLowITE", "SmallDataCenterHighITE", "SmallDataCenterLowITE"}, selected="LargeOffice")
brep = Brep([<brep referenced from the Rhino model> x18])
panel = Panel("https://climate.onebuilding.org/WMO_Region_2_Asia/BGD_Bangladesh/RP_Rangpur/BGD_RP_Dinajpur.418630_TMYx.zip")
geometry_2 = Geometry(<brep referenced from the Rhino model>)
item_selector = ItemSelector(
    searchconstrs.opaque_constrs,
    {"Adiabatic Wall", "Generic Exterior Wall", "Generic Interior Wall", "Generic Underground Wall", "Typical Insulated Basement Mass Wall", "Typical Insulated Basement Mass Wall-R10"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}, selected="Typical Insulated Exterior Mass Wall")
item_selector_2 = ItemSelector(
    searchconstrs_4.opaque_constrs,
    {"Adiabatic ExteriorFloor", "Generic Exterior Door", "Generic Exterior Wall", "Typical Insulated Exterior Mass Floor", "Typical Insulated Exterior Mass Floor Ceiling", "Typical Insulated Exterior Mass Floor-R10"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}, selected="Typical Insulated Wood Framed Exterior Floor-R38")
item_selector_3 = ItemSelector(
    searchconstrs_5.opaque_constrs,
    {"Adiabatic ExteriorFloor", "Generic Exterior Door", "Generic Exterior Wall", "Typical Insulated Exterior Mass Floor", "Typical Insulated Exterior Mass Floor Ceiling", "Typical Insulated Exterior Mass Floor-R10"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}, selected="Typical Insulated Exterior Mass Floor-R12")
item_selector_4 = ItemSelector(
    searchconstrs_2.opaque_constrs,
    {"Adiabatic ExteriorFloor", "Generic Exterior Door", "Generic Exterior Wall", "Typical Insulated Exterior Mass Floor", "Typical Insulated Exterior Mass Floor Ceiling", "Typical Insulated Exterior Mass Floor-R10"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}, selected="Typical Insulated Steel Framed Exterior Floor-R20")
downloadepw = LBDownloadWeather(weather_URL=panel)  # -> epw_file, stat_file, ddy_file; plug-in component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
number_slider = Slider(90, range=0..1000)
item_selector_5 = ItemSelector(
    searchconstrs_3.opaque_constrs,
    {"Generic Interior Ceiling", "Generic Interior Door", "Generic Interior Floor", "Generic Interior Wall", "Typical Insulated Interior Wall", "Typical Interior Ceiling", "Typical Interior Door", "Typical Interior Floor", "Typical Interior Partition", "Typical Interior Slab Floor", "Typical Interior Wall", "Typical Uninsulated Interior Wall"}, selected="Typical Interior Partition")
analysisperiod = LBAnalysisPeriod(
    start_month=Slider(1, range=0..10),
    start_day=simplify(Slider(1, range=-11..31)),
    start_hour=0,
    end_month=Slider(12, range=0..12),
    end_day=Slider(31, range=-11..31))  # -> period, hoys, dates; plug-in component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
importloc = LBImportLocation(epw_file=downloadepw.epw_file)  # -> location; plug-in component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
louvershades = HBLouverShades(
    shade_count=Slider(20, range=0..100),
    dist_between=Slider(0.757, range=0..1),
    facade_offset=Slider(1, range=0..1),
    angle=Slider(90, range=0..100),
    vertical=Toggle(True),
    indoor=Toggle(False),
    ep_constr=item_selector)  # -> readMe, hb_objs; plug-in component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
interiorsubset = HBInteriorConstructionSubset(interior_wall=item_selector_5)  # -> interior_set; plug-in component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
exteriorsubset = HBExteriorConstructionSubset(exterior_wall=item_selector_4, exterior_roof=item_selector_3, exposed_floor=item_selector_2)  # -> exterior_set; plug-in component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
sunpath = LBSunPath(location=importloc, hoys=analysisperiod.hoys, scale=Slider(1.708, range=0..2))  # -> out, vectors, altitudes, azimuths, hoys, sun_pts, analemma, daily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; plug-in component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
panel_2 = Panel(sunpath.title)

# ---- group: Interior Wall R value
decnstrconstr = HBDeconstructConstruction(constr=item_selector_5)  # -> materials, layers, r_val_si, r_val_ip, u_fac_si, u_fac_ip, shgc, t_sol, t_vis; plug-in component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
panel_3 = Panel(decnstrconstr.r_val_si)

# ---- group: Exterior Wall R value
decnstrconstr_2 = HBDeconstructConstruction(constr=item_selector_4)  # -> materials, layers, r_val_si, r_val_ip, u_fac_si, u_fac_ip, shgc, t_sol, t_vis; plug-in component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
panel_4 = Panel(decnstrconstr_2.r_val_si)

# ---- group: Roof R value
decnstrconstr_3 = HBDeconstructConstruction(constr=item_selector_2)  # -> materials, layers, r_val_si, r_val_ip, u_fac_si, u_fac_ip, shgc, t_sol, t_vis; plug-in component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
panel_5 = Panel(decnstrconstr_3.r_val_si)

# ---- group: Floor R value
decnstrconstr_4 = HBDeconstructConstruction(constr=item_selector_3)  # -> materials, layers, r_val_si, r_val_ip, u_fac_si, u_fac_ip, shgc, t_sol, t_vis; plug-in component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
panel_6 = Panel(decnstrconstr_4.r_val_si)

# ----
constructionset = HBConstructionSet(exterior_subset=exteriorsubset, interior_subset=interiorsubset)  # -> constr_set; plug-in component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
panel_7 = Panel(sunpath.vectors)
searchconstrs_6 = HBSearchConstructions(keywords="air")  # -> opaque_constrs, window_constrs, shade_constrs; plug-in component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
roomsolid = HBRoomFromSolid(
    geo=flatten(brep),
    name="Office Spaces",
    constr_set=constructionset,
    program=hb_building_programs,
    conditioned=Toggle(True))  # -> out, rooms; plug-in component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
directsunhours = LBDirectSunHours(
    vectors=flatten(sunpath.vectors),
    geometry=flatten([brep, geometry_2]),
    grid_size=Slider(69, range=0..100),
    offset_dist=Slider(10, range=0..100),
    run=Toggle(True))  # -> out, points, results, mesh, legend, title, int_mtx; plug-in component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
item_selector_6 = ItemSelector(searchconstrs_6.opaque_constrs, {"Generic Air Boundary"}, selected="Generic Air Boundary")
solveadj = HBSolveAdjacency(rooms=flatten(roomsolid.rooms), run=Toggle(True))  # -> out, adj_rooms; plug-in component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

searchschs = HBSearchSchedules(keywords="office")  # -> schedules, type_limits; plug-in component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
searchschs_2 = HBSearchSchedules(keywords="office")  # -> schedules, type_limits; plug-in component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
searchschs_3 = HBSearchSchedules(keywords="office")  # -> schedules, type_limits; plug-in component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
searchschs_4 = HBSearchSchedules(keywords="office")  # -> schedules, type_limits; plug-in component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
searchschs_5 = HBSearchSchedules(keywords="office")  # -> schedules, type_limits; plug-in component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
searchschs_6 = HBSearchSchedules(keywords="office")  # -> schedules, type_limits; plug-in component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
item_selector_7 = ItemSelector(
    searchschs.schedules,
    {"College BLDG_OCC_SCH_Offices", "Courthouse OFFICE_OCC_SCH", "Generic Office Cooling", "Generic Office Equipment", "Generic Office Heating", "Generic Office Infiltration"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}, selected="Generic Office Occupancy")
item_selector_8 = ItemSelector(
    searchschs_2.schedules,
    {"College BLDG_OCC_SCH_Offices", "Courthouse OFFICE_OCC_SCH", "Generic Office Cooling", "Generic Office Equipment", "Generic Office Heating", "Generic Office Infiltration"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}, selected="Office Activity")
item_selector_9 = ItemSelector(
    searchschs_3.schedules,
    {"College BLDG_OCC_SCH_Offices", "Courthouse OFFICE_OCC_SCH", "Generic Office Cooling", "Generic Office Equipment", "Generic Office Heating", "Generic Office Infiltration"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}, selected="Generic Office Lighting")
item_selector_10 = ItemSelector(
    searchschs_4.schedules,
    {"College BLDG_OCC_SCH_Offices", "Courthouse OFFICE_OCC_SCH", "Generic Office Cooling", "Generic Office Equipment", "Generic Office Heating", "Generic Office Infiltration"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}, selected="Generic Office Equipment")
item_selector_11 = ItemSelector(
    searchschs_5.schedules,
    {"College BLDG_OCC_SCH_Offices", "Courthouse OFFICE_OCC_SCH", "Generic Office Cooling", "Generic Office Equipment", "Generic Office Heating", "Generic Office Infiltration"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}, selected="Generic Office Infiltration")
item_selector_12 = ItemSelector(
    searchschs_6.schedules,
    {"College BLDG_OCC_SCH_Offices", "Courthouse OFFICE_OCC_SCH", "Generic Office Cooling", "Generic Office Equipment", "Generic Office Heating", "Generic Office Infiltration"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}, selected="Generic Office Cooling")
applyroomsch = HBApplyRoomSchedules(
    room_or_program=flatten(solveadj.adj_rooms),
    occupancy_sch=item_selector_7,
    activity_sch=item_selector_8,
    lighting_sch=item_selector_9,
    electric_equip_sch=item_selector_10,
    infiltration_sch=item_selector_11,
    ventilation_sch=item_selector_11,
    cooling_setpt_sch=item_selector_12)  # -> out, mod_obj; plug-in component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

exteriorsubset_2 = HBExteriorConstructionSubset(exterior_wall=item_selector_6)  # -> exterior_set; plug-in component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
number_slider_2 = Slider(6, range=0..10)
number_slider_3 = Slider(22, range=-11..31)
boolean_toggle = BooleanToggle(True)
simoutput = HBSimulationOutput(
    zone_energy_use=boolean_toggle,
    system_energy_use=boolean_toggle,
    gains_and_losses=boolean_toggle,
    comfort_metrics=boolean_toggle,
    surface_temperature=boolean_toggle,
    surface_energy_flow=boolean_toggle)  # -> out, sim_output; plug-in component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
panel_8 = Panel(simoutput.sim_output)
simcontrol = HBSimulationControl()  # -> sim_control; plug-in component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
analysisperiod_2 = LBAnalysisPeriod(start_month=number_slider_2, start_day=number_slider_3, start_hour=0, end_month=number_slider_2, end_day=number_slider_3)  # -> period, hoys, dates; plug-in component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
simpar = HBSimulationParameter(output=simoutput.sim_output, run_period=analysisperiod.period, timestep=6)  # -> sim_par; plug-in component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
geometry_3 = Geometry([<brep referenced from the Rhino model> x52])
aperture = HBAperture(geo=geometry_3, name="Double Glazing Low e Coating Glass Window", operable=Toggle(True))  # -> out, apertures; plug-in component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
annualloads = HBAnnualLoads(rooms=flatten(applyroomsch.mod_obj), epw_file=downloadepw.epw_file, run_bal=Toggle(False), run=Toggle(False))  # -> out, total_load, cooling, heating, lighting, equip, process, hot_water, balance; plug-in component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
model = HBModel(rooms=flatten(solveadj.adj_rooms), apertures=flatten(aperture.apertures))  # -> out, model; plug-in component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
panel_9 = Panel(annualloads.balance)
modeltoosm = HBModelToOSM(
    model=model.model,
    epw_file=downloadepw.epw_file,
    sim_par=simpar,
    folder="C:\Nesco duity",
    write=Toggle(True),
    run=Toggle(True))  # -> out, jsons, osw, osm, idf, sql, zsz, rdd, html; plug-in component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
panel_10 = Panel(modeltoosm.out)
vizbytype = HBVisualizeByType(hb_objs=model.model)  # -> walls, interior_walls, roofs, ceilings, exterior_floors, interior_floors, air_walls, apertures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; plug-in component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
faceresult = HBReadFaceResult(sql=modeltoosm.sql)  # -> face_indoor_temp, face_outdoor_temp, face_energy_flow; plug-in component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
roomenergyresult = HBReadRoomEnergyResult(sql=modeltoosm.sql)  # -> cooling, heating, lighting, electric_equip, gas_equip, process, hot_water, fan_electric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; plug-in component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

# ---- group: W
area = Area(Geometry=vizbytype.walls)  # -> Area, Centroid
area_2 = Area(Geometry=vizbytype.apertures)  # -> Area, Centroid
division = Division(A=area.Area, B=area_2.Area)
panel_11 = Panel(division)

# ----
legendpar = LBLegendParameters()  # -> leg_par; plug-in component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
colorfaces = HBColorFaces(data=flatten(faceresult.face_indoor_temp), hb_objs=flatten(applyroomsch.mod_obj))  # -> readMe, mesh, wire_frame, legend, title, faces, colors, values, vis_set; plug-in component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
roomcomfortresult = HBReadRoomComfortResult(sql=modeltoosm.sql)  # -> oper_temp, air_temp, rad_temp, rel_humidity, unmet_heat, unmet_cool; plug-in component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
panel_12 = Panel(roomenergyresult.solar_gain)
colorrooms = HBColorRooms(data=flatten(roomcomfortresult.rel_humidity), rooms_model=flatten(applyroomsch.mod_obj))  # -> readMe, mesh, wire_frame, legend, title, rooms, colors, values, vis_set; plug-in component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
loadbalance = HBThermalLoadBalance(
    rooms_model=flatten(model.model),
    cooling=roomenergyresult.cooling,
    lighting=roomenergyresult.lighting,
    electric_equip=roomenergyresult.electric_equip,
    people_gain=roomenergyresult.people_gain,
    solar_gain=roomenergyresult.solar_gain,
    mech_vent_load=roomenergyresult.mech_vent_load)  # -> out, balance, balance_stor, norm_bal, norm_bal_stor; plug-in component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
timeop = LBTimeIntervalOperation(data=loadbalance.balance)  # -> daily, monthly, mon_per_hr; plug-in component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
panel_13 = Panel(timeop.daily)
panel_14 = Panel(timeop.mon_per_hr)
construct_point = ConstructPoint(XCoordinate=0, YCoordinate=0, ZCoordinate=0)
monthlychart = LBMonthlyChart(data=timeop.mon_per_hr, base_pt=construct_point, x_dim=Slider(1302, range=0..10000), y_dim=Slider(3151, range=0..10000))  # -> out, data_mesh, data_lines, col_lines, legend, borders, labels, y_title, title, vis_set; plug-in component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
