# Grasshopper definition Honeybee_Insulator_Thermal_Analysis.gh (Grasshopper 1.0.7)

bldgprograms = Honeybee_bldgPrograms({"Office": 0, "Retail": 1, "MidriseApartment": 2, "PrimarySchool": 3, "SecondarySchool": 4, "SmallHotel": 5, "LargeHotel": 6, "Hospital": 7, "Outpatient": 8, "Warehouse": 9, "SuperMarket": 10, "FullServiceRestaurant": 11, "QuickServiceRestaurant": 12}, selected="Warehouse")
epglassmat = Honeybee_EnergyPlusGlassMaterial(
    name="Clear 6mm",
    thickness=Slider(0.006, range=0..1),
    solarTransmittance=Slider(0.775, range=0..2),
    solarReflectance=Slider(0.08, range=0..2000),
    visibleTransmittance=Slider(0.881, range=0..2000),
    frontEmissivity=Slider(0.08, range=0..1),
    backEmissivity=Slider(0.08, range=0..1),
    conductivity=Slider(0.9, range=0..1))  # -> EPMaterial; plug-in component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
epopaquemat = Honeybee_EnergyPlusOpaqueMaterial(
    name="Polystyrene_Insulator",
    roughness="MediumRough",
    thickness=Slider(0.05, range=0..1),
    conductivity=Slider(0.036, range=0..1),
    density=Slider(35, range=0..100),
    specificHeat=Slider(800, range=0..1000),
    thermAbsp=Slider(0.88, range=0..1),
    solAbsp=Slider(0.77, range=0..1),
    visAbsp=Slider(0.07, range=0..1))  # -> EPMaterial; plug-in component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
epopaquemat_2 = Honeybee_EnergyPlusOpaqueMaterial(
    name="Plaster",
    roughness="MediumRough",
    thickness=Slider(0.0063, range=0..0.02),
    conductivity=Slider(0.43, range=0..100),
    density=Slider(2374, range=0..10000),
    specificHeat=Slider(753.12, range=0..1000),
    thermAbsp=Slider(0.91, range=0..1),
    solAbsp=Slider(0.7, range=0..1),
    visAbsp=Slider(0.7, range=0..1))  # -> EPMaterial; plug-in component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
epopaquemat_3 = Honeybee_EnergyPlusOpaqueMaterial(
    name="CI_Sheet",
    roughness="Smooth",
    thickness=Slider(0.00047, range=0..0.01),
    conductivity=Slider(13, range=0..100),
    density=Slider(4167, range=0..10000),
    specificHeat=Slider(460, range=0..1000),
    thermAbsp=Slider(0.9, range=0..1),
    solAbsp=Slider(0.32, range=0..1))  # -> EPMaterial; plug-in component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
epopaquemat_4 = Honeybee_EnergyPlusOpaqueMaterial(
    name="Glass wool",
    roughness="MediumRough",
    thickness=Slider(0.025, range=0..1),
    conductivity=Slider(0.032, range=0..1),
    density=Slider(13.5, range=0..100),
    specificHeat=Slider(850, range=0..1000),
    thermAbsp=Slider(0.9, range=0..1),
    solAbsp=Slider(0.7, range=0..1),
    visAbsp=Slider(0.7, range=0..1))  # -> EPMaterial; plug-in component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
epopaquemat_5 = Honeybee_EnergyPlusOpaqueMaterial(
    name="Cork Sheet",
    roughness="Smooth",
    thickness=Slider(0.05, range=0..1),
    conductivity=Slider(0.04, range=0..1),
    density=Slider(150, range=0..500),
    specificHeat=Slider(2100, range=0..2100),
    thermAbsp=Slider(0.9, range=0..1),
    solAbsp=Slider(0.7, range=0..1),
    visAbsp=Slider(0.7, range=0..1))  # -> EPMaterial; plug-in component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
epopaquemat_6 = Honeybee_EnergyPlusOpaqueMaterial(
    name="Aluminium Foil Bubble Composite",
    roughness="Smooth",
    thickness=Slider(0.004, range=0..1),
    conductivity=Slider(0.04, range=0..1),
    density=Slider(93, range=0..100),
    specificHeat=Slider(932, range=0..1000),
    thermAbsp=Slider(0.9, range=0..1),
    solAbsp=Slider(0.7, range=0..1),
    visAbsp=Slider(0.07, range=0..1))  # -> EPMaterial; plug-in component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
brep = Brep([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])
listzoneprograms = Honeybee_ListZonePrograms(bldgProgram=bldgprograms)  # -> WarehouseZonePrograms; plug-in component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
honeybee = Honeybee_Honeybee()  # -> Vviiiiiiiiiizzz; plug-in component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
ladybug = Ladybug_Ladybug()  # -> Vviiiiiiiiiizzz; plug-in component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
addtoeplibrary = Honeybee_AddToEnergyPlusLibrary(EPObject=[epopaquemat, epopaquemat_3, epopaquemat_2], addToProjectLib=Toggle(True))  # -> readMe; plug-in component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
panel = Panel(addtoeplibrary)
addtoeplibrary_2 = Honeybee_AddToEnergyPlusLibrary(EPObject=epglassmat, addToProjectLib=Toggle(True))  # -> readMe; plug-in component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
addtoeplibrary_3 = Honeybee_AddToEnergyPlusLibrary(EPObject=[epopaquemat_6, epopaquemat_5, epopaquemat_4], addToProjectLib=Toggle(True))  # -> readMe; plug-in component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
panel_2 = Panel(addtoeplibrary_3)
item = ListItem(List=listzoneprograms, Index=Slider(1, range=0..10), Wrap=True)
panel_3 = Panel(listzoneprograms)
mass2zone = Honeybee_Masses2Zones(
    zoneMasses=flatten(brep),
    zoneNames="Factory_2nd_Floor",
    zonePrograms=item,
    maxRoofAngle=Slider(23, range=0..360),
    createHBZones=Toggle(True))  # -> readMe, HBZones; plug-in component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
callfromepconstrlibrary = Honeybee_CallFromEPConstructionLibrary(keywords="air")  # -> ThermMaterials, EPMaterials, EPWindowMaterials, EPConstructions; plug-in component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
callfromepconstrlibrary_2 = Honeybee_CallFromEPConstructionLibrary(keywords="clear 6mm")  # -> ThermMaterials, EPMaterials, EPWindowMaterials, EPConstructions; plug-in component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
callfromepconstrlibrary_3 = Honeybee_CallFromEPConstructionLibrary(keywords="CI_Sheet")  # -> ThermMaterials, EPMaterials, EPWindowMaterials, EPConstructions; plug-in component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
callfromepconstrlibrary_4 = Honeybee_CallFromEPConstructionLibrary(keywords="glass")  # -> ThermMaterials, EPMaterials, EPWindowMaterials, EPConstructions; plug-in component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
callfromepconstrlibrary_5 = Honeybee_CallFromEPConstructionLibrary(keywords="expanded")  # -> ThermMaterials, EPMaterials, EPWindowMaterials, EPConstructions; plug-in component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
callfromepconstrlibrary_6 = Honeybee_CallFromEPConstructionLibrary(keywords="Air Gap")  # -> ThermMaterials, EPMaterials, EPWindowMaterials, EPConstructions; plug-in component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
callfromepconstrlibrary_7 = Honeybee_CallFromEPConstructionLibrary(keywords="Plaster")  # -> ThermMaterials, EPMaterials, EPWindowMaterials, EPConstructions; plug-in component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
callfromepconstrlibrary_8 = Honeybee_CallFromEPConstructionLibrary(keywords="Brick")  # -> ThermMaterials, EPMaterials, EPWindowMaterials, EPConstructions; plug-in component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
callfromepconstrlibrary_9 = Honeybee_CallFromEPConstructionLibrary(keywords="Plaster")  # -> ThermMaterials, EPMaterials, EPWindowMaterials, EPConstructions; plug-in component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
callfromepconstrlibrary_10 = Honeybee_CallFromEPConstructionLibrary(keywords="Floor Tiles")  # -> ThermMaterials, EPMaterials, EPWindowMaterials, EPConstructions; plug-in component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
callfromepconstrlibrary_11 = Honeybee_CallFromEPConstructionLibrary(keywords="R.C.C")  # -> ThermMaterials, EPMaterials, EPWindowMaterials, EPConstructions; plug-in component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
callfromepconstrlibrary_12 = Honeybee_CallFromEPConstructionLibrary(keywords="Plaster")  # -> ThermMaterials, EPMaterials, EPWindowMaterials, EPConstructions; plug-in component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
panel_4 = Panel(mass2zone.readMe)
panel_5 = Panel(mass2zone.HBZones)
solveadjc = Honeybee_SolveAdjacencies(
    HBZones=flatten(mass2zone.HBZones),
    altConstruction=callfromepconstrlibrary.EPConstructions,
    removeCurrentAdjc=False,
    findAdjc=Toggle(True))  # -> readMe, HBZonesWADJ; plug-in component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
number_slider = Slider(0.469, range=0..1)
panel_6 = Panel(callfromepconstrlibrary.EPConstructions)
panel_7 = Panel(callfromepconstrlibrary_2.EPWindowMaterials)
panel_8 = Panel(callfromepconstrlibrary_4.ThermMaterials)
panel_9 = Panel(callfromepconstrlibrary_10.EPMaterials)
panel_10 = Panel(callfromepconstrlibrary_6.EPMaterials)
panel_11 = Panel(callfromepconstrlibrary_5.EPMaterials)
series = Series(Start=Slider(9, range=0..20), Step=Slider(1, range=0..1), Count=Slider(12, range=0..100))
series_2 = Series(Start=Slider(1, range=0..1), Step=Slider(1, range=0..1), Count=Slider(6, range=0..100))
item_2 = ListItem(List=callfromepconstrlibrary_8.EPMaterials, Index=Slider(0, range=0..100), Wrap=True)
glzparamlist = Honeybee_GlazingParametersList(northGlzParam=number_slider, westGlzParam=0, southGlzParam=number_slider, eastGlzParam=0)  # -> glzParamList; plug-in component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
item_3 = ListItem(List=callfromepconstrlibrary_11.EPMaterials, Index=Slider(0, range=0..100), Wrap=True)
item_4 = ListItem(List=solveadjc.HBZonesWADJ, Index=[series_2, series], Wrap=True)
epconstruction = Honeybee_EnergyPlusConstruction(name="Glass window", layer_1=callfromepconstrlibrary_2.EPWindowMaterials)  # -> EPConstruction; plug-in component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
epconstruction_2 = Honeybee_EnergyPlusConstruction(
    name="CI_Sheet",
    layer_1=callfromepconstrlibrary_3.EPMaterials,
    layer_2=callfromepconstrlibrary_5.EPMaterials,
    layer_3=callfromepconstrlibrary_3.EPMaterials,
    layer_4=callfromepconstrlibrary_4.EPMaterials)  # -> EPConstruction; plug-in component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
epconstruction_3 = Honeybee_EnergyPlusConstruction(
    name="127mm_Wall",
    layer_1=callfromepconstrlibrary_7.EPMaterials,
    layer_2=item_2,
    layer_3=callfromepconstrlibrary_9.EPMaterials)  # -> EPConstruction; plug-in component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
epconstruction_4 = Honeybee_EnergyPlusConstruction(
    name="150mm R.C.C Slab",
    layer_1=callfromepconstrlibrary_10.EPMaterials,
    layer_2=item_3,
    layer_3=callfromepconstrlibrary_12.EPMaterials)  # -> EPConstruction; plug-in component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
number_slider_2 = Slider(0.2, range=0..1)
glazingcreator = Honeybee_GlazingBasedOnRatio(
    HBObjects=item_4,
    glzRatio=glzparamlist,
    breakUpWindow=Toggle(True),
    breakUpDist=Slider(6.454, range=0..10),
    windowHeight=Slider(1.266, range=0..10),
    sillHeight=Slider(0.605, range=0..10),
    splitGlzVertDist=Slider(0, range=0..10),
    runIt=Toggle(True))  # -> readMe, HBObjWGLZ; plug-in component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
item_5 = ListItem(List=solveadjc.HBZonesWADJ, Index=Slider(0, range=0..21), Wrap=True)
series_3 = Series(Start=Slider(7, range=0..20), Step=Slider(1, range=0..1), Count=Slider(2, range=0..100))
glzparamlist_2 = Honeybee_GlazingParametersList(northGlzParam=number_slider_2, westGlzParam=0, southGlzParam=number_slider_2, eastGlzParam=0)  # -> glzParamList; plug-in component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
item_6 = ListItem(List=solveadjc.HBZonesWADJ, Index=series_3, Wrap=True)
glazingcreator_2 = Honeybee_GlazingBasedOnRatio(HBObjects=item_6, glzRatio=Slider(0, range=0..1), runIt=Toggle(True))  # -> readMe, HBObjWGLZ; plug-in component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
glazingcreator_3 = Honeybee_GlazingBasedOnRatio(
    HBObjects=item_5,
    glzRatio=glzparamlist_2,
    breakUpWindow=Toggle(True),
    breakUpDist=Slider(7.822, range=0..10),
    windowHeight=Slider(1.746, range=0..10),
    sillHeight=Slider(1.237, range=0..10),
    splitGlzVertDist=Slider(0, range=0..10),
    runIt=Toggle(True))  # -> readMe, HBObjWGLZ; plug-in component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
epopaquemat_7 = Honeybee_EnergyPlusOpaqueMaterial(
    name="Expanded Polystyrene",
    roughness="Smooth",
    thickness=Slider(0.075, range=0..0.1),
    conductivity=Slider(0.036, range=0..100),
    density=Slider(35, range=0..10000),
    specificHeat=Slider(800, range=0..1000),
    thermAbsp=Slider(0.9, range=0..1),
    solAbsp=Slider(0.7, range=0..1),
    visAbsp=Slider(0.7, range=0..1))  # -> EPMaterial; plug-in component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
epopaquemat_8 = Honeybee_EnergyPlusOpaqueMaterial(
    name="Aluminum Foil",
    roughness="Smooth",
    thickness=Slider(0.0002, range=0..0.1),
    conductivity=Slider(0.896, range=0..100),
    density=Slider(2689, range=0..10000),
    specificHeat=Slider(167, range=0..2500),
    thermAbsp=Slider(0.2, range=0..1),
    solAbsp=Slider(0.7, range=0..1),
    visAbsp=Slider(0.7, range=0..1))  # -> EPMaterial; plug-in component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
epopaquemat_9 = Honeybee_EnergyPlusOpaqueMaterial(
    name="Brick",
    roughness="MediumRough",
    thickness=Slider(0.127, range=0..0.5),
    conductivity=Slider(0.48, range=0..10),
    density=Slider(1690.108, range=0..10000),
    specificHeat=Slider(1338.88, range=0..2000),
    thermAbsp=Slider(0.9, range=0..1),
    solAbsp=Slider(0.7, range=0..1),
    visAbsp=Slider(0.7, range=0..1))  # -> EPMaterial; plug-in component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
epopaquemat_10 = Honeybee_EnergyPlusOpaqueMaterial(
    name="R.C.C",
    roughness="Rough",
    thickness=Slider(0.15, range=0..0.5),
    conductivity=Slider(1.34, range=0..100),
    density=Slider(2487.667, range=0..10000),
    specificHeat=Slider(669.44, range=0..1000),
    thermAbsp=Slider(0.9, range=0..1),
    solAbsp=Slider(0.7, range=0..1),
    visAbsp=Slider(0.7, range=0..1))  # -> EPMaterial; plug-in component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
epopaquemat_11 = Honeybee_EnergyPlusOpaqueMaterial(
    name="Floor Tiles",
    roughness="Smooth",
    thickness=Slider(0.00063, range=0..1),
    conductivity=Slider(1.12, range=0..2),
    density=Slider(1763.633, range=0..2000),
    specificHeat=Slider(1213.36, range=0..2000),
    thermAbsp=Slider(0.9, range=0..1),
    solAbsp=Slider(0.7, range=0..1),
    visAbsp=Slider(0.7, range=0..1))  # -> EPMaterial; plug-in component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
decomposebytype = Honeybee_DecomposeBasedOnType(HBZone=[glazingcreator_3.HBObjWGLZ, glazingcreator_2.HBObjWGLZ])  # -> walls, interiorWalls, airWalls, windows, interiorWindows, skylights, roofs, ceilings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; plug-in component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
decomposebytype_2 = Honeybee_DecomposeBasedOnType(HBZone=glazingcreator.HBObjWGLZ)  # -> walls, interiorWalls, airWalls, windows, interiorWindows, skylights, roofs, ceilings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; plug-in component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
setepzonecnstr = Honeybee_SetEPZoneConstruction(
    HBZones=flatten([glazingcreator_3.HBObjWGLZ, glazingcreator_2.HBObjWGLZ, glazingcreator.HBObjWGLZ]),
    wallEPConstruction=epconstruction_3,
    windowEPConstruction=epconstruction,
    roofEPConstruction=epconstruction_2,
    floorEPConstruction=epconstruction_4,
    expFloorEPConstruction=epconstruction_4)  # -> simplify(modifiedHBZones); plug-in component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
addtoeplibrary_4 = Honeybee_AddToEnergyPlusLibrary(EPObject=epopaquemat_11, addToProjectLib=Toggle(True))  # -> readMe; plug-in component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
addtoeplibrary_5 = Honeybee_AddToEnergyPlusLibrary(EPObject=[epopaquemat_10, epopaquemat_9], addToProjectLib=Toggle(True))  # -> readMe; plug-in component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
panel_12 = Panel(addtoeplibrary_5)
brep_2 = Brep(decomposebytype.roofs)
brep_3 = Brep(decomposebytype.exposedFloors)
brep_4 = Brep(decomposebytype.walls)
brep_5 = Brep(decomposebytype.windows)
brep_6 = Brep(decomposebytype_2.walls)
brep_7 = Brep(decomposebytype_2.windows)
brep_8 = Brep(decomposebytype_2.roofs)
brep_9 = Brep(decomposebytype_2.exposedFloors)
epopaquemat_12 = Honeybee_EnergyPlusOpaqueMaterial(
    name="Polyethylene Foam",
    roughness="Smooth",
    thickness=Slider(0.006, range=0..0.1),
    conductivity=Slider(0.031, range=0..100),
    density=Slider(55, range=0..10000),
    specificHeat=Slider(800, range=0..1000),
    thermAbsp=Slider(0.9, range=0..1),
    solAbsp=Slider(0.7, range=0..1),
    visAbsp=Slider(0.7, range=0..1))  # -> EPMaterial; plug-in component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
epopaquemat_13 = Honeybee_EnergyPlusOpaqueMaterial(
    name="Air Bubble Sheet",
    roughness="Smooth",
    thickness=Slider(0.012, range=0..0.1),
    conductivity=Slider(0.04, range=0..100),
    density=Slider(93, range=0..10000),
    specificHeat=Slider(932, range=0..2500),
    thermAbsp=Slider(0.9, range=0..1),
    solAbsp=Slider(0.7, range=0..1),
    visAbsp=Slider(0.7, range=0..1))  # -> EPMaterial; plug-in component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
preview = CustomPreview(Geometry=brep_4, Material=ColourSwatch(SwatchColor=RGB(181, 175, 125)))
preview_2 = CustomPreview(Geometry=brep_5, Material=ColourSwatch(SwatchColor=RGBA(116, 158, 178, 110)))
preview_3 = CustomPreview(Geometry=brep_2, Material=ColourSwatch(SwatchColor=RGB(94, 75, 34)))
preview_4 = CustomPreview(Geometry=brep_3, Material=ColourSwatch(SwatchColor=RGB(79, 69, 37)))
preview_5 = CustomPreview(Geometry=brep_6, Material=ColourSwatch(SwatchColor=RGB(214, 206, 135)))
preview_6 = CustomPreview(Geometry=brep_7, Material=ColourSwatch(SwatchColor=RGBA(125, 166, 181, 110)))
preview_7 = CustomPreview(Geometry=brep_8, Material=ColourSwatch(SwatchColor=RGB(94, 75, 34)))
preview_8 = CustomPreview(Geometry=brep_9, Material=ColourSwatch(SwatchColor=RGB(0, 0, 0)))
division = Division(A=Slider(1090, range=0..10000), B=Slider(836.209, range=0..1000))
setepzoneloads = Honeybee_SetEnergyPlusZoneLoads(
    HBZones=setepzonecnstr,
    equipmentLoadPerArea=Slider(15, range=0..100),
    infilRatePerArea_Facade=Slider(0.000285, range=0..0.001),
    lightingDensityPerArea=Slider(11.2, range=0..100),
    numOfPeoplePerArea=division,
    ventilationPerArea=Slider(0.0002, range=0..0.001),
    recirculatedAirPerArea=Slider(0.001, range=0..0.001))  # -> loads, HBZones; plug-in component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
epopaquemat_14 = Honeybee_EnergyPlusOpaqueMaterial(
    name="Cork Sheet",
    roughness="Smooth",
    thickness=Slider(0.012, range=0..0.1),
    conductivity=Slider(0.04, range=0..100),
    density=Slider(150, range=0..10000),
    specificHeat=Slider(2100, range=0..2500),
    thermAbsp=Slider(0.9, range=0..1),
    solAbsp=Slider(0.7, range=0..1),
    visAbsp=Slider(0.7, range=0..1))  # -> EPMaterial; plug-in component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
epopaquemat_15 = Honeybee_EnergyPlusOpaqueMaterial(
    name="Aerogel",
    roughness="Smooth",
    thickness=Slider(0.05, range=0..0.1),
    conductivity=Slider(0.015, range=0..100),
    density=Slider(150, range=0..10000),
    specificHeat=Slider(1000, range=0..2500),
    thermAbsp=Slider(0.9, range=0..1),
    solAbsp=Slider(0.7, range=0..1),
    visAbsp=Slider(0.7, range=0..1))  # -> EPMaterial; plug-in component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
panel_13 = Panel(setepzoneloads.loads)
setepzonethresholds = Honeybee_SetEnergyPlusZoneThresholds(
    HBZones=setepzoneloads.HBZones,
    coolingSetPt=Slider(26, range=0..40),
    heatingSetPt=Slider(18, range=0..100),
    maxHumidity=Slider(90, range=0..100),
    minHumidity=Slider(20, range=0..100))  # -> readMe, HBZones; plug-in component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
epopaquemat_16 = Honeybee_EnergyPlusOpaqueMaterial(
    name="Mineralized Wood",
    roughness="Smooth",
    thickness=Slider(0.067, range=0..0.1),
    conductivity=Slider(0.04, range=0..100),
    density=Slider(400, range=0..10000),
    specificHeat=Slider(2100, range=0..2500),
    thermAbsp=Slider(0.9, range=0..1),
    solAbsp=Slider(0.7, range=0..1),
    visAbsp=Slider(0.7, range=0..1))  # -> EPMaterial; plug-in component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
epopaquemat_17 = Honeybee_EnergyPlusOpaqueMaterial(
    name="Air Gap",
    roughness="Smooth",
    thickness=Slider(0.05, range=0..0.6),
    conductivity=Slider(0.026, range=0..100),
    density=Slider(1.2, range=0..10000),
    specificHeat=Slider(1006, range=0..2500),
    thermAbsp=Slider(0.9, range=0..1),
    solAbsp=Slider(0.7, range=0..1),
    visAbsp=Slider(0.7, range=0..1))  # -> EPMaterial; plug-in component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
addtoeplibrary_6 = Honeybee_AddToEnergyPlusLibrary(
    EPObject=[epopaquemat_12, epopaquemat_7, epopaquemat_14, epopaquemat_16, epopaquemat_17, epopaquemat_15, epopaquemat_8, epopaquemat_13],
    addToProjectLib=Toggle(True))  # -> out; plug-in component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
panel_14 = Panel(addtoeplibrary_6)
panel_15 = Panel("""0
0
0
0
0
0
0
0
1
1
1
1
1
1
1
1
1
0
0
0
0
0
0
0""")
setepnatvent = Honeybee_SetEPAirFlow(
    HBZones=flatten(setepzonethresholds.HBZones),
    naturalVentilationType=Slider(1, range=0..3),
    minIndoorTempForNatVent=Slider(8, range=0..10),
    maxIndoorTempForNatVent=Slider(100, range=0..100),
    minOutdoorTempForNatVent=Slider(-100, range=-100..100),
    maxOutdoorTempForNatVent=Slider(100, range=0..100),
    fractionOfGlzAreaOperable=Slider(0.5, range=0..1),
    windDrivenCrossVent=Toggle(True))  # -> readMe, simplify(HBZones); plug-in component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
toggle = BooleanToggle(True)
dup = DuplicateData(Data=panel_15, Number="365", Order=True)
data = Data(dup)
csvschedule = Honeybee_CreateCSVSchedule(values=data, scheduleName="Factory_Occupancy_Scedule ", writeFile=toggle)  # -> readMe, csvSchedule; plug-in component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
panel_16 = Panel(data)
csvschedule_2 = Honeybee_CreateCSVSchedule(values=data, scheduleName="Factory_Equipment_Scedule ", writeFile=toggle)  # -> readMe, csvSchedule; plug-in component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
toggle_2 = BooleanToggle(False)
panel_17 = Panel(csvschedule_2.csvSchedule)
panel_18 = Panel(csvschedule.csvSchedule)
epoutput = Honeybee_GenerateEPOutput(
    zoneEnergyUse=toggle_2,
    zoneGainsAndLosses=Toggle(False),
    zoneComfortMetrics=Toggle(True),
    comfortMapVariables=toggle_2,
    zoneHVACParams=toggle_2,
    surfaceTempAnalysis=toggle_2,
    glazingSolarAnalysis=toggle_2,
    timestep="hourly")  # -> report, flatten(simulationOutputs); plug-in component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
analysisperiod = Ladybug_AnalysisPeriod(
    fromMonth=Slider(4, range=0..12),
    fromDay=Slider(1, range=0..31),
    fromHour=Slider(1, range=0..24),
    toMonth=Slider(7, range=0..12),
    toDay=Slider(31, range=0..31),
    toHour=Slider(24, range=0..24))  # -> readMe, analysisPeriod; plug-in component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
panel_19 = Panel("http://climate.onebuilding.org/WMO_Region_2_Asia/BGD_Bangladesh/DH_Dhaka/BGD_DH_Dhaka-Shahjalal.Intl.AP.419220_TMYx.zip")
downloadepw = Ladybug_downloadEPWWeatherFile(download=Toggle(False))  # -> readMe; plug-in component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
setepzoneschedules = Honeybee_SetEnergyPlusZoneSchedules(
    HBZones=setepnatvent.HBZones,
    occupancySchedules=csvschedule.csvSchedule,
    occupancyActivitySchs=csvschedule.csvSchedule,
    heatingSetPtSchedules=csvschedule.csvSchedule,
    coolingSetPtSchedules=csvschedule.csvSchedule,
    lightingSchedules=csvschedule_2.csvSchedule,
    equipmentSchedules=csvschedule_2.csvSchedule,
    infiltrationSchedules=csvschedule.csvSchedule,
    ventilationSchedules=csvschedule.csvSchedule)  # -> schedules, simplify(HBZones); plug-in component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
panel_20 = Panel(".47mm_White_CI_Sheet_75mm_Expanded_Polystyrene_.42mm_White_CI_Sheet_6mm_Glass_False_roof")
panel_21 = Panel(epoutput.simulationOutputs)
energysimpar = Honeybee_EnergySimulationPar(timestep=6, solarDistribution="4")  # -> energySimPar; plug-in component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
epw_stat = Ladybug_OpenEPWAndSTATWeatherFiles(weatherFileURL=panel_19)  # -> epwFile, statFile; plug-in component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
panel_22 = Panel(epw_stat.epwFile)
series_4 = Series(Start=Slider(2159, range=0..10000), Step=Slider(1, range=0..1), Count=Slider(2928, range=0..10000))
panel_23 = Panel(setepzoneschedules.schedules)
importepw = Ladybug_ImportEpw(epwFile=epw_stat.epwFile)  # -> readMe, latitude, location, dryBulbTemperature, dewPointTemperature, relativeHumidity, windSpeed, windDirection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; plug-in component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
panel_24 = Panel(series_4)
runenergysimulation = Honeybee_RunEnergySimulation(
    epwFile=epw_stat.epwFile,
    analysisPeriod=analysisperiod.analysisPeriod,
    energySimPar=energysimpar,
    HBZones=flatten(setepnatvent.HBZones),
    simulationOutputs=flatten(epoutput.simulationOutputs),
    writeIdf=Toggle(True),
    runEnergyPlus=Toggle(False),
    idfFileName=panel_20)  # -> readMe, idfFileAddress, resultFileAddress, eioFileAddress, rddFileAddress, htmlReport, studyFolder; plug-in component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
strnum = Ladybug_SeparateData(inputList=flatten(importepw.dryBulbTemperature))  # -> numbers, strings; plug-in component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
branchdatadailymonthlyhourly = Ladybug_BranchData(data=importepw.dryBulbTemperature, HOY=panel_24)  # -> dataEachDayOfYear, dataEachMonth, dataEachHourOfDay; plug-in component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
panel_25 = Panel(branchdatadailymonthlyhourly.dataEachHourOfDay)
panel_26 = Panel(runenergysimulation.readMe)
panel_27 = Panel(importepw.relativeHumidity)
panel_28 = Panel(strnum.numbers)
strnum_2 = Ladybug_SeparateData(inputList=flatten(panel_27))  # -> numbers, strings; plug-in component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
list_item = ListItem(List=panel_28, Index=series_4, Wrap=True)
relative_humidity = Panel(strnum_2.numbers)
list_item_2 = ListItem(List=relative_humidity, Index=series_4, Wrap=True)
outdoor_air_temperature = Panel(list_item)
outdoor_relative_humidity = Panel(list_item_2)
