# Grasshopper definition Impact_Analysis_of_Metal_Roofing_Honeybee.gh (Grasshopper 1.0.7)

epopaquemat = Honeybee_EnergyPlusOpaqueMaterial(
    name="CI_Sheet",
    roughness="Smooth",
    thickness=Slider(0.00063, range=0..0.01),
    conductivity=Slider(13, range=0..100),
    density=Slider(4167, range=0..10000),
    specificHeat=Slider(460, range=0..1000),
    thermAbsp=Slider(0.9, range=0..1),
    solAbsp=Slider(0.43, range=0..1))  # -> EPMaterial; plug-in component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
epopaquemat_2 = Honeybee_EnergyPlusOpaqueMaterial(
    name="Polystyrene_Insulator",
    roughness="MediumRough",
    thickness=Slider(0.05, range=0..1),
    conductivity=Slider(0.036, range=0..1),
    density=Slider(35, range=0..100),
    specificHeat=Slider(800, range=0..1000),
    thermAbsp=Slider(0.88, range=0..1),
    solAbsp=Slider(0.77, range=0..1),
    visAbsp=Slider(0.07, range=0..1))  # -> EPMaterial; plug-in component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
epopaquemat_3 = Honeybee_EnergyPlusOpaqueMaterial(
    name="Plaster",
    roughness="MediumRough",
    thickness=Slider(0.0063, range=0..0.02),
    conductivity=Slider(0.43, range=0..100),
    density=Slider(2374, range=0..10000),
    specificHeat=Slider(753.12, range=0..1000),
    thermAbsp=Slider(0.91, range=0..1),
    solAbsp=Slider(0.7, range=0..1),
    visAbsp=Slider(0.7, range=0..1))  # -> EPMaterial; plug-in component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
epglassmat = Honeybee_EnergyPlusGlassMaterial(
    name="Clear 6mm",
    thickness=Slider(0.006, range=0..1),
    solarTransmittance=Slider(0.775, range=0..2),
    solarReflectance=Slider(0.08, range=0..2000),
    visibleTransmittance=Slider(0.881, range=0..2000),
    frontEmissivity=Slider(0.08, range=0..1),
    backEmissivity=Slider(0.08, range=0..1),
    conductivity=Slider(0.9, range=0..1))  # -> EPMaterial; plug-in component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
epopaquemat_4 = Honeybee_EnergyPlusOpaqueMaterial(
    name="Aluminium Foil Bubble Composite",
    roughness="Smooth",
    thickness=Slider(0.004, range=0..1),
    conductivity=Slider(0.04, range=0..1),
    density=Slider(93, range=0..100),
    specificHeat=Slider(932, range=0..1000),
    thermAbsp=Slider(0.9, range=0..1),
    solAbsp=Slider(0.7, range=0..1),
    visAbsp=Slider(0.07, range=0..1))  # -> EPMaterial; plug-in component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
epopaquemat_5 = Honeybee_EnergyPlusOpaqueMaterial(
    name="Cork Sheet",
    roughness="Smooth",
    thickness=Slider(0.05, range=0..1),
    conductivity=Slider(0.04, range=0..1),
    density=Slider(150, range=0..500),
    specificHeat=Slider(2100, range=0..2100),
    thermAbsp=Slider(0.9, range=0..1),
    solAbsp=Slider(0.7, range=0..1),
    visAbsp=Slider(0.7, range=0..1))  # -> EPMaterial; plug-in component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
epopaquemat_6 = Honeybee_EnergyPlusOpaqueMaterial(
    name="Glass wool",
    roughness="MediumRough",
    thickness=Slider(0.025, range=0..1),
    conductivity=Slider(0.032, range=0..1),
    density=Slider(13.5, range=0..100),
    specificHeat=Slider(850, range=0..1000),
    thermAbsp=Slider(0.9, range=0..1),
    solAbsp=Slider(0.7, range=0..1),
    visAbsp=Slider(0.7, range=0..1))  # -> EPMaterial; plug-in component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
addtoeplibrary = Honeybee_AddToEnergyPlusLibrary(EPObject=[epopaquemat_2, epopaquemat, epopaquemat_3], addToProjectLib=Toggle(True))  # -> readMe; plug-in component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
addtoeplibrary_2 = Honeybee_AddToEnergyPlusLibrary(EPObject=epglassmat, addToProjectLib=Toggle(True))  # -> readMe; plug-in component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
addtoeplibrary_3 = Honeybee_AddToEnergyPlusLibrary(EPObject=[epopaquemat_4, epopaquemat_5, epopaquemat_6], addToProjectLib=Toggle(True))  # -> readMe; plug-in component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
cluster = Cluster()
bldgprograms = Honeybee_bldgPrograms({"Office": 0, "Retail": 1, "MidriseApartment": 2, "PrimarySchool": 3, "SecondarySchool": 4, "SmallHotel": 5, "LargeHotel": 6, "Hospital": 7, "Outpatient": 8, "Warehouse": 9, "SuperMarket": 10, "FullServiceRestaurant": 11, "QuickServiceRestaurant": 12}, selected="Warehouse")
bldgprograms_2 = Honeybee_bldgPrograms({"Office": 0, "Retail": 1, "MidriseApartment": 2, "PrimarySchool": 3, "SecondarySchool": 4, "SmallHotel": 5, "LargeHotel": 6, "Hospital": 7, "Outpatient": 8, "Warehouse": 9, "SuperMarket": 10, "FullServiceRestaurant": 11, "QuickServiceRestaurant": 12}, selected="Warehouse")
bldgprograms_3 = Honeybee_bldgPrograms({"Office": 0, "Retail": 1, "MidriseApartment": 2, "PrimarySchool": 3, "SecondarySchool": 4, "SmallHotel": 5, "LargeHotel": 6, "Hospital": 7, "Outpatient": 8, "Warehouse": 9, "SuperMarket": 10, "FullServiceRestaurant": 11, "QuickServiceRestaurant": 12}, selected="Warehouse")
ladybug = Ladybug_Ladybug()  # -> Vviiiiiiiiiizzz; plug-in component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
honeybee = Honeybee_Honeybee()  # -> Vviiiiiiiiiizzz; plug-in component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
bldgprograms_4 = Honeybee_bldgPrograms({"Office": 0, "Retail": 1, "MidriseApartment": 2, "PrimarySchool": 3, "SecondarySchool": 4, "SmallHotel": 5, "LargeHotel": 6, "Hospital": 7, "Outpatient": 8, "Warehouse": 9, "SuperMarket": 10, "FullServiceRestaurant": 11, "QuickServiceRestaurant": 12}, selected="Warehouse")
roof = Geometry(<brep referenced from the Rhino model>)
listzoneprograms = Honeybee_ListZonePrograms(bldgProgram=bldgprograms)  # -> WarehouseZonePrograms; plug-in component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
listzoneprograms_2 = Honeybee_ListZonePrograms(bldgProgram=bldgprograms_2)  # -> WarehouseZonePrograms; plug-in component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
listzoneprograms_3 = Honeybee_ListZonePrograms(bldgProgram=bldgprograms_3)  # -> WarehouseZonePrograms; plug-in component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
geometry = Geometry([<brep referenced from the Rhino model> x3])
callfromepconstrlibrary = Honeybee_CallFromEPConstructionLibrary(keywords="Interior wall")  # -> ThermMaterials, EPMaterials, EPWindowMaterials, EPConstructions; plug-in component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
listzoneprograms_4 = Honeybee_ListZonePrograms(bldgProgram=bldgprograms_4)  # -> WarehouseZonePrograms; plug-in component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
callfromepconstrlibrary_2 = Honeybee_CallFromEPConstructionLibrary(keywords="Interior wall")  # -> ThermMaterials, EPMaterials, EPWindowMaterials, EPConstructions; plug-in component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
callfromepconstrlibrary_3 = Honeybee_CallFromEPConstructionLibrary(keywords="Interior wall")  # -> ThermMaterials, EPMaterials, EPWindowMaterials, EPConstructions; plug-in component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
geometry_2 = Geometry([<brep referenced from the Rhino model> x3])
geometry_3 = Geometry([<brep referenced from the Rhino model> x3])
list_item = ListItem(List=listzoneprograms_2, Index=Slider(2, range=0..20), Wrap=True)
panel = Panel(callfromepconstrlibrary.EPConstructions)
list_item_2 = ListItem(List=listzoneprograms_3, Index=Slider(2, range=0..20), Wrap=True)
list_item_3 = ListItem(List=listzoneprograms, Index=Slider(2, range=0..20), Wrap=True)
list_item_4 = ListItem(List=listzoneprograms_4, Index=Slider(2, range=0..20), Wrap=True)
panel_2 = Panel(callfromepconstrlibrary_2.EPConstructions)
panel_3 = Panel(listzoneprograms_2)
mass2zone = Honeybee_Masses2Zones(
    zoneMasses=flatten(geometry),
    zoneNames="Factory_Ground_Floor",
    zonePrograms=list_item,
    maxRoofAngle=30,
    createHBZones=Toggle(True))  # -> out, HBZones; plug-in component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
mass2zone_2 = Honeybee_Masses2Zones(
    zoneMasses=flatten(geometry_2),
    zoneNames="Factory_First_Floor",
    zonePrograms=list_item_4,
    maxRoofAngle=30,
    createHBZones=Toggle(True))  # -> out, HBZones; plug-in component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
mass2zone_3 = Honeybee_Masses2Zones(zoneMasses=flatten(roof), zoneNames="Roof", zonePrograms=list_item_2, maxRoofAngle=30, createHBZones=Toggle(True))  # -> out, HBZones; plug-in component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
mass2zone_4 = Honeybee_Masses2Zones(
    zoneMasses=flatten(geometry_3),
    zoneNames="Factory_Second_Floor",
    zonePrograms=list_item_3,
    maxRoofAngle=30,
    createHBZones=Toggle(True))  # -> out, HBZones; plug-in component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
panel_4 = Panel(callfromepconstrlibrary_3.EPConstructions)
panel_5 = Panel(listzoneprograms_4)
panel_6 = Panel(listzoneprograms_3)
solveadjc = Honeybee_SolveAdjacencies(
    HBZones=flatten(mass2zone.HBZones),
    altConstruction=callfromepconstrlibrary_3.EPConstructions,
    removeCurrentAdjc=False,
    findAdjc=Toggle(True))  # -> out, HBZonesWADJ; plug-in component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
solveadjc_2 = Honeybee_SolveAdjacencies(
    HBZones=flatten(mass2zone_2.HBZones),
    altConstruction=callfromepconstrlibrary_2.EPConstructions,
    removeCurrentAdjc=False,
    findAdjc=Toggle(True))  # -> out, HBZonesWADJ; plug-in component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
panel_7 = Panel(listzoneprograms)
solveadjc_3 = Honeybee_SolveAdjacencies(
    HBZones=flatten(mass2zone_4.HBZones),
    altConstruction=callfromepconstrlibrary.EPConstructions,
    removeCurrentAdjc=False,
    findAdjc=Toggle(True))  # -> out, HBZonesWADJ; plug-in component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
panel_8 = Panel(solveadjc_3.out)
decomposebybc = Honeybee_DecomposeBasedOnBoundaryCondition(HBZone=solveadjc_3.HBZonesWADJ)  # -> outdoors, surface, adiabatic, ground; plug-in component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
panel_9 = Panel(solveadjc_2.out)
decomposebybc_2 = Honeybee_DecomposeBasedOnBoundaryCondition(HBZone=solveadjc_2.HBZonesWADJ)  # -> outdoors, surface, adiabatic, ground; plug-in component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
panel_10 = Panel(solveadjc.out)
decomposebybc_3 = Honeybee_DecomposeBasedOnBoundaryCondition(HBZone=solveadjc.HBZonesWADJ)  # -> outdoors, surface, adiabatic, ground; plug-in component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
geometry_4 = Geometry(decomposebybc.surface)
geometry_5 = Geometry(decomposebybc_2.surface)
geometry_6 = Geometry(decomposebybc_3.surface)
callfromepconstrlibrary_4 = Honeybee_CallFromEPConstructionLibrary(keywords="air")  # -> ThermMaterials, EPMaterials, EPWindowMaterials, EPConstructions; plug-in component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
callfromepconstrlibrary_5 = Honeybee_CallFromEPConstructionLibrary(keywords="150mm R.C.C Slab")  # -> ThermMaterials, EPMaterials, EPWindowMaterials, EPConstructions; plug-in component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
callfromepconstrlibrary_6 = Honeybee_CallFromEPConstructionLibrary(keywords="clear 6mm")  # -> ThermMaterials, EPMaterials, EPWindowMaterials, EPConstructions; plug-in component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
callfromepconstrlibrary_7 = Honeybee_CallFromEPConstructionLibrary(keywords="CI_Sheet")  # -> ThermMaterials, EPMaterials, EPWindowMaterials, EPConstructions; plug-in component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
callfromepconstrlibrary_8 = Honeybee_CallFromEPConstructionLibrary(keywords="Air Bubble Sheet")  # -> ThermMaterials, EPMaterials, EPWindowMaterials, EPConstructions; plug-in component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
callfromepconstrlibrary_9 = Honeybee_CallFromEPConstructionLibrary(keywords="Aluminum Foil")  # -> ThermMaterials, EPMaterials, EPWindowMaterials, EPConstructions; plug-in component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
panel_11 = Panel(callfromepconstrlibrary_4.EPConstructions)
panel_12 = Panel(callfromepconstrlibrary_5.EPConstructions)
solveadjc_4 = Honeybee_SolveAdjacencies(
    HBZones=flatten([solveadjc_3.HBZonesWADJ, solveadjc_2.HBZonesWADJ, solveadjc.HBZonesWADJ]),
    altConstruction=callfromepconstrlibrary_5.EPConstructions,
    removeCurrentAdjc=False,
    findAdjc=Toggle(True))  # -> out, HBZonesWADJ; plug-in component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
panel_13 = Panel(callfromepconstrlibrary_6.EPWindowMaterials)
panel_14 = Panel(callfromepconstrlibrary_8.EPMaterials)
panel_15 = Panel(callfromepconstrlibrary_9.EPMaterials)
epconstruction = Honeybee_EnergyPlusConstruction(
    name="CI_Sheet",
    layer_1=callfromepconstrlibrary_7.EPMaterials,
    layer_2=callfromepconstrlibrary_8.EPMaterials,
    layer_3=callfromepconstrlibrary_9.EPMaterials)  # -> EPConstruction; plug-in component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
solveadjc_5 = Honeybee_SolveAdjacencies(
    HBZones=flatten([solveadjc_4.HBZonesWADJ, mass2zone_3.HBZones]),
    altConstruction=callfromepconstrlibrary_4.EPConstructions,
    removeCurrentAdjc=False,
    findAdjc=Toggle(True))  # -> out, HBZonesWADJ; plug-in component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
labelsurfaces = Honeybee_LabelZoneSurfaces(HBObjects=flatten(solveadjc_4.HBZonesWADJ), textHeight=Slider(0.44, range=0..1))  # -> surfaceTxtLabels, labelBasePts, brepTxtLabels, surfaceWireFrames; plug-in component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
decomposebybc_4 = Honeybee_DecomposeBasedOnBoundaryCondition(HBZone=solveadjc_4.HBZonesWADJ)  # -> outdoors, surface, adiabatic, ground; plug-in component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
epconstruction_2 = Honeybee_EnergyPlusConstruction(name="Glass window", layer_1=callfromepconstrlibrary_6.EPWindowMaterials)  # -> EPConstruction; plug-in component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
geometry_7 = Geometry(decomposebybc_4.surface)
number_slider = Slider(0.176, range=0..1)
callfromepconstrlibrary_10 = Honeybee_CallFromEPConstructionLibrary(keywords="glass")  # -> ThermMaterials, EPMaterials, EPWindowMaterials, EPConstructions; plug-in component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
callfromepconstrlibrary_11 = Honeybee_CallFromEPConstructionLibrary(keywords="Plaster")  # -> ThermMaterials, EPMaterials, EPWindowMaterials, EPConstructions; plug-in component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
callfromepconstrlibrary_12 = Honeybee_CallFromEPConstructionLibrary(keywords="Brick")  # -> ThermMaterials, EPMaterials, EPWindowMaterials, EPConstructions; plug-in component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
callfromepconstrlibrary_13 = Honeybee_CallFromEPConstructionLibrary(keywords="Plaster")  # -> ThermMaterials, EPMaterials, EPWindowMaterials, EPConstructions; plug-in component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
labelsurfaces_2 = Honeybee_LabelZoneSurfaces(HBObjects=flatten(solveadjc_5.HBZonesWADJ))  # -> surfaceTxtLabels, labelBasePts, brepTxtLabels, surfaceWireFrames; plug-in component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
panel_16 = Panel(callfromepconstrlibrary_10.ThermMaterials)
series = Series(Start=Slider(0, range=0..27), Step=Slider(1, range=0..1), Count=Slider(9, range=0..10))
glzparamlist = Honeybee_GlazingParametersList(northGlzParam=number_slider, westGlzParam=number_slider, southGlzParam=number_slider, eastGlzParam=number_slider)  # -> glzParamList; plug-in component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
list_item_5 = ListItem(List=solveadjc_5.HBZonesWADJ, Index=Slider(9, range=0..10), Wrap=True)
list_item_6 = ListItem(List=solveadjc_5.HBZonesWADJ, Index=series, Wrap=True)
item = ListItem(List=callfromepconstrlibrary_12.EPMaterials, Index=Slider(0, range=0..100), Wrap=True)
brep = Brep(list_item_5)
epconstruction_3 = Honeybee_EnergyPlusConstruction(
    name="127mm_Wall",
    layer_1=callfromepconstrlibrary_11.EPMaterials,
    layer_2=item,
    layer_3=callfromepconstrlibrary_13.EPMaterials)  # -> EPConstruction; plug-in component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
preview = CustomPreview(Geometry=brep, Material=ColourSwatch(SwatchColor=RGB(125, 79, 79)))
glazingcreator = Honeybee_GlazingBasedOnRatio(
    HBObjects=list_item_6,
    glzRatio=glzparamlist,
    breakUpWindow=Toggle(True),
    breakUpDist=Slider(6.642, range=0..10),
    windowHeight=Slider(1.79, range=0..10),
    sillHeight=Slider(1.095, range=0..10),
    splitGlzVertDist=Slider(0, range=0..10),
    runIt=Toggle(True))  # -> out, HBObjWGLZ; plug-in component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
callfromepconstrlibrary_14 = Honeybee_CallFromEPConstructionLibrary(keywords="Floor Tiles")  # -> ThermMaterials, EPMaterials, EPWindowMaterials, EPConstructions; plug-in component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
callfromepconstrlibrary_15 = Honeybee_CallFromEPConstructionLibrary(keywords="R.C.C")  # -> ThermMaterials, EPMaterials, EPWindowMaterials, EPConstructions; plug-in component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
callfromepconstrlibrary_16 = Honeybee_CallFromEPConstructionLibrary(keywords="Plaster")  # -> ThermMaterials, EPMaterials, EPWindowMaterials, EPConstructions; plug-in component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
decomposebytype = Honeybee_DecomposeBasedOnType(HBZone=glazingcreator.HBObjWGLZ)  # -> walls, interiorWalls, airWalls, windows, interiorWindows, skylights, roofs, ceilings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; plug-in component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
panel_17 = Panel(callfromepconstrlibrary_14.EPMaterials)
item_2 = ListItem(List=callfromepconstrlibrary_15.EPMaterials, Index=Slider(0, range=0..100), Wrap=True)
brep_2 = Brep(decomposebytype.walls)
brep_3 = Brep(decomposebytype.windows)
brep_4 = Brep(decomposebytype.roofs)
brep_5 = Brep(decomposebytype.floors)
brep_6 = Brep(decomposebytype.exposedFloors)
preview_2 = CustomPreview(Geometry=brep_2, Material=ColourSwatch(SwatchColor=RGB(153, 106, 106)))
preview_3 = CustomPreview(Geometry=brep_3, Material=ColourSwatch(SwatchColor=RGBA(37, 43, 46, 163)))
preview_4 = CustomPreview(Geometry=brep_4, Material=ColourSwatch(SwatchColor=RGB(127, 94, 133)))
preview_5 = CustomPreview(Geometry=brep_5, Material=ColourSwatch(SwatchColor=RGBA(153, 106, 106, 215)))
preview_6 = CustomPreview(Geometry=brep_6, Material=ColourSwatch(SwatchColor=RGB(79, 69, 37)))
epconstruction_4 = Honeybee_EnergyPlusConstruction(
    name="150mm R.C.C Slab",
    layer_1=callfromepconstrlibrary_14.EPMaterials,
    layer_2=item_2,
    layer_3=callfromepconstrlibrary_16.EPMaterials)  # -> EPConstruction; plug-in component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
setepzonecnstr = Honeybee_SetEPZoneConstruction(
    HBZones=flatten([glazingcreator.HBObjWGLZ, list_item_5]),
    wallEPConstruction=epconstruction_3,
    windowEPConstruction=epconstruction_2,
    roofEPConstruction=epconstruction,
    floorEPConstruction=epconstruction_4,
    expFloorEPConstruction=epconstruction_4)  # -> simplify(modifiedHBZones); plug-in component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
panel_18 = Panel("""0
0
0
0
0
0
0
0
1
1
1
1
1
1
1
1
1
0
0
0
0
0
0
0""")
division = Division(A=Slider(1090, range=0..10000), B=Slider(836.209, range=0..1000))
toggle = BooleanToggle(True)
setepzoneloads = Honeybee_SetEnergyPlusZoneLoads(
    HBZones=setepzonecnstr,
    equipmentLoadPerArea=Slider(15, range=0..100),
    infilRatePerArea_Facade=Slider(0.000285, range=0..0.001),
    lightingDensityPerArea=Slider(11.2, range=0..100),
    numOfPeoplePerArea=division,
    ventilationPerArea=Slider(0.0002, range=0..0.001),
    recirculatedAirPerArea=Slider(0.001, range=0..0.001))  # -> loads, HBZones; plug-in component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
dup = DuplicateData(Data=panel_18, Number="365", Order=True)
data = Data(dup)
csvschedule = Honeybee_CreateCSVSchedule(values=data, scheduleName="Factory_Occupancy_Scedule ", writeFile=toggle)  # -> readMe, csvSchedule; plug-in component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
panel_19 = Panel(data)
csvschedule_2 = Honeybee_CreateCSVSchedule(values=data, scheduleName="Factory_Equipment_Scedule ", writeFile=toggle)  # -> readMe, csvSchedule; plug-in component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
setepzonethresholds = Honeybee_SetEnergyPlusZoneThresholds(
    HBZones=setepzoneloads.HBZones,
    coolingSetPt=Slider(28, range=0..40),
    heatingSetPt=Slider(18, range=0..100),
    maxHumidity=Slider(90, range=0..100),
    minHumidity=Slider(20, range=0..100))  # -> readMe, HBZones; plug-in component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
panel_20 = Panel(csvschedule.csvSchedule)
panel_21 = Panel(csvschedule_2.csvSchedule)
setepnatvent = Honeybee_SetEPAirFlow(
    HBZones=flatten(setepzonethresholds.HBZones),
    naturalVentilationType=Slider(1, range=0..3),
    minIndoorTempForNatVent=Slider(10, range=0..10),
    maxIndoorTempForNatVent=Slider(100, range=0..100),
    minOutdoorTempForNatVent=Slider(-100, range=-100..100),
    maxOutdoorTempForNatVent=Slider(100, range=0..100),
    fractionOfGlzAreaOperable=Slider(0.5, range=0..1),
    windDrivenCrossVent=Toggle(True))  # -> readMe, simplify(HBZones); plug-in component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
setepzoneschedules = Honeybee_SetEnergyPlusZoneSchedules(
    HBZones=setepnatvent.HBZones,
    occupancySchedules=csvschedule.csvSchedule,
    occupancyActivitySchs=csvschedule.csvSchedule,
    heatingSetPtSchedules=csvschedule.csvSchedule,
    coolingSetPtSchedules=csvschedule.csvSchedule,
    lightingSchedules=csvschedule_2.csvSchedule,
    equipmentSchedules=csvschedule_2.csvSchedule,
    infiltrationSchedules=csvschedule.csvSchedule,
    ventilationSchedules=csvschedule.csvSchedule)  # -> schedules, simplify(HBZones); plug-in component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
toggle_2 = BooleanToggle(False)
analysisperiod = Ladybug_AnalysisPeriod(
    fromMonth=Slider(4, range=0..12),
    fromDay=Slider(1, range=0..31),
    fromHour=Slider(1, range=0..24),
    toMonth=Slider(7, range=0..12),
    toDay=Slider(31, range=0..31),
    toHour=Slider(24, range=0..24))  # -> readMe, analysisPeriod; plug-in component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
epoutput = Honeybee_GenerateEPOutput(
    zoneEnergyUse=toggle_2,
    zoneGainsAndLosses=Toggle(False),
    zoneComfortMetrics=Toggle(True),
    comfortMapVariables=toggle_2,
    zoneHVACParams=toggle_2,
    surfaceTempAnalysis=toggle_2,
    glazingSolarAnalysis=toggle_2,
    timestep="hourly")  # -> report, flatten(simulationOutputs); plug-in component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
panel_22 = Panel("http://climate.onebuilding.org/WMO_Region_2_Asia/BGD_Bangladesh/DH_Dhaka/BGD_DH_Dhaka-Shahjalal.Intl.AP.419220_TMYx.zip")
downloadepw = Ladybug_downloadEPWWeatherFile(download=Toggle(False))  # -> readMe; plug-in component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
epw_stat = Ladybug_OpenEPWAndSTATWeatherFiles(weatherFileURL=panel_22)  # -> epwFile, statFile; plug-in component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
series_2 = Series(Start=Slider(2159, range=0..10000), Step=Slider(1, range=0..1), Count=Slider(2928, range=0..10000))
importepw = Ladybug_ImportEpw(epwFile=epw_stat.epwFile)  # -> readMe, latitude, location, dryBulbTemperature, dewPointTemperature, relativeHumidity, windSpeed, windDirection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; plug-in component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
panel_23 = Panel(series_2)
panel_24 = Panel(epoutput.simulationOutputs)
runenergysimulation = Honeybee_RunEnergySimulation(
    epwFile=epw_stat.epwFile,
    analysisPeriod=analysisperiod.analysisPeriod,
    HBZones=flatten(setepnatvent.HBZones),
    simulationOutputs=flatten(epoutput.simulationOutputs),
    writeIdf=Toggle(True),
    runEnergyPlus=Toggle(False),
    idfFileName="Existing")  # -> readMe, idfFileAddress, resultFileAddress, eioFileAddress, rddFileAddress, htmlReport, studyFolder; plug-in component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
panel_25 = Panel(epw_stat.epwFile)
branchdatadailymonthlyhourly = Ladybug_BranchData(data=importepw.dryBulbTemperature, HOY=panel_23)  # -> dataEachDayOfYear, dataEachMonth, dataEachHourOfDay; plug-in component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
strnum = Ladybug_SeparateData(inputList=flatten(importepw.dryBulbTemperature))  # -> numbers, strings; plug-in component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
panel_26 = Panel(runenergysimulation.readMe)
panel_27 = Panel(setepzoneschedules.schedules)
panel_28 = Panel(importepw.relativeHumidity)
strnum_2 = Ladybug_SeparateData(inputList=flatten(panel_28))  # -> numbers, strings; plug-in component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
relative_humidity = Panel(strnum_2.numbers)
panel_29 = Panel(strnum.numbers)
list_item_7 = ListItem(List=panel_29, Index=series_2, Wrap=True)
list_item_8 = ListItem(List=relative_humidity, Index=series_2, Wrap=True)

# ==== cluster Cluster
epopaquemat = Honeybee_EnergyPlusOpaqueMaterial(
    name="Floor Tiles",
    roughness="Smooth",
    thickness=Slider(0.00063, range=0..1),
    conductivity=Slider(1.12, range=0..2),
    density=Slider(1763.633, range=0..2000),
    specificHeat=Slider(1213.36, range=0..2000),
    thermAbsp=Slider(0.9, range=0..1),
    solAbsp=Slider(0.7, range=0..1),
    visAbsp=Slider(0.7, range=0..1))  # -> EPMaterial; plug-in component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
epopaquemat_2 = Honeybee_EnergyPlusOpaqueMaterial(
    name="Brick",
    roughness="MediumRough",
    thickness=Slider(0.127, range=0..0.5),
    conductivity=Slider(0.48, range=0..10),
    density=Slider(1690.108, range=0..10000),
    specificHeat=Slider(1338.88, range=0..2000),
    thermAbsp=Slider(0.9, range=0..1),
    solAbsp=Slider(0.7, range=0..1),
    visAbsp=Slider(0.7, range=0..1))  # -> EPMaterial; plug-in component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
epopaquemat_3 = Honeybee_EnergyPlusOpaqueMaterial(
    name="R.C.C",
    roughness="Rough",
    thickness=Slider(0.15, range=0..0.5),
    conductivity=Slider(1.34, range=0..100),
    density=Slider(2487.667, range=0..10000),
    specificHeat=Slider(669.44, range=0..1000),
    thermAbsp=Slider(0.9, range=0..1),
    solAbsp=Slider(0.7, range=0..1),
    visAbsp=Slider(0.7, range=0..1))  # -> EPMaterial; plug-in component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
addtoeplibrary = Honeybee_AddToEnergyPlusLibrary(EPObject=epopaquemat, addToProjectLib=Toggle(True))  # -> readMe; plug-in component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
addtoeplibrary_2 = Honeybee_AddToEnergyPlusLibrary(EPObject=[epopaquemat_3, epopaquemat_2], addToProjectLib=Toggle(True))  # -> readMe; plug-in component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
panel = Panel(addtoeplibrary_2)

# ---- group: Insulators
epopaquemat_4 = Honeybee_EnergyPlusOpaqueMaterial(
    name="Aluminum Foil",
    roughness="Smooth",
    thickness=Slider(0.0002, range=0..0.1),
    conductivity=Slider(0.896, range=0..100),
    density=Slider(2689, range=0..10000),
    specificHeat=Slider(167, range=0..2500),
    thermAbsp=Slider(0.2, range=0..1),
    solAbsp=Slider(0.7, range=0..1),
    visAbsp=Slider(0.7, range=0..1))  # -> EPMaterial; plug-in component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
epopaquemat_5 = Honeybee_EnergyPlusOpaqueMaterial(
    name="Expanded Polystyrene",
    roughness="Smooth",
    thickness=Slider(0.1, range=0..0.1),
    conductivity=Slider(0.036, range=0..100),
    density=Slider(35, range=0..10000),
    specificHeat=Slider(800, range=0..1000),
    thermAbsp=Slider(0.9, range=0..1),
    solAbsp=Slider(0.7, range=0..1),
    visAbsp=Slider(0.7, range=0..1))  # -> EPMaterial; plug-in component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
epopaquemat_6 = Honeybee_EnergyPlusOpaqueMaterial(
    name="Polyethylene Foam",
    roughness="Smooth",
    thickness=Slider(0.006, range=0..0.1),
    conductivity=Slider(0.031, range=0..100),
    density=Slider(55, range=0..10000),
    specificHeat=Slider(800, range=0..1000),
    thermAbsp=Slider(0.9, range=0..1),
    solAbsp=Slider(0.7, range=0..1),
    visAbsp=Slider(0.7, range=0..1))  # -> EPMaterial; plug-in component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
epopaquemat_7 = Honeybee_EnergyPlusOpaqueMaterial(
    name="Air Bubble Sheet",
    roughness="Smooth",
    thickness=Slider(0.012, range=0..0.1),
    conductivity=Slider(0.04, range=0..100),
    density=Slider(93, range=0..10000),
    specificHeat=Slider(932, range=0..2500),
    thermAbsp=Slider(0.9, range=0..1),
    solAbsp=Slider(0.7, range=0..1),
    visAbsp=Slider(0.7, range=0..1))  # -> EPMaterial; plug-in component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
epopaquemat_8 = Honeybee_EnergyPlusOpaqueMaterial(
    name="Cork Sheet",
    roughness="Smooth",
    thickness=Slider(0.012, range=0..0.1),
    conductivity=Slider(0.04, range=0..100),
    density=Slider(150, range=0..10000),
    specificHeat=Slider(2100, range=0..2500),
    thermAbsp=Slider(0.9, range=0..1),
    solAbsp=Slider(0.7, range=0..1),
    visAbsp=Slider(0.7, range=0..1))  # -> EPMaterial; plug-in component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
epopaquemat_9 = Honeybee_EnergyPlusOpaqueMaterial(
    name="Aerogel",
    roughness="Smooth",
    thickness=Slider(0.05, range=0..0.1),
    conductivity=Slider(0.015, range=0..100),
    density=Slider(150, range=0..10000),
    specificHeat=Slider(1000, range=0..2500),
    thermAbsp=Slider(0.9, range=0..1),
    solAbsp=Slider(0.7, range=0..1),
    visAbsp=Slider(0.7, range=0..1))  # -> EPMaterial; plug-in component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
epopaquemat_10 = Honeybee_EnergyPlusOpaqueMaterial(
    name="Air Gap",
    roughness="Smooth",
    thickness=Slider(0.075, range=0..0.6),
    conductivity=Slider(0.026, range=0..100),
    density=Slider(1.2, range=0..10000),
    specificHeat=Slider(1006, range=0..2500),
    thermAbsp=Slider(0.9, range=0..1),
    solAbsp=Slider(0.7, range=0..1),
    visAbsp=Slider(0.7, range=0..1))  # -> EPMaterial; plug-in component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
epopaquemat_11 = Honeybee_EnergyPlusOpaqueMaterial(
    name="Mineralized Wood",
    roughness="Smooth",
    thickness=Slider(0.067, range=0..0.1),
    conductivity=Slider(0.04, range=0..100),
    density=Slider(400, range=0..10000),
    specificHeat=Slider(2100, range=0..2500),
    thermAbsp=Slider(0.9, range=0..1),
    solAbsp=Slider(0.7, range=0..1),
    visAbsp=Slider(0.7, range=0..1))  # -> EPMaterial; plug-in component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
addtoeplibrary_3 = Honeybee_AddToEnergyPlusLibrary(
    EPObject=[epopaquemat_6, epopaquemat_5, epopaquemat_8, epopaquemat_11, epopaquemat_10, epopaquemat_9, epopaquemat_4, epopaquemat_7],
    addToProjectLib=Toggle(True))  # -> out; plug-in component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
panel_2 = Panel(addtoeplibrary_3)

# ----
number_slider = Slider(4665, range=0..10000)
