# Grasshopper definition Indoorairflow_Butterfly_Workflow.gh (Grasshopper 1.0.7)

epsilonwallfunction = Butterfly_epsilonWallFunction(Cmu=0.09, kappa=0.4, E=9.8)  # -> epsilon_wall_funct; plug-in component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
nutkwallfunction = Butterfly_nutkWallFunction()  # -> nutk_wall_funct; plug-in component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
calculated = Butterfly_calculated()  # -> calculated; plug-in component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
zerogradient = Butterfly_zeroGradient()  # -> zero_gradient; plug-in component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
kqrwallfunction = Butterfly_kqRWallFunction(value="0.01")  # -> kqR_wall_funct; plug-in component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
fixedvalue = Butterfly_fixedValue(value="(0 0 0)")  # -> fixed_value; plug-in component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

panel = Panel(nutkwallfunction)
boundary = Butterfly_Boundary(b_type="patch", U=zerogradient, p=zerogradient, k=zerogradient, epsilon=calculated, nut=calculated)  # -> report, boundary; plug-in component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
settings_quality = SettingsQuality()
wall = Butterfly_WallBoundary()  # -> wall_boundary; plug-in component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
geometry = Geometry([<brep referenced from the Rhino model> x2])
createbfgeometry = Butterfly_CreateButterflyGeometry(name="wall", geo=flatten(geometry), boundary=wall, refine_levels="2,2", mesh_set=settings_quality)  # -> out, BF_geo; plug-in component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
cluster = Cluster_2(
    mesh_set=settings_quality,
    mesh_set_2=settings_quality,
    mesh_set_3=settings_quality,
    mesh_set_4=settings_quality,
    mesh_set_5=settings_quality,
    mesh_set_6=settings_quality,
    mesh_set_7=settings_quality,
    mesh_set_8=settings_quality)  # -> bf_geo, bf_geo_2, bf_geo_3, bf_geo_4, bf_geo_5, bf_geo_6, bf_geo_7, bf_geo_8
surface = Surface(<surface referenced from the Rhino model>)
cluster_2 = Cluster(
    refine_levels="2,2",
    mesh_set=settings_quality,
    refine_levels_2="2,2",
    mesh_set_2=settings_quality,
    refine_levels_3="2,2",
    mesh_set_3=settings_quality,
    refine_levels_4="2,2",
    mesh_set_4=settings_quality,
    refine_levels_5="2,2",
    mesh_set_5=settings_quality,
    refine_levels_6="2,2",
    mesh_set_6=settings_quality,
    refine_levels_7="2,2",
    mesh_set_7=settings_quality,
    refine_levels_8="2,2",
    mesh_set_8=settings_quality)  # -> bf_geo, bf_geo_2, bf_geo_3, bf_geo_4, bf_geo_5, bf_geo_6, bf_geo_7, bf_geo_8
brep = Brep(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)
brep_2 = Brep(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)
gentestpts = Honeybee_GenerateTestPoints(testGeometry=surface, gridSize=Slider(0.3, range=0..1), distBaseSrf="0.05", moveTestMesh=Toggle(False))  # -> readMe, simplify(testPoints), simplify(ptsVectors), simplify(facesArea), simplify(mesh); plug-in component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
genpts = LBGeneratePointGrid(geometry=surface, grid_size=Slider(2, range=0..100))  # -> points, vectors, face_areas, mesh; plug-in component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
casefromgeos = Butterfly_CreateCaseFromGeometries(
    name="insideair",
    BF_geo=flatten([createbfgeometry.BF_geo, cluster_2.bf_geo, cluster_2.bf_geo_2, cluster_2.bf_geo_3, cluster_2.bf_geo_4, cluster_2.bf_geo_5, cluster_2.bf_geo_6, cluster_2.bf_geo_7, cluster_2.bf_geo_8, cluster.bf_geo, cluster.bf_geo_2, cluster.bf_geo_3, cluster.bf_geo_4, cluster.bf_geo_5, cluster.bf_geo_6, cluster.bf_geo_7, cluster.bf_geo_8]),
    expand_block_mesh=True,
    run=Toggle(True))  # -> out, block_pts, case; plug-in component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
brep_wireframe = BrepWireframe(Brep=geometry, Density=-1)
flatten = FlattenTree(Tree=gentestpts.testPoints, Path="{0}")
flatten_2 = FlattenTree(Tree=gentestpts.mesh, Path="{0}")
panel_2 = Panel("""p
U""")
panel_3 = Panel(casefromgeos.out)
panel_4 = Panel(casefromgeos.case)
snappyhexmeshdict = Butterfly_snappyHexMeshDict(
    castellated_mesh=True,
    snap=Toggle(False),
    add_layers=False,
    n_cells_btwn_levels=3,
    max_global_cells=2000000,
    expansion_ratio=1.1,
    final_layer_thickness=0.7,
    min_thickness=0.1,
    n_layer_iter=50)  # -> snappy_hex_mesh_dict; plug-in component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
probes = Butterfly_probes(points=flatten, fields=panel_2)  # -> probes; plug-in component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
blockmesh = Butterfly_blockMesh(case=casefromgeos.case, overwrite=True, write=Toggle(True), run=Toggle(True))  # -> out, case; plug-in component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
controldict = Butterfly_controlDict(start_time=0, end_time=1000, write_interval=100, write_compression=False, purge_write=0)  # -> control_dict; plug-in component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
point = Point(<point referenced from the Rhino model>)
loadmesh = Butterfly_LoadMesh(case=blockmesh.case, inner_mesh=Toggle(True), load=Toggle(True))  # -> mesh; plug-in component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
snappyhexmesh = Butterfly_snappyHexMesh(
    case=blockmesh.case,
    location_in_mesh=point,
    snappy_hex_mesh_dict=snappyhexmeshdict,
    write=Toggle(True),
    run=Toggle(True))  # -> out, case; plug-in component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
solutionparams = Butterfly_SolutionParameters(control_dict=controldict, probes=probes)  # -> solution_par; plug-in component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
steadyincomp = Butterfly_SteadyIncompressibleRecipe()  # -> out, recipe; plug-in component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
solution = Butterfly_Solution(
    case=snappyhexmesh.case,
    recipe=steadyincomp.recipe,
    solution_par=solutionparams,
    interval=2,
    write=Toggle(True),
    run=Toggle(True))  # -> out, solution, is_running, timestep, residual_fields, residual_values, log_files; plug-in component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
panel_5 = Panel(solution.out)
loadprobesvalue = Butterfly_LoadProbesValue(solution=solution.solution, field="p")  # -> values; plug-in component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
loadprobesvalue_2 = Butterfly_LoadProbesValue(solution=solution.solution, field="U")  # -> values; plug-in component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

# ---- group: points
pt = Point(flatten)

# ---- group: vectors
vec = Vector(loadprobesvalue_2)

# ----
panel_6 = Panel(solution.solution)
vlen = VectorLength(Vector=vec)
panel_7 = Panel(loadprobesvalue)
bnd = Bounds(Numbers=vlen)
gradientlibrary = Ladybug_GradientLibrary(gradIndex="7")  # -> customColors; plug-in component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
dedomain = DeconstructDomain(Domain=bnd)  # -> Start, End
mjoin = MeshJoin(Meshes=flatten_2)
scale = Slider(0.52, range=0..1)
gradient = Gradient(
    LowerLimit=dedomain.End,
    UpperLimit=dedomain.Start,
    Parameter=vlen,
    stops=[0: RGB(234, 38, 0), 0.14: RGB(234, 126, 0), 0.5: RGB(254, 244, 84), 0.75: RGB(173, 203, 249), 1: RGB(75, 107, 169)])
legendpar = Ladybug_LegendParameters(customColors=flatten(gradientlibrary))  # -> legendPar; plug-in component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
multiplication = Multiplication(A=vec, B=scale)
vdisex = VectorDisplayEx(Point=pt, Vector=multiplication, Colour=gradient, Width=Slider(2, range=0..5))
recolormesh = Ladybug_RecolorMesh(analysisResult=loadprobesvalue, inputMesh=mjoin, legendPar=legendpar, analysisTitle="Pressure.", legendTitle="Pa.")  # -> readMe, newMesh, newLegend, legendBasePt, meshColors, legendColors; plug-in component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
ladybug = Ladybug_Ladybug()  # -> Vviiiiiiiiiizzz; plug-in component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
faceb = FaceBoundaries(Mesh=recolormesh.newMesh)
mesh = Mesh(recolormesh.newLegend)

# ==== cluster Cluster
curve = Curve(<curve referenced from the Rhino model>)
unit_x = UnitX(Factor=Slider(-1.8, range=-20..20))
unit_x_2 = UnitX(Factor=Slider(-1.8, range=-20..20))
unit_x_3 = UnitX(Factor=Slider(-1.8, range=-20..20))
unit_x_4 = UnitX(Factor=Slider(-1.8, range=-20..20))
unit_x_5 = UnitX(Factor=Slider(-1.8, range=-20..20))
unit_x_6 = UnitX(Factor=Slider(-1.8, range=-20..20))
unit_x_7 = UnitX(Factor=Slider(-1.8, range=-20..20))
unit_x_8 = UnitX(Factor=Slider(-1.8, range=-20..20))
end_points = EndPoints(Curve=curve)  # -> Start, End
curve_2 = Curve(<curve referenced from the Rhino model>)
curve_3 = Curve(<curve referenced from the Rhino model>)
curve_4 = Curve(<curve referenced from the Rhino model>)
curve_5 = Curve(<curve referenced from the Rhino model>)
curve_6 = Curve(<curve referenced from the Rhino model>)
curve_7 = Curve(<curve referenced from the Rhino model>)
curve_8 = Curve(<curve referenced from the Rhino model>)
move = Move(Geometry=end_points.End, Motion=unit_x_8)  # -> Geometry, Transform
end_points_2 = EndPoints(Curve=curve_2)  # -> Start, End
move_2 = Move(Geometry=end_points_2.End, Motion=unit_x)  # -> Geometry, Transform
end_points_3 = EndPoints(Curve=curve_3)  # -> Start, End
move_3 = Move(Geometry=end_points_3.End, Motion=unit_x_3)  # -> Geometry, Transform
end_points_4 = EndPoints(Curve=curve_4)  # -> Start, End
move_4 = Move(Geometry=end_points_4.End, Motion=unit_x_2)  # -> Geometry, Transform
end_points_5 = EndPoints(Curve=curve_5)  # -> Start, End
move_5 = Move(Geometry=end_points_5.End, Motion=unit_x_5)  # -> Geometry, Transform
end_points_6 = EndPoints(Curve=curve_6)  # -> Start, End
move_6 = Move(Geometry=end_points_6.End, Motion=unit_x_4)  # -> Geometry, Transform
end_points_7 = EndPoints(Curve=curve_7)  # -> Start, End
move_7 = Move(Geometry=end_points_7.End, Motion=unit_x_6)  # -> Geometry, Transform
end_points_8 = EndPoints(Curve=curve_8)  # -> Start, End
move_8 = Move(Geometry=end_points_8.End, Motion=unit_x_7)  # -> Geometry, Transform
point = Point(move_2.Geometry)
point_2 = Point(end_points_2.Start)
point_3 = Point(move_3.Geometry)
point_4 = Point(end_points_3.Start)
point_5 = Point(move_4.Geometry)
point_6 = Point(move_5.Geometry)
point_7 = Point(move_6.Geometry)
point_8 = Point(end_points_4.Start)
point_9 = Point(end_points_5.Start)
point_10 = Point(end_points_6.Start)
point_11 = Point(move_7.Geometry)
point_12 = Point(end_points_7.Start)
point_13 = Point(move_8.Geometry)
point_14 = Point(end_points_8.Start)
point_15 = Point(move.Geometry)
point_16 = Point(end_points.Start)
line = Line(StartPoint=point, EndPoint=point_2)
line_2 = Line(StartPoint=point_6, EndPoint=point_9)
line_3 = Line(StartPoint=point_3, EndPoint=point_4)
line_4 = Line(StartPoint=point_7, EndPoint=point_10)
line_5 = Line(StartPoint=point_5, EndPoint=point_8)
line_6 = Line(StartPoint=point_13, EndPoint=point_14)
line_7 = Line(StartPoint=point_15, EndPoint=point_16)
line_8 = Line(StartPoint=point_11, EndPoint=point_12)
inletvel = Butterfly_InletBoundary(velocity_vec=line)  # -> inlet_boundary; plug-in component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
inletvel_2 = Butterfly_InletBoundary(velocity_vec=line_2)  # -> inlet_boundary; plug-in component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
inletvel_3 = Butterfly_InletBoundary(velocity_vec=line_4)  # -> inlet_boundary; plug-in component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
inletvel_4 = Butterfly_InletBoundary(velocity_vec=line_3)  # -> inlet_boundary; plug-in component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
inletvel_5 = Butterfly_InletBoundary(velocity_vec=line_5)  # -> inlet_boundary; plug-in component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
inletvel_6 = Butterfly_InletBoundary(velocity_vec=line_8)  # -> inlet_boundary; plug-in component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
inletvel_7 = Butterfly_InletBoundary(velocity_vec=line_6)  # -> inlet_boundary; plug-in component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
inletvel_8 = Butterfly_InletBoundary(velocity_vec=line_7)  # -> inlet_boundary; plug-in component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
refine_levels = ClusterInput()
mesh_set = ClusterInput()
refine_levels_2 = ClusterInput()
mesh_set_2 = ClusterInput()
refine_levels_3 = ClusterInput()
mesh_set_3 = ClusterInput()
refine_levels_4 = ClusterInput()
mesh_set_4 = ClusterInput()
refine_levels_5 = ClusterInput()
mesh_set_5 = ClusterInput()
refine_levels_6 = ClusterInput()
mesh_set_6 = ClusterInput()
refine_levels_7 = ClusterInput()
mesh_set_7 = ClusterInput()
refine_levels_8 = ClusterInput()
mesh_set_8 = ClusterInput()
geometry = Geometry(<brep referenced from the Rhino model>)
geometry_2 = Geometry(<brep referenced from the Rhino model>)
geometry_3 = Geometry(<brep referenced from the Rhino model>)
geometry_4 = Geometry(<brep referenced from the Rhino model>)
geometry_5 = Geometry(<brep referenced from the Rhino model>)
geometry_6 = Geometry(<brep referenced from the Rhino model>)
geometry_7 = Geometry(<brep referenced from the Rhino model>)
geometry_8 = Geometry(<brep referenced from the Rhino model>)
createbfgeometry = Butterfly_CreateButterflyGeometry(name="airingf", geo=flatten(geometry), boundary=inletvel, refine_levels=refine_levels, mesh_set=mesh_set)  # -> out, BF_geo; plug-in component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
createbfgeometry_2 = Butterfly_CreateButterflyGeometry(name="airings", geo=flatten(geometry_2), boundary=inletvel_2, refine_levels=refine_levels_2, mesh_set=mesh_set_2)  # -> out, BF_geo; plug-in component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
createbfgeometry_3 = Butterfly_CreateButterflyGeometry(name="airingt", geo=flatten(geometry_3), boundary=inletvel_3, refine_levels=refine_levels_3, mesh_set=mesh_set_3)  # -> out, BF_geo; plug-in component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
createbfgeometry_4 = Butterfly_CreateButterflyGeometry(name="airingff", geo=flatten(geometry_4), boundary=inletvel_4, refine_levels=refine_levels_4, mesh_set=mesh_set_4)  # -> out, BF_geo; plug-in component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
createbfgeometry_5 = Butterfly_CreateButterflyGeometry(name="airinskf", geo=flatten(geometry_5), boundary=inletvel_5, refine_levels=refine_levels_5, mesh_set=mesh_set_5)  # -> out, BF_geo; plug-in component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
createbfgeometry_6 = Butterfly_CreateButterflyGeometry(name="airinsks", geo=flatten(geometry_6), boundary=inletvel_6, refine_levels=refine_levels_6, mesh_set=mesh_set_6)  # -> out, BF_geo; plug-in component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
createbfgeometry_7 = Butterfly_CreateButterflyGeometry(name="airinskt", geo=flatten(geometry_7), boundary=inletvel_7, refine_levels=refine_levels_7, mesh_set=mesh_set_7)  # -> out, BF_geo; plug-in component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
createbfgeometry_8 = Butterfly_CreateButterflyGeometry(name="airinskff", geo=flatten(geometry_8), boundary=inletvel_8, refine_levels=refine_levels_8, mesh_set=mesh_set_8)  # -> out, BF_geo; plug-in component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
bf_geo = ClusterOutput(createbfgeometry.BF_geo)
bf_geo_2 = ClusterOutput(createbfgeometry_2.BF_geo)
bf_geo_3 = ClusterOutput(createbfgeometry_3.BF_geo)
bf_geo_4 = ClusterOutput(createbfgeometry_4.BF_geo)
bf_geo_5 = ClusterOutput(createbfgeometry_5.BF_geo)
bf_geo_6 = ClusterOutput(createbfgeometry_6.BF_geo)
bf_geo_7 = ClusterOutput(createbfgeometry_7.BF_geo)
bf_geo_8 = ClusterOutput(createbfgeometry_8.BF_geo)

# ==== cluster Cluster_2
outlet = Butterfly_OutletBoundary()  # -> outlet_boundary; plug-in component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
outlet_2 = Butterfly_OutletBoundary()  # -> outlet_boundary; plug-in component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
outlet_3 = Butterfly_OutletBoundary()  # -> outlet_boundary; plug-in component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
outlet_4 = Butterfly_OutletBoundary()  # -> outlet_boundary; plug-in component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
outlet_5 = Butterfly_OutletBoundary()  # -> outlet_boundary; plug-in component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
outlet_6 = Butterfly_OutletBoundary()  # -> outlet_boundary; plug-in component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
outlet_7 = Butterfly_OutletBoundary()  # -> outlet_boundary; plug-in component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
outlet_8 = Butterfly_OutletBoundary()  # -> outlet_boundary; plug-in component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
geometry = Geometry(<brep referenced from the Rhino model>)
geometry_2 = Geometry(<brep referenced from the Rhino model>)
geometry_3 = Geometry(<brep referenced from the Rhino model>)
geometry_4 = Geometry(<brep referenced from the Rhino model>)
geometry_5 = Geometry(<brep referenced from the Rhino model>)
geometry_6 = Geometry(<brep referenced from the Rhino model>)
geometry_7 = Geometry(<brep referenced from the Rhino model>)
geometry_8 = Geometry(<brep referenced from the Rhino model>)
mesh_set = ClusterInput()
mesh_set_2 = ClusterInput()
mesh_set_3 = ClusterInput()
mesh_set_4 = ClusterInput()
mesh_set_5 = ClusterInput()
mesh_set_6 = ClusterInput()
mesh_set_7 = ClusterInput()
mesh_set_8 = ClusterInput()
createbfgeometry = Butterfly_CreateButterflyGeometry(name="outgf", geo=flatten(geometry), boundary=outlet_8, mesh_set=mesh_set)  # -> out, BF_geo; plug-in component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
createbfgeometry_2 = Butterfly_CreateButterflyGeometry(name="outgs", geo=flatten(geometry_2), boundary=outlet_6, mesh_set=mesh_set_2)  # -> out, BF_geo; plug-in component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
createbfgeometry_3 = Butterfly_CreateButterflyGeometry(name="outgt", geo=flatten(geometry_3), boundary=outlet_7, mesh_set=mesh_set_3)  # -> out, BF_geo; plug-in component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
createbfgeometry_4 = Butterfly_CreateButterflyGeometry(name="outgff", geo=flatten(geometry_4), boundary=outlet_5, mesh_set=mesh_set_4)  # -> out, BF_geo; plug-in component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
createbfgeometry_5 = Butterfly_CreateButterflyGeometry(name="outskf", geo=flatten(geometry_5), boundary=outlet_4, mesh_set=mesh_set_5)  # -> out, BF_geo; plug-in component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
createbfgeometry_6 = Butterfly_CreateButterflyGeometry(name="outsks", geo=flatten(geometry_6), boundary=outlet, mesh_set=mesh_set_6)  # -> out, BF_geo; plug-in component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
createbfgeometry_7 = Butterfly_CreateButterflyGeometry(name="outskt", geo=flatten(geometry_7), boundary=outlet_2, mesh_set=mesh_set_7)  # -> out, BF_geo; plug-in component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
createbfgeometry_8 = Butterfly_CreateButterflyGeometry(name="outskff", geo=flatten(geometry_8), boundary=outlet_3, mesh_set=mesh_set_8)  # -> out, BF_geo; plug-in component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
bf_geo = ClusterOutput(createbfgeometry.BF_geo)
bf_geo_2 = ClusterOutput(createbfgeometry_2.BF_geo)
bf_geo_3 = ClusterOutput(createbfgeometry_3.BF_geo)
bf_geo_4 = ClusterOutput(createbfgeometry_4.BF_geo)
bf_geo_5 = ClusterOutput(createbfgeometry_5.BF_geo)
bf_geo_6 = ClusterOutput(createbfgeometry_6.BF_geo)
bf_geo_7 = ClusterOutput(createbfgeometry_7.BF_geo)
bf_geo_8 = ClusterOutput(createbfgeometry_8.BF_geo)
