# Grasshopper definition Kangaroo Ancor Point Script.gh (Grasshopper 1.0.7)
# plug-ins: Bifocals, Kangaroo2 Components

number_slider = Slider(1e-05, range=-20..200)
point = Point(Point(31.50648635, -7.821569698, 0))
point_2 = Point(Point(-9.244213171, 7.467062873, 0))
unit_y = UnitY(Factor=Slider(3.98, range=0..10))
line = Line(StartPoint=point_2, EndPoint=point)
length = Length(Curve=line)
load = Load(Point=point_2, ForceVector=unit_y, Weighting=1)
multiplication = Multiplication(A=length, B=Slider(1, range=0..1))
length_line = LengthLine(Line=line, Length=multiplication, Strength=Slider(6.68, range=0..10))
reset = Button()
run = BooleanToggle(True)
anchor = Anchor(Point=point, Strength=Slider(6.78, range=0..100))
bouncysolver = BouncySolver(
    GoalObjects=[load, length_line, anchor],
    Reset=reset,
    Threshold=1e-15,
    Tolerance=0.01,
    Damping=0.99,
    Iterations="1",
    On=run)  # -> I, V, O
