# Grasshopper definition Kangaroo_Basics.gh (Grasshopper 1.0.7)
# plug-ins: Kangaroo2 Components

series = Series(Start=Slider(1, range=0..1), Step=Slider(1, range=0..10), Count=Slider(16, range=0..100))
unit_z = UnitZ(Factor=series)
point = Point([Point(-34.42437956, -29.63548166, 110.3989887), Point(-16.09065033, -22.86579395, 110.3989887), Point(2.787143343, -47.42340116, 110.3989887), Point(-24.84050634, -45.43131866, 110.3989887), Point(-27.39103665, -25.35769822, 110.3989887), Point(-45.6235451, 1.726119716, 110.3989887)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])
reverse = Reverse(Vector=unit_z)
load = Load(Point=point, ForceVector=reverse, Weighting=1)
floor = Floor(Strength=Slider(0.173, range=0..1))
merge = Merge(Data1=load, Data2=floor)
bouncysolver = BouncySolver(
    GoalObjects=merge,
    Reset=Button(),
    Threshold=1e-15,
    Tolerance=0.0001,
    Damping=0.99,
    Iterations=Slider(0.8, range=0..10),
    On=Toggle(True))  # -> I, V, O
point_list = PointList(Points=bouncysolver.V, Size="2")
