# Grasshopper definition Kangaroo_Example.gh (Grasshopper 1.0.8)
# plug-ins: Bifocals, Weaverbird, Kangaroo2 Components

rectangle = Rectangle(Plane=PlaneXY(0, 0, 0), XSize=Slider(23, range=0..100), YSize=Slider(60, range=0..100), Radius=0)  # -> Rectangle, Length
populate_2d = Populate2D(Region=rectangle.Rectangle, Count=Slider(10, range=0..100), Seed=Slider(23, range=0..100))
voronoi = Voronoi(Points=populate_2d, BruteForceOverride=False)
trim_with_region = TrimWithRegion(Curve=voronoi, Region=rectangle.Rectangle)  # -> Inside, Outside
number_slider = Slider(2, range=0..10)
explode = Explode(Curve=trim_with_region.Inside, Recursive=True)  # -> flatten(Segments), Vertices
negative = Negative(Value=number_slider)
curve_middle = CurveMiddle(Curve=explode.Segments)
multiplication = Multiplication(A=number_slider, B=Slider(2, range=0..10))
entwine = Entwine(Branch00=number_slider, Branch01=negative, FlattenInputs=True)
cull_duplicates = CullDuplicates(Points=curve_middle, Tolerance=0.1, CullMode=1)  # -> Points, Indices, Valence
list_item = ListItem(List=explode.Segments, Index=cull_duplicates.Indices, Wrap=True)  # -> flatten(Item)
offset_curve = OffsetCurve(Curve=list_item, Distance=entwine, Corners=1)  # -> simplify(Curve)
shift_paths = ShiftPaths(Data=offset_curve, Offset=Slider(1, range=0..1))
list_item_2 = ListItem(List=shift_paths, Index=0, Wrap=True)  # -> Item, Item1
flip_curve = FlipCurve(Curve=list_item_2.Item1)  # -> Curve, Flag
merge = Merge(Data1=list_item_2.Item, Data2=flip_curve.Curve)
connect_curves = ConnectCurves(Curves=merge, Continuity=0, Close=True, Bulge=1)  # -> flatten(Curve)
region_union = RegionUnion(Curves=connect_curves)
explode_2 = Explode(Curve=region_union, Recursive=True)  # -> Segments, Vertices
length = Length(Curve=explode_2.Segments)
expression = Expression(x=length, Expression="Round(x,4)")
equality = Equality(FirstNumber=expression, SecondNumber=multiplication)  # -> Equality, Inequality
dispatch = Dispatch(List=explode_2.Segments, DispatchPattern=equality.Equality)  # -> ListA, ListB
curve = Curve(dispatch.ListA)
curve_2 = Curve(dispatch.ListB)
curve_3 = Curve(list_item)
curve_middle_2 = CurveMiddle(Curve=curve_3)
curve_middle_3 = CurveMiddle(Curve=curve_2)
closest_points = ClosestPoints(Point=curve_middle_2, Cloud=curve_middle_3, Count=Slider(2, range=0..10))  # -> ClosestPoint, CPIndex, Distance
panel = Panel(closest_points.CPIndex)
list_item_3 = ListItem(List=curve_2, Index=closest_points.CPIndex, Wrap=True)
curve_4 = Curve(graft(curve_3))
insert_items = InsertItems(List=list_item_3, Item=curve_4, Indices=Slider(1, range=0..1), Wrap=True)
loft_options = LoftOptions(Closed=False, Adjust=True, Rebuild=0, Refit=0, Type=3)
loft = Loft(Curves=insert_items, Options=loft_options)
simple_mesh = SimpleMesh(Brep=loft)
weaverbird_s_join_meshes_and_weld = WeaverbirdsJoinMeshesAndWeld(Mesh=simple_mesh, Weld=True)
refine = Refine(Mesh=weaverbird_s_join_meshes_and_weld, Level=Slider(3, range=0..10))
show = Show(G=refine)
nakedvertices = NakedVertices(Mesh=refine)  # -> ClothedIndex, NakedIndex, ClothedPts, NakedPts
mesh_edges = MeshEdges(Mesh=refine)  # -> NakedEdges, InteriorEdges, NonManifoldEdges
point = Point(nakedvertices.NakedPts)
merge_2 = Merge(Data1=mesh_edges.NakedEdges, Data2=mesh_edges.InteriorEdges)
pull_point = PullPoint(Point=point, Geometry=curve, ClosestOnly=True)  # -> ClosestPoint, Distance
length_line = LengthLine(Line=merge_2, Length=Slider(0.25, range=0..1), Strength=Slider(1, range=0..1))
expression_2 = Expression(x=pull_point.Distance, Expression="Round(x,4)")
vertexloads = VertexLoads(Mesh=refine, Strength=Slider(0.04, range=0..0.1))
edgelengths = EdgeLengths(Mesh=refine, LengthFactor=1, Strength=Slider(0.4, range=0..1))
equality_2 = Equality(FirstNumber=expression_2, SecondNumber=Slider(0, range=0..100))  # -> Equality, Inequality
cull_pattern = CullPattern(List=point, CullPattern=equality_2.Equality)  # -> flatten(List)
anchor = Anchor(Point=cull_pattern, Strength=10000)
entwine_2 = Entwine(Branch00=show, Branch01=anchor, Branch02=vertexloads, Branch03=edgelengths, Branch04=length_line, FlattenInputs=True)  # -> flatten(Result)
solver = Solver(GoalObjects=entwine_2, Reset=Button(), Threshold=1e-15, Tolerance=0.0001, On=Toggle(True))  # -> I, V, graft(O)
panel_2 = Panel(solver.O)
list_item_4 = ListItem(List=solver.O, Index=0, Wrap=True)
