# Grasshopper definition Kangaroo_tensile_Example.gh (Grasshopper 1.0.7)
# plug-ins: Kangaroo2 Components

mesh = Mesh(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)
point = Point([Point(0, 27.33209229, 0), Point(16.12968402, 18.22140503, 0), Point(32.29029637, 9.110687256, 0), Point(48.0881753, 0, 0), Point(112.2057366, 91.10699463, 0), Point(128.2351327, 81.9697843, 0), Point(144.2645211, 72.8855896, 0), Point(160.2939095, 63.77490234, 0)])
curve = Curve(<curve referenced from the Rhino model>)
mesh_edges = MeshEdges(Mesh=mesh)  # -> NakedEdges, InteriorEdges, NonManifoldEdges
length_line = LengthLine(Strength=10)
curve_closest_point = CurveClosestPoint(Point=point, Curve=curve)  # -> Point, Parameter, Distance
meshcorners = MeshCorners(Mesh=mesh, Angle=2.35619449)
unit_z = UnitZ(Factor=Slider(0.03147, range=0..1))
length_line_2 = LengthLine(Line=[mesh_edges.NakedEdges, mesh_edges.InteriorEdges], Strength=10)
deconstruct_mesh = DeconstructMesh(Mesh=mesh)  # -> Vertices, Faces, Colours, Normals
anchor = Anchor(Point=meshcorners, Strength=10000)
show = Show(G=mesh)
oncurve = OnCurve(Points=point, Strength=1)
reset = Button()
run = BooleanToggle(True)
load = Load(Point=deconstruct_mesh.Vertices, ForceVector=unit_z, Weighting=1)
solver = Solver(GoalObjects=[length_line_2, load, show, anchor], Reset=reset, Threshold=1e-15, Tolerance=0.01, On=run)  # -> I, V, O
