# Grasshopper definition Parametric_Screen_Fabrication_Example.gh (Grasshopper 1.0.8)
# plug-ins: Kangaroo2 Components

geometry = Geometry(<surface referenced from the Rhino model>)
unit_y = UnitY(Factor=Slider(65.03, range=0..100))
move = Move(Geometry=geometry, Motion=unit_y)  # -> Geometry, Transform
triremesh = TriRemesh(Geometry=move.Geometry, Length=Slider(229.7, range=0..1000), Iterations=25)  # -> Triangulation, Dual, Creases
triremesh_2 = TriRemesh(Geometry=geometry, Length=Slider(229.7, range=0..1000), Iterations=25)  # -> Triangulation, Dual, Creases
face_boundaries = FaceBoundaries(Mesh=triremesh_2.Triangulation)
panel = Panel(triremesh_2.Triangulation)
face_boundaries_2 = FaceBoundaries(Mesh=triremesh.Triangulation)
boundary_surfaces = BoundarySurfaces(Edges=face_boundaries)
boundary_surfaces_2 = BoundarySurfaces(Edges=face_boundaries_2)
panel_2 = Panel(boundary_surfaces)
deconstruct_brep = DeconstructBrep(Brep=boundary_surfaces_2)  # -> Faces, flatten(Edges), Vertices
deconstruct_brep_2 = DeconstructBrep(Brep=boundary_surfaces)  # -> Faces, flatten(Edges), Vertices
area = Area(Geometry=boundary_surfaces)  # -> Area, Centroid
curve_middle = CurveMiddle(Curve=deconstruct_brep_2.Edges)
curve_middle_2 = CurveMiddle(Curve=deconstruct_brep.Edges)
point_list = PointList(Points=area.Centroid, Size=Slider(24.3, range=0..100))
cull_duplicates = CullDuplicates(Points=curve_middle_2, Tolerance=0.1, CullMode=1)  # -> Points, Indices, Valence
cull_duplicates_2 = CullDuplicates(Points=curve_middle, Tolerance=0.1, CullMode=1)  # -> Points, Indices, Valence
cull_index = CullIndex(List=deconstruct_brep.Edges, Indices=cull_duplicates.Valence, Wrap=True)  # -> flatten(List)
cull_index_2 = CullIndex(List=deconstruct_brep_2.Edges, Indices=cull_duplicates_2.Valence, Wrap=True)  # -> flatten(List)
edge_surface = EdgeSurface(CurveA=cull_index, CurveB=cull_index_2)
area_2 = Area(Geometry=edge_surface)  # -> Area, Centroid
evaluate_surface = EvaluateSurface(Surface=edge_surface, Point=area_2.Centroid)  # -> Point, Normal, UDirection, VDirection, Frame
offset_surface = OffsetSurface(Surface=edge_surface, Distance=Slider(10.23, range=0..1000), Retrim=True)
extrude = Extrude(Base=edge_surface, Direction=evaluate_surface.Normal)
unit_vector = UnitVector(Vector=evaluate_surface.Normal)
