# Grasshopper definition Path_Optimization_Galapagos.gh (Grasshopper 1.0.8)

# Right Set Points
point = Point([<point referenced from the Rhino model> x7])
# Left Set Points
point_2 = Point([<point referenced from the Rhino model> x8])
# Right Edge Waterbody
curve = Curve(<curve referenced from the Rhino model>)
# Left Edge Waterbody
curve_2 = Curve(<curve referenced from the Rhino model>)
number_slider = Slider(0.115, range=0..1)
number_slider_2 = Slider(0.938, range=0..1)
number_slider_3 = Slider(0.674, range=0..1)
number_slider_4 = Slider(0.449, range=0..1)
number_slider_5 = Slider(0.371, range=0..1)
number_slider_6 = Slider(0.651, range=0..1)
number_slider_7 = Slider(0.147, range=0..1)
number_slider_8 = Slider(0.926, range=0..1)
# Number of Bridges
evaluate_length = EvaluateLength(Curve=curve, Length=number_slider_2, Normalized=Toggle(True))  # -> Point, Tangent, Parameter
evaluate_length_2 = EvaluateLength(Curve=curve, Length=number_slider, Normalized=Toggle(True))  # -> Point, Tangent, Parameter
evaluate_length_3 = EvaluateLength(Curve=curve, Length=number_slider_3, Normalized=Toggle(True))  # -> Point, Tangent, Parameter
evaluate_length_4 = EvaluateLength(Curve=curve, Length=number_slider_4, Normalized=Toggle(True))  # -> Point, Tangent, Parameter
# Number of Bridges
evaluate_length_5 = EvaluateLength(Curve=curve_2, Length=number_slider_5, Normalized=Toggle(True))  # -> Point, Tangent, Parameter
evaluate_length_6 = EvaluateLength(Curve=curve_2, Length=number_slider_6, Normalized=Toggle(True))  # -> Point, Tangent, Parameter
evaluate_length_7 = EvaluateLength(Curve=curve_2, Length=number_slider_7, Normalized=Toggle(True))  # -> Point, Tangent, Parameter
evaluate_length_8 = EvaluateLength(Curve=curve_2, Length=number_slider_8, Normalized=Toggle(True))  # -> Point, Tangent, Parameter
merge = Merge(Data1=evaluate_length_4.Point, Data2=evaluate_length_3.Point, Data3=evaluate_length_2.Point, Data4=evaluate_length.Point)
merge_2 = Merge(
    Data1=evaluate_length_8.Point,
    Data2=evaluate_length_7.Point,
    Data3=evaluate_length_6.Point,
    Data4=evaluate_length_5.Point)
closest_point = ClosestPoint(Point=point, Cloud=merge)  # -> ClosestPoint, CPIndex, Distance
closest_point_2 = ClosestPoint(Point=point_2, Cloud=merge_2)  # -> ClosestPoint, CPIndex, Distance
line = Line(StartPoint=point_2, EndPoint=closest_point_2.ClosestPoint)
closest_point_3 = ClosestPoint(Point=evaluate_length_6.Point, Cloud=merge)  # -> ClosestPoint, CPIndex, Distance
closest_point_4 = ClosestPoint(Point=evaluate_length_5.Point, Cloud=merge)  # -> ClosestPoint, CPIndex, Distance
closest_point_5 = ClosestPoint(Point=evaluate_length_7.Point, Cloud=merge)  # -> ClosestPoint, CPIndex, Distance
closest_point_6 = ClosestPoint(Point=evaluate_length_8.Point, Cloud=merge)  # -> ClosestPoint, CPIndex, Distance
line_2 = Line(StartPoint=point, EndPoint=closest_point.ClosestPoint)
line_3 = Line(
    StartPoint=[evaluate_length_8.Point, evaluate_length_7.Point, evaluate_length_6.Point, evaluate_length_5.Point],
    EndPoint=[closest_point_6.ClosestPoint, closest_point_5.ClosestPoint, closest_point_3.ClosestPoint, closest_point_4.ClosestPoint])
length = Length(Curve=[line, line_3, line_2])
mass_addition = MassAddition(Input=length)  # -> Result, PartialResults
panel = Panel(length)
number_slider_9 = Slider(1.76, range=0..5)
panel_2 = Panel(mass_addition.Result)
expression = Expression(x=number_slider_9, Expression="x*-1")
entwine = Entwine(Branch00=number_slider_9, Branch01=expression, FlattenInputs=True)
offset_curve = OffsetCurve(Curve=[line_3, line, line_2], Distance=entwine, Corners=1)
shift_paths = ShiftPaths(Data=offset_curve, Offset=Slider(2, range=0..10))
panel_3 = Panel(shift_paths)
list_item = ListItem(List=shift_paths, Index=0, Wrap=True)  # -> Item, Item1
flip_curve = FlipCurve(Curve=list_item.Item1)  # -> Curve, Flag
connect_curves = ConnectCurves(Curves=[list_item.Item, flip_curve.Curve], Continuity=0, Close=True, Bulge=1)
region_union = RegionUnion(Curves=flatten(connect_curves))
boundary_surfaces = BoundarySurfaces(Edges=region_union)
galapagos = Galapagos(
    fitness=mass_addition,
    gene=[number_slider_7, number_slider_8, number_slider_6, number_slider_5, number_slider_4, number_slider_3, number_slider, number_slider_2])
