# Grasshopper definition Pier_Placement_in_Alignment.gh (Grasshopper 1.0.7)

panel = Panel("Pier I Girder")
curve = Curve(<curve referenced from the Rhino model>)
length = Length(Curve=curve)
division = Division(A=length, B=Slider(28, range=0..100))
panel_2 = Panel(division)
ghpython_script = GhPythonScript(x=division)  # -> out, pier_no
# ---------- ghpython_script: Python ----------
# Example value, replace with your actual value

# Convert x to a float and assign to division_value
division_value = float(x)
print("Division Value:", division_value)

# Convert x to an integer after casting to float (if needed)
print("Integer Value of x:", int(float(x)))

# Calculate mid_range by adding 0.5 to the integer part of x
mid_range = int(float(x)) + 0.5
print("Mid Range:", mid_range)

# Compare division_value with mid_range and determine pier_no
if division_value > mid_range:
    pier_no = int(x) + 1
else:
    pier_no = int(x)

print("Pier No:", pier_no)
# ---------- end ghpython_script ----------
panel_3 = Panel(ghpython_script.pier_no)
divide_curve = DivideCurve(Curve=curve, Count=ghpython_script.pier_no, Kinks=False)  # -> Points, Tangents, Parameters
interpolate = Interpolate(Vertices=divide_curve.Points, Degree=3, Periodic=False, KnotStyle=1)  # -> Curve, Length, Domain
project = Project(Geometry=divide_curve.Points, Plane=PlaneXY(0, 0, 0))  # -> Geometry, Transform
perp_frames = PerpFrames(Curve=interpolate.Curve, Count=ghpython_script.pier_no, Align=Toggle(True))  # -> Frames, Parameters
unit_x = UnitX(Factor=1)
unit_y = UnitY(Factor=1)
unit_z = UnitZ(Factor=1)
line = Line(StartPoint=divide_curve.Points, EndPoint=project.Geometry)
geometry = Geometry(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)
geometry_2 = Geometry(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)
length_2 = Length(Curve=line)
rotate_3d = Rotate3D(Geometry=geometry_2, Angle=degrees(Slider(90, range=0..100)), Center=Point(0, 0, 0), Axis=unit_x)  # -> Geometry, Transform
scale_nu = ScaleNU(Geometry=geometry, Plane=PlaneXY(0, 0, 0), ScaleX=Slider(0.83, range=-1..2), ScaleY=1, ScaleZ=1)  # -> Geometry, Transform
number_slider = Slider(-13, range=-100..100)
panel_4 = Panel(length_2)
multiplication = Multiplication(A=length_2, B="-1")
unit_x_2 = UnitX(Factor=1)
unit_y_2 = UnitY(Factor=1)
unit_z_2 = UnitZ(Factor=1)
orient = Orient(Geometry=rotate_3d.Geometry, Source=PlaneXY(0, 0, 0), Target=perp_frames.Frames)  # -> Geometry, Transform
unit_z_3 = UnitZ(Factor=multiplication)
rotate_3d_2 = Rotate3D(Geometry=scale_nu.Geometry, Angle=degrees(Slider(-90, range=-180..180)), Center=Point(0, 0, 0), Axis=unit_x_2)  # -> Geometry, Transform
orient_2 = Orient(Geometry=rotate_3d_2.Geometry, Source=PlaneXY(0, 0, 0), Target=perp_frames.Frames)  # -> Geometry, Transform
extrude = Extrude(Base=orient.Geometry, Direction=unit_z_3)
unit_z_4 = UnitZ(Factor=Slider(-3.823, range=-20..20))
move = Move(Geometry=[orient_2.Geometry, extrude], Motion=unit_z_4)  # -> Geometry, Transform

panel_5 = Panel("Pier Box Girder")
curve_2 = Curve(<curve referenced from the Rhino model>)
length_3 = Length(Curve=curve_2)
division_2 = Division(A=length_3, B=Slider(28, range=0..100))
panel_6 = Panel(division_2)
ghpython_script_2 = GhPythonScript(x=division_2)  # -> out, pier_no; same code as ghpython_script
panel_7 = Panel(ghpython_script_2.pier_no)
divide_curve_2 = DivideCurve(Curve=curve_2, Count=ghpython_script_2.pier_no, Kinks=False)  # -> Points, Tangents, Parameters
interpolate_2 = Interpolate(Vertices=divide_curve_2.Points, Degree=3, Periodic=False, KnotStyle=1)  # -> Curve, Length, Domain
project_2 = Project(Geometry=divide_curve_2.Points, Plane=PlaneXY(0, 0, 0))  # -> Geometry, Transform
perp_frames_2 = PerpFrames(Curve=interpolate_2.Curve, Count=ghpython_script_2.pier_no, Align=Toggle(True))  # -> Frames, Parameters
unit_x_3 = UnitX(Factor=1)
unit_y_3 = UnitY(Factor=1)
unit_z_5 = UnitZ(Factor=1)
line_2 = Line(StartPoint=divide_curve_2.Points, EndPoint=project_2.Geometry)
geometry_3 = Geometry(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)
geometry_4 = Geometry(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)
length_4 = Length(Curve=line_2)
rotate_3d_3 = Rotate3D(Geometry=geometry_4, Angle=degrees(Slider(90, range=0..100)), Center=Point(0, 0, 0), Axis=unit_x_3)  # -> Geometry, Transform
scale_nu_2 = ScaleNU(Geometry=geometry_3, Plane=PlaneXY(0, 0, 0), ScaleX=Slider(1, range=-2..2), ScaleY=1, ScaleZ=1)  # -> Geometry, Transform
number_slider_2 = Slider(-13, range=-100..100)
panel_8 = Panel(length_4)
multiplication_2 = Multiplication(A=length_4, B="-1")
unit_x_4 = UnitX(Factor=1)
unit_y_4 = UnitY(Factor=1)
unit_z_6 = UnitZ(Factor=1)
orient_3 = Orient(Geometry=rotate_3d_3.Geometry, Source=PlaneXY(0, 0, 0), Target=perp_frames_2.Frames)  # -> Geometry, Transform
unit_z_7 = UnitZ(Factor=multiplication_2)
rotate_3d_4 = Rotate3D(Geometry=scale_nu_2.Geometry, Angle=degrees(Slider(-90, range=-180..180)), Center=Point(0, 0, 0), Axis=unit_x_4)  # -> Geometry, Transform
orient_4 = Orient(Geometry=rotate_3d_4.Geometry, Source=PlaneXY(0, 0, 0), Target=perp_frames_2.Frames)  # -> Geometry, Transform
extrude_2 = Extrude(Base=orient_3.Geometry, Direction=unit_z_7)
unit_z_8 = UnitZ(Factor=Slider(-6.608, range=-20..20))
move_2 = Move(Geometry=[orient_4.Geometry, extrude_2], Motion=unit_z_8)  # -> Geometry, Transform

curve_3 = Curve(<curve referenced from the Rhino model>)
divide_curve_3 = DivideCurve(Curve=curve_3, Count=Slider(26, range=0..100), Kinks=False)  # -> Points, Tangents, Parameters
interpolate_3 = Interpolate(Vertices=divide_curve_3.Points, Degree=3, Periodic=False, KnotStyle=1)  # -> Curve, Length, Domain
