# Grasshopper definition Residential_Unit_Growth_Biomorpher.gh (Grasshopper 1.0.7)
# plug-ins: Biomorpher

number_slider = Slider(332, range=0..2000)
rectangle = Rectangle(Plane=PlaneXY(0, 0, 0), XSize=Slider(1236, range=0..2000), YSize=number_slider, Radius=0)  # -> Rectangle, Length
area = Area(Geometry=rectangle.Rectangle)  # -> Area, Centroid
number_slider_2 = Slider(4, range=0..10)
number_slider_3 = Slider(2, range=0..10)
divide_surface = DivideSurface(Surface=rectangle.Rectangle, UCount=number_slider_2, VCount=number_slider_3)  # -> Points, Normals, Parameters
number_slider_4 = Slider(59, range=0..100)
interpolate_t = InterpolateT(Vertices=divide_surface.Points, TangentStart=Vector(0, 0, 0), TangentEnd=Vector(0, 0, 0), KnotStyle=1)  # -> flatten(Curve), Length, Domain
negative = Negative(Value=number_slider_4)
dispatch = Dispatch(List=interpolate_t.Curve, DispatchPattern=[True, False])  # -> ListA, ListB
curve_middle = CurveMiddle(Curve=interpolate_t.Curve)
number_slider_5 = Slider(59, range=0..100)
entwine = Entwine(Branch00=number_slider_4, Branch01=negative, FlattenInputs=True)
interpolate_t_2 = InterpolateT(Vertices=flatten(curve_middle), TangentStart=Vector(0, 0, 0), TangentEnd=Vector(0, 0, 0), KnotStyle=1)  # -> Curve, Length, Domain
curve_middle_2 = CurveMiddle(Curve=interpolate_t_2.Curve)
xy_plane = XYPlane(Origin=curve_middle_2)
offset_curve = OffsetCurve(Curve=flatten(dispatch.ListB), Distance=entwine, Corners=1)
negative_2 = Negative(Value=number_slider_5)
scale_nu = ScaleNU(Geometry=interpolate_t_2.Curve, Plane=xy_plane, ScaleX=Slider(0.8, range=0..1), ScaleY=1, ScaleZ=1)  # -> Geometry, Transform
negative_3 = Negative(Value=number_slider_5)
entwine_2 = Entwine(Branch00=number_slider_5, Branch01=negative_2, FlattenInputs=True)
entwine_3 = Entwine(Branch00=number_slider_5, Branch01=negative_3, FlattenInputs=True)
curve = Curve(flatten([dispatch.ListB, interpolate_t_2.Curve]))
offset_curve_2 = OffsetCurve(Curve=flatten(scale_nu.Geometry), Distance=entwine_2, Corners=1)
shift_paths = ShiftPaths(Data=offset_curve, Offset=Slider(2, range=0..2))
offset_curve_3 = OffsetCurve(Curve=flatten(curve), Distance=entwine_3, Corners=1)
shift_paths_2 = ShiftPaths(Data=offset_curve_2, Offset=Slider(2, range=0..2))
list_item = ListItem(List=shift_paths, Index=0, Wrap=True)  # -> Item, Item1
shift_paths_3 = ShiftPaths(Data=offset_curve_3, Offset=Slider(2, range=0..2))
list_item_2 = ListItem(List=shift_paths_2, Index=0, Wrap=True)  # -> Item, Item1
flip_curve = FlipCurve(Curve=list_item.Item1)  # -> Curve, Flag
flip_curve_2 = FlipCurve(Curve=list_item_2.Item1)  # -> Curve, Flag
list_item_3 = ListItem(List=shift_paths_3, Index=0, Wrap=True)  # -> Item, Item1
merge = Merge(Data1=list_item.Item, Data2=flip_curve.Curve)
merge_2 = Merge(Data1=list_item_2.Item, Data2=flip_curve_2.Curve)
connect_curves = ConnectCurves(Curves=merge, Continuity=0, Close=True, Bulge=1)
connect_curves_2 = ConnectCurves(Curves=merge_2, Continuity=0, Close=True, Bulge=1)
unit_z = UnitZ(Factor=Slider(2553, range=0..10000))
surface = Surface(connect_curves)
area_2 = Area(Geometry=surface)  # -> Area, Centroid
surface_2 = Surface(connect_curves_2)
extrude = Extrude(Base=connect_curves, Direction=unit_z)
number_slider_6 = Slider(1, range=0..1)
cap_holes = CapHoles(Brep=extrude)
flip_curve_3 = FlipCurve(Curve=list_item_3.Item1)  # -> Curve, Flag
boundary_surfaces = BoundarySurfaces(Edges=rectangle.Rectangle)
scale = Scale(Geometry=surface, Center=area_2.Centroid, Factor=Slider(2, range=0..10))  # -> Geometry, Transform
unit_y = UnitY(Factor=1)
unit_z_2 = UnitZ(Factor=Slider(2351.242, range=0..10000))
merge_3 = Merge(Data1=list_item_3.Item, Data2=flip_curve_3.Curve)
rotate_3d = Rotate3D(Geometry=scale.Geometry, Angle=degrees(Slider(135, range=0..360)), Center=area_2.Centroid, Axis=unit_y)  # -> Geometry, Transform
divide_domain² = DivideDomain²(Domain=boundary_surfaces, UCount=number_slider_2, VCount=number_slider_3)
number_slider_7 = Slider(126, range=0..1000)
box_rectangle = BoxRectangle(Rectangle=connect_curves_2, Height=number_slider_7)
box_array = BoxArray(Geometry=surface_2, Cell=box_rectangle, XCount=number_slider_6, YCount=number_slider_6, ZCount=Slider(16, range=0..100))  # -> Geometry, Transform
number_slider_8 = Slider(1, range=0..1)
connect_curves_3 = ConnectCurves(Curves=merge_3, Continuity=0, Close=True, Bulge=1)
isotrim = Isotrim(Surface=boundary_surfaces, Domain=divide_domain²)
move = Move(Geometry=rotate_3d.Geometry, Motion=unit_z_2)  # -> Geometry, Transform
region_union = RegionUnion(Curves=flatten(connect_curves_3))
split_brep = SplitBrep(Brep=cap_holes, Cutter=move.Geometry)
region_difference = RegionDifference(CurvesA=isotrim, CurvesB=region_union)
region_intersection = RegionIntersection(CurvesA=isotrim, CurvesB=region_union)
list_item_4 = ListItem(List=split_brep, Index=0, Wrap=True)
colour_swatch = ColourSwatch(SwatchColor=RGB(191, 191, 191))
cap_holes_2 = CapHoles(Brep=list_item_4)
area_3 = Area(Geometry=region_difference)  # -> Area, Centroid
rectangle_2 = Rectangle(region_difference)
box_rectangle_2 = BoxRectangle(Rectangle=rectangle_2, Height=number_slider_7)
box_array_2 = BoxArray(
    Geometry=box_rectangle_2,
    Cell=box_rectangle_2,
    XCount=number_slider_8,
    YCount=number_slider_8,
    ZCount=Slider(17, range=0..20))  # -> Geometry, Transform
area_4 = Area(Geometry=region_intersection)  # -> Area, Centroid
custom_preview = CustomPreview(Geometry=[box_array.Geometry, cap_holes_2], Material=ColourSwatch(SwatchColor=RGB(255, 255, 255)))
deconstruct = Deconstruct(Point=area_4.Centroid)  # -> XComponent, YComponent, ZComponent
deconstruct_2 = Deconstruct(Point=area_3.Centroid)  # -> XComponent, YComponent, ZComponent
cull_index = CullIndex(List=box_array_2.Geometry, Indices=Slider(0, range=0..1), Wrap=True)
number_slider_9 = Slider(1, range=0..1)
expression = Expression(x=number_slider, y=number_slider_5, Expression="(x/2)- y")
construct_point = ConstructPoint(XCoordinate=deconstruct_2.XComponent, YCoordinate=deconstruct.YComponent, ZCoordinate=deconstruct.ZComponent)
vector_2pt = Vector2Pt(PointA=construct_point, PointB=area_3.Centroid, Unitize=True)  # -> Vector, Length
unit_vector = UnitVector(Vector=vector_2pt.Vector)
shift_paths_4 = ShiftPaths(Data=cull_index, Offset=Slider(3, range=0..10))  # -> flatten(Data)
number_slider_10 = Slider(5.304, range=2..5.4)
number_slider_11 = Slider(4.165, range=3..10)
amplitude = Amplitude(Vector=unit_vector, Amplitude=expression)
list_length = ListLength(List=shift_paths_4)
division = Division(A=list_length, B=number_slider_10)
move_2 = Move(Geometry=rectangle_2, Motion=amplitude)  # -> Geometry, Transform
multiplication = Multiplication(A=division, B=number_slider_11)
surface_3 = Surface(graft(move_2.Geometry))
construct_domain = ConstructDomain(DomainStart=division, DomainEnd=multiplication)
divide_domain²_2 = DivideDomain²(Domain=surface_3, UCount=Slider(2, range=0..10), VCount=Slider(2, range=0..10))
random = Random(Range=construct_domain, Number=division, Seed=Slider(20, range=0..100))
isotrim_2 = Isotrim(Surface=surface_3, Domain=divide_domain²_2)
box_rectangle_3 = BoxRectangle(Rectangle=isotrim_2, Height=Slider(126, range=0..1000))
box_array_3 = BoxArray(
    Geometry=box_rectangle_3,
    Cell=box_rectangle_3,
    XCount=number_slider_9,
    YCount=number_slider_9,
    ZCount=Slider(17, range=0..20))  # -> Geometry, Transform
cull_index_2 = CullIndex(List=box_array_3.Geometry, Indices=Slider(0, range=0..1), Wrap=True)
shift_paths_5 = ShiftPaths(Data=cull_index_2, Offset=Slider(3, range=0..10))  # -> flatten(Data)
number_slider_12 = Slider(30, range=0..30)
cull_index_3 = CullIndex(List=shift_paths_4, Indices=random, Wrap=True)
list_length_2 = ListLength(List=shift_paths_5)
cull_index_4 = CullIndex(List=cull_index_3, Indices=[Slider(52, range=0..100), Slider(79, range=0..100), Slider(20, range=0..100)], Wrap=True)
volume = Volume(Geometry=cull_index_3)  # -> flatten(Volume), Centroid
division_2 = Division(A=list_length_2, B=number_slider_12)
ghpython_script = GhPythonScript(x=volume.Volume)  # -> out, unit_volume; inputs x: list of Int32
# ---------- ghpython_script: Python ----------
import rhinoscriptsyntax as rs


unit_volume = 0  # Initialize `a` to zero

# Loop through the elements of `x`
for i in x:
    unit_volume = unit_volume + i
   

# Print the final value of `a`
print(unit_volume)
# ---------- end ghpython_script ----------
construct_domain_2 = ConstructDomain(DomainStart="0", DomainEnd=division_2)
expression_2 = Expression(x=list_length_2, Expression="x/2")
number_slider_13 = Slider(56, range=10..100)
random_2 = Random(Range=construct_domain_2, Number=expression_2, Seed=Slider(65, range=0..100))
custom_preview_2 = CustomPreview(Geometry=cull_index_4, Material=ColourSwatch(SwatchColor=RGB(237, 237, 237)))
multiplication_2 = Multiplication(A=random_2, B=number_slider_13)
list_item_5 = ListItem(List=shift_paths_5, Index=multiplication_2, Wrap=True)
deconstruct_brep = DeconstructBrep(Brep=[cull_index_4, list_item_5, cap_holes_2])  # -> Faces, Edges, Vertices
custom_preview_3 = CustomPreview(Geometry=deconstruct_brep.Edges, Material=ColourSwatch(SwatchColor=RGB(0, 0, 0)))
colour_swatch_2 = ColourSwatch(SwatchColor=RGB(196, 128, 128))
volume_2 = Volume(Geometry=list_item_5)  # -> flatten(Volume), Centroid
geometry = Geometry([box_array.Geometry, cull_index_3, cap_holes_2, list_item_5])
rotate_3d_2 = Rotate3D(Geometry=geometry, Angle=degrees(Slider(191, range=0..360)), Center=area.Centroid, Axis=Vector(0, 0, 1))  # -> Geometry, Transform
custom_preview_4 = CustomPreview(Geometry=list_item_5, Material=ColourSwatch(SwatchColor=RGB(237, 237, 237)))
ghpython_script_2 = GhPythonScript(x=volume_2.Volume)  # -> out, ext_volume; inputs x: list of Int32
# ---------- ghpython_script_2: Python ----------
import rhinoscriptsyntax as rs


ext_volume = 0  # Initialize `a` to zero

# Loop through the elements of `x`
for i in x:
    ext_volume = ext_volume + i
   

# Print the final value of `a`
print(ext_volume)
# ---------- end ghpython_script_2 ----------
biomorpher = Biomorpher(
    Genome=[number_slider_13, number_slider_12, number_slider_10, number_slider_11],
    Geometry=rotate_3d_2.Geometry,
    Performs=[ghpython_script_2.ext_volume, ghpython_script.unit_volume])
