# Grasshopper definition Road_lane_mark_generation.gh (Grasshopper 1.0.7)

surface = Surface(flatten([<surface referenced from the Rhino model> x4]))
brep = Brep(<brep referenced from the Rhino model>)
brep_2 = Brep(<brep referenced from the Rhino model>)
curve = Curve(<curve referenced from the Rhino model>)
curve_2 = Curve(<curve referenced from the Rhino model>)
number_slider = Slider(0.028, range=0..0.1)
brep_3 = Brep()
curve_3 = Curve()
number_slider_2 = Slider(-0.23, range=-0.9..0.9)
solid_union = SolidUnion(Breps=[brep_2, brep])
deconstruct_brep = DeconstructBrep(Brep=solid_union)  # -> Faces, Edges, Vertices
multiplication = Multiplication(A=number_slider, B="-1")
offset_curve = OffsetCurve(Curve=curve_2, Distance=Slider(-0.3, range=-0.9..0.9), Plane=PlaneXY(0, 0, 0), Corners=1)
offset_curve_2 = OffsetCurve(Curve=curve_2, Distance=Slider(-0.23, range=-0.9..0.9), Plane=PlaneXY(0, 0, 0), Corners=1)
offset_curve_3 = OffsetCurve(Curve=curve, Distance=Slider(-0.3, range=-0.9..0.9), Plane=PlaneXY(0, 0, 0), Corners=1)
offset_curve_4 = OffsetCurve(Curve=curve, Distance=number_slider_2, Plane=PlaneXY(0, 0, 0), Corners=1)
offset_curve_5 = OffsetCurve(Curve=curve_3, Distance=multiplication, Plane=PlaneXY(0, 0, 0), Corners=1)
offset_curve_6 = OffsetCurve(Curve=curve_3, Distance=number_slider, Plane=PlaneXY(0, 0, 0), Corners=1)
panel = Panel(deconstruct_brep.Faces)
list_item = ListItem(List=deconstruct_brep.Edges, Index=Slider(11, range=0..20), Wrap=True)
panel_2 = Panel("""1
-1""")
panel_3 = Panel("""1
-1""")
multiplication_2 = Multiplication(A=Slider(4.3, range=0..10), B=panel_2)
multiplication_3 = Multiplication(A=Slider(4.23, range=0..10), B=panel_3)
panel_4 = Panel("""1
-1""")
project = Project(Curve=offset_curve, Brep=surface, Direction=Vector(0, 0, 1))
project_2 = Project(Curve=offset_curve_2, Brep=surface, Direction=Vector(0, 0, 1))
project_3 = Project(Curve=offset_curve_3, Brep=surface, Direction=Vector(0, 0, 1))
project_4 = Project(Curve=offset_curve_4, Brep=surface, Direction=Vector(0, 0, 1))
offset_curve_7 = OffsetCurve(Curve=list_item, Distance=Slider(0.1, range=0..1), Plane=PlaneXY(0, 0, 0), Corners=1)
number_slider_3 = Slider(1, range=0..10)
offset_curve_8 = OffsetCurve(Curve=curve_3, Distance=multiplication_2, Plane=PlaneXY(0, 0, 0), Corners=1)
offset_curve_9 = OffsetCurve(Curve=curve_3, Distance=multiplication_3, Plane=PlaneXY(0, 0, 0), Corners=1)
offset_curve_10 = OffsetCurve(Curve=list_item, Distance=Slider(3.7, range=0..10), Plane=PlaneXY(0, 0, 0), Corners=1)
multiplication_4 = Multiplication(A=Slider(3.3, range=0..10), B=panel_4)
divide_distance = DivideDistance(Curve=offset_curve_7, Distance=Slider(2, range=0..100))  # -> Points, Tangents, Parameters
edge_surface = EdgeSurface(CurveA=project_2, CurveB=project)
number_slider_4 = Slider(83, range=0..100)
project_5 = Project(Curve=offset_curve_5, Brep=brep_3, Direction=Vector(0, 0, 1))
project_6 = Project(Curve=offset_curve_6, Brep=brep_3, Direction=Vector(0, 0, 1))
edge_surface_2 = EdgeSurface(CurveA=project_4, CurveB=project_3)
number_slider_5 = Slider(0.028, range=0..0.1)
unit_z = UnitZ(Factor=multiplication_4)
end_points = EndPoints(Curve=project_4)  # -> Start, End
end_points_2 = EndPoints(Curve=project_2)  # -> Start, End
line = Line(StartPoint=end_points_2.Start, EndPoint=end_points.End)
divide_distance_2 = DivideDistance(Curve=project_5, Distance=number_slider_3)  # -> flatten(Points), Tangents, Parameters
divide_distance_3 = DivideDistance(Curve=project_6, Distance=number_slider_3)  # -> flatten(Points), Tangents, Parameters
curve_middle = CurveMiddle(Curve=line)
length = Length(Curve=line)
extrude = Extrude(Base=offset_curve_10, Direction=unit_z)
unit_z_2 = UnitZ(Factor=Slider(0.018, range=0..1))
unit_z_3 = UnitZ(Factor=Slider(0.018, range=0..1))
list_item_2 = ListItem(List=deconstruct_brep.Faces, Index=Slider(5, range=0..10), Wrap=True)
project_7 = Project(Curve=offset_curve_9, Brep=brep_3, Direction=Vector(0, 0, 1))
project_8 = Project(Curve=offset_curve_8, Brep=brep_3, Direction=Vector(0, 0, 1))
division = Division(A=length, B="-2")
multiplication_5 = Multiplication(A=number_slider_5, B="-1")
dispatch = Dispatch(List=divide_distance_3.Points, DispatchPattern=[True, False])  # -> ListA, ListB
dispatch_2 = Dispatch(List=divide_distance_2.Points, DispatchPattern=[True, False])  # -> ListA, ListB
surface_line = SurfaceLine(Surface=[list_item_2, extrude], LimitToFirst=False)  # -> Curves, Points, UVPoints, Normal
unit_z_4 = UnitZ(Factor=Slider(0.018, range=0..1))
edge_surface_3 = EdgeSurface(CurveA=project_8, CurveB=project_7)
addition = Addition(A=number_slider_2, B=division)
extrude_2 = Extrude(Base=edge_surface_3, Direction=unit_z_4)
point = Point(dispatch.ListB)
offset_curve_11 = OffsetCurve(Curve=curve_2, Distance=addition, Plane=PlaneXY(0, 0, 0), Corners=1)
point_2 = Point(dispatch.ListA)
point_3 = Point(dispatch_2.ListA)
point_4 = Point(dispatch_2.ListB)
project_9 = Project(Curve=offset_curve_11, Brep=surface, Direction=Vector(0, 0, 1))
offset_curve_12 = OffsetCurve(Curve=project_9, Distance=multiplication_5, Plane=PlaneXY(0, 0, 0), Corners=1)
offset_curve_13 = OffsetCurve(Curve=project_9, Distance=number_slider_5, Plane=PlaneXY(0, 0, 0), Corners=1)
list_item_3 = ListItem(List=point_4, Index=Slider(0, range=0..100), Wrap=True)
number_slider_6 = Slider(1, range=0..10)
_4point_surface = _4PointSurface(CornerA=point_2, CornerB=point, CornerC=point_4, CornerD=point_3)
project_10 = Project(Curve=offset_curve_12, Brep=surface, Direction=Vector(0, 0, 1))
project_11 = Project(Curve=offset_curve_13, Brep=surface, Direction=Vector(0, 0, 1))
unit_z_5 = UnitZ(Factor=Slider(0.018, range=0..0.1))
extrude_3 = Extrude(Base=_4point_surface, Direction=unit_z_5)
divide_distance_4 = DivideDistance(Curve=project_10, Distance=number_slider_6)  # -> flatten(Points), Tangents, Parameters
divide_distance_5 = DivideDistance(Curve=project_11, Distance=number_slider_6)  # -> flatten(Points), Tangents, Parameters
extrude_4 = Extrude(Base=edge_surface_2, Direction=unit_z_2)
extrude_5 = Extrude(Base=edge_surface, Direction=unit_z_3)
dispatch_3 = Dispatch(List=divide_distance_5.Points, DispatchPattern=[True, False])  # -> ListA, ListB
dispatch_4 = Dispatch(List=divide_distance_4.Points, DispatchPattern=[True, False])  # -> ListA, ListB
point_5 = Point(dispatch_3.ListA)
point_6 = Point(dispatch_3.ListB)
point_7 = Point(dispatch_4.ListA)
point_8 = Point(dispatch_4.ListB)
list_item_4 = ListItem(List=point_8, Index=Slider(0, range=0..100), Wrap=True)
_4point_surface_2 = _4PointSurface(CornerA=point_5, CornerB=point_6, CornerC=point_8, CornerD=point_7)
unit_z_6 = UnitZ(Factor=Slider(0.018, range=0..0.1))
extrude_6 = Extrude(Base=_4point_surface_2, Direction=unit_z_6)
