# Grasshopper definition Screen_UV_morph_jitter.gh (Grasshopper 1.0.7)

number_slider = Slider(30, range=0..100)
xy_plane = XYPlane(Origin=Point(0, 0, 0))
unit_z = UnitZ(Factor=Slider(50, range=0..100))
rectangle = Rectangle(Plane=xy_plane, XSize=number_slider, YSize=number_slider, Radius=Slider(7, range=0..10))  # -> Rectangle, Length
extrude = Extrude(Base=rectangle.Rectangle, Direction=unit_z)
unit_x = UnitX(Factor=Slider(58, range=0..100))
deconstruct_domain² = DeconstructDomain²(Domain=extrude)  # -> UMin, UMax, VMin, VMax
move = Move(Geometry=extrude, Motion=unit_x)  # -> Geometry, Transform
rectangle_2 = Rectangle(Plane=xy_plane, XSize=deconstruct_domain².UMax, YSize=deconstruct_domain².VMax, Radius=0)  # -> Rectangle, Length
populate_2d = Populate2D(Region=rectangle_2.Rectangle, Count=Slider(1200, range=0..10000), Seed=1)

# ---- group: Gradual Scale
curve_closest_point = CurveClosestPoint(Point=populate_2d, Curve=<geometry referenced from the Rhino model>)  # -> Point, Parameter, Distance
construct_domain = ConstructDomain(DomainStart=Slider(0.45, range=0..1), DomainEnd=Slider(0.85, range=0..1))
bounds = Bounds(Numbers=curve_closest_point.Distance)
remap_numbers = RemapNumbers(Value=curve_closest_point.Distance, Source=bounds, Target=construct_domain)  # -> Mapped, Clipped

# ----
voronoi = Voronoi(Points=populate_2d, Boundary=rectangle_2.Rectangle, BruteForceOverride=False)
scale = Scale(Geometry=voronoi, Center=populate_2d, Factor=remap_numbers.Mapped)  # -> Geometry, Transform
construct_domain_2 = ConstructDomain(DomainStart=Slider(0.35, range=0..1), DomainEnd=Slider(0.75, range=0..1))
sort_list = SortList(Keys=curve_closest_point.Distance, ValuesValuesA=scale.Geometry)  # -> Keys, ValuesValuesA
jitter = Jitter(List=sort_list.ValuesValuesA, Jitter=construct_domain_2, Seed=2)  # -> Values, Indices
list_length = ListLength(List=sort_list.Keys)
multiplication = Multiplication(A=list_length, B=Slider(0.5, range=0..1))
sub_list = SubList(List=jitter.Values, Domain=multiplication, Wrap=True)  # -> List, Index
ruled_surface = RuledSurface(CurveA=scale.Geometry, CurveB=voronoi)
boundary_surfaces = BoundarySurfaces(Edges=sub_list.List)
unit_z_2 = UnitZ(Factor=Slider(0.1, range=0..0.1))
extrude_2 = Extrude(Base=[ruled_surface, boundary_surfaces], Direction=unit_z_2)  # -> flatten(Extrusion)
surface = Surface(move.Geometry)
bounding_box = BoundingBox(Content=extrude_2, Plane=PlaneXY(0, 0, 0), UnionBox=True)  # -> Box, Box_2
deconstruct_domain²_2 = DeconstructDomain²(Domain=surface)  # -> UComponent, VComponent
surface_morph = SurfaceMorph(
    Geometry=extrude_2,
    Reference=bounding_box.Box,
    Surface=surface,
    UDomain=deconstruct_domain²_2.UComponent,
    VDomain=deconstruct_domain²_2.VComponent,
    WDomain=Slider(-0.1, range=-0.1..0))
