# Grasshopper definition Segmentet_folded_Plate.gh (Grasshopper 1.0.7)

xy_plane = XYPlane(Origin=Point(0, 0, 0))
ellipse = Ellipse(Plane=xy_plane, Radius1=Slider(1500, range=0..10000), Radius2=Slider(2130, range=0..10000))  # -> Ellipse, Focus1, Focus2
number_slider = Slider(20, range=0..100)
divide_curve = DivideCurve(Curve=ellipse.Ellipse, Count=number_slider, Kinks=False)  # -> Points, Tangents, Parameters
number_slider_2 = Slider(4, range=0..10)
area = Area(Geometry=ellipse.Ellipse)  # -> Area, Centroid
division = Division(A=number_slider, B=Slider(2, range=0..10))
division_2 = Division(A=number_slider, B=Slider(2, range=0..10))
line = Line(StartPoint=area.Centroid, EndPoint=divide_curve.Points)
series = Series(Start=Slider(0, range=0..100), Step=Slider(2, range=0..10), Count=division)
series_2 = Series(Start=Slider(1, range=0..100), Step=Slider(2, range=0..10), Count=division_2)
list_item = ListItem(List=line, Index=series, Wrap=True)
list_item_2 = ListItem(List=line, Index=series_2, Wrap=True)
divide_curve_2 = DivideCurve(Curve=list_item, Count=Slider(4, range=0..10), Kinks=False)  # -> Points, Tangents, Parameters
divide_curve_3 = DivideCurve(Curve=list_item_2, Count=Slider(5, range=0..10), Kinks=False)  # -> Points, Tangents, Parameters
line_2 = Line(StartPoint=divide_curve_2.Points, EndPoint=divide_curve_3.Points)
