# Grasshopper definition Shell_Segment_Script.gh (Grasshopper 1.0.7)
# plug-ins: LunchBox, Bifocals

number_slider = Slider(20, range=0..100)
xy_plane = XYPlane(Origin=Point(0, 0, 0))

# ---- group: Ellipse Radius
number_slider_2 = Slider(9202, range=0..10000)
number_slider_3 = Slider(5911, range=0..10000)

# ----
ellipse = Ellipse(Plane=xy_plane, Radius1=number_slider_2, Radius2=number_slider_3)  # -> Ellipse, Focus1, Focus2
gene_pool = GenePool(Decimals=2, Maximum=2, Minimum=0, Value=[1, 1, 1, 1.1])
gene_pool_2 = GenePool(Decimals=2, Maximum=2, Minimum=0, Value=[1, 1, 1, 1])
curve = Curve(ellipse.Ellipse)
gene_pool_3 = GenePool(Decimals=2, Maximum=360, Minimum=0, Value=[0, 8.06, 11.09, 16.89])
divide_curve = DivideCurve(Curve=curve, Count=number_slider, Kinks=False)  # -> Points, Tangents, Parameters
offset_curve = OffsetCurve(Curve=curve, Distance=Slider(304, range=0..1000), Plane=PlaneXY(0, 0, 0), Corners=1)
divide_curve_2 = DivideCurve(Curve=offset_curve, Count=number_slider, Kinks=False)  # -> Points, Tangents, Parameters
rotate = Rotate(Geometry=divide_curve_2.Points, Angle=Slider(0.02, range=0..1), Plane=PlaneXY(0, 0, 0))  # -> Geometry, Transform
rotate_2 = Rotate(Geometry=divide_curve_2.Points, Angle=Slider(-0.02, range=-1..1), Plane=PlaneXY(0, 0, 0))  # -> Geometry, Transform
area = Area(Geometry=offset_curve)  # -> Area, Centroid
xy_plane_2 = XYPlane(Origin=area.Centroid)
line = Line(StartPoint=rotate.Geometry, EndPoint=divide_curve.Points)
line_2 = Line(StartPoint=rotate_2.Geometry, EndPoint=divide_curve.Points)
multiplication = Multiplication(A=number_slider, B="2")
shift_list = ShiftList(List=rotate_2.Geometry, Shift=1, Wrap=True)

line_3 = Line(StartPoint=rotate.Geometry, EndPoint=shift_list)
curve_middle = CurveMiddle(Curve=line_3)
line_4 = Line(StartPoint=curve_middle, EndPoint=area.Centroid)
extend_curve = ExtendCurve(Curve=line_4, Type=0, Start=curve_middle, End=Slider(1, range=0..1))

series = Series(Start=multiplication, Step="1", Count=number_slider)

point_on_curve = PointOnCurve(extend_curve, parameter=0.495)
arc_3pt = Arc3Pt(PointA=rotate.Geometry, PointB=point_on_curve, PointC=shift_list)  # -> Arc, Plane, Radius
merge = Merge(Data1=line, Data2=arc_3pt.Arc, Data3=line_2)

number_slider_4 = Slider(31, range=0..100)
number_slider_5 = Slider(14, range=0..100)

gene_pool_4 = GenePool(Decimals=3, Maximum=5000, Minimum=0, Value=[0, 1338.864, 2195.472, 4156.487])
unit_z = UnitZ(Factor=gene_pool_4)
move = Move(Geometry=simplify(graft(merge)), Motion=unit_z)  # -> Geometry, Transform
gene_pool_5 = GenePool(Decimals=3, Maximum=2, Minimum=0, Value=[0.9, 1.081, 0.985, 0.7])
scale = Scale(Geometry=move.Geometry, Center=area.Centroid, Factor=gene_pool_5)  # -> Geometry, Transform

rotate_3 = Rotate(Geometry=scale.Geometry, Angle=degrees(gene_pool_3), Plane=PlaneXY(0, 0, 0))  # -> Geometry, Transform
scale_nu = ScaleNU(Geometry=rotate_3.Geometry, Plane=xy_plane_2, ScaleX=gene_pool, ScaleY=gene_pool_2, ScaleZ=1)  # -> Geometry, Transform
loft = Loft(
    Curves=scale_nu.Geometry,
    Options={Adjust=False, Closed=False, LoftEnds=0, LoftSimp=0, LoftType=0, Rebuild=10, Refit=0.01})  # -> flatten(Loft)
dimensions = Dimensions(Surface=loft)  # -> UDimension, VDimension
sort_list = SortList(Keys=dimensions.VDimension, ValuesValuesA=loft)  # -> Keys, ValuesValuesA
list_item = ListItem(List=sort_list.ValuesValuesA, Index=series, Wrap=True)
diagrid_structure = DiagridStructure(Surface=list_item, UDivisions=number_slider_4, VDivisions=number_slider_5, Type=True)  # -> StructureLines, StructureNodes
diamond_panels = DiamondPanels(Surface=list_item, UDivisions=number_slider_4, VDivisions=number_slider_5)  # -> DiamondPanels, TriPanels
mass_model = Geometry(loft)
panel_frame = PanelFrame(Panel=[diamond_panels.TriPanels, diamond_panels.DiamondPanels], ScaleFactor=Slider(0.92, range=0..2))  # -> PanelFrame, Panel
pipe = Pipe(Curve=diagrid_structure.StructureLines, Radius=Slider(9, range=0..10), Caps=0)
glass_frame = Geometry(panel_frame.PanelFrame)
glass_panel = Geometry(panel_frame.Panel)
custom_preview = CustomPreview(Geometry=pipe, Material=ColourSwatch(SwatchColor=RGB(189, 189, 189)))
custom_preview_2 = CustomPreview(Geometry=glass_frame, Material=ColourSwatch(SwatchColor=RGB(255, 255, 255)))
custom_preview_3 = CustomPreview(Geometry=mass_model, Material=ColourSwatch(SwatchColor=RGB(255, 255, 255)))
