# Grasshopper definition Stadium_Random_Composition_Script.gh (Grasshopper 1.0.7)

sphere = Sphere(Base=PlaneXY(0, 0, 0), Radius=Slider(2693, range=0..100000))
curve = Curve([<curve referenced from the Rhino model> x3])
loft = Loft(Curves=curve, Options={Adjust=False, Closed=False, LoftEnds=0, LoftSimp=0, LoftType=0, Rebuild=10, Refit=0.01})
populate_3d = Populate3D(Region=sphere, Count=Slider(78, range=0..1000), Seed=Slider(4, range=0..100))
construct_point = ConstructPoint(XCoordinate=0, YCoordinate=0, ZCoordinate=0)
vector_2pt = Vector2Pt(PointA=construct_point, PointB=populate_3d, Unitize=False)  # -> Vector, Length
plane_normal = PlaneNormal(Origin=construct_point, ZAxis=vector_2pt.Vector)
brep_plane = BrepPlane(Brep=loft, Plane=plane_normal)  # -> Curves, Points
pipe = Pipe(Curve=brep_plane.Curves, Radius=Slider(14, range=0..100), Caps=0)
