# Grasshopper definition Surface_Voronoi.gh (Grasshopper 1.0.7)

number_slider = Slider(30, range=0..100)
surface = Surface(<surface referenced from the Rhino model>)
dimensions = Dimensions(Surface=surface)  # -> UDimension, VDimension
plane_surface = PlaneSurface(Plane=PlaneXY(0, 0, 0), XSize=dimensions.UDimension, YSize=dimensions.VDimension)
populate_geometry = PopulateGeometry(Geometry=plane_surface, Count=Slider(569, range=0..1000), Seed=1)
surface_2 = Surface(<surface referenced from the Rhino model>)
rectangle = Rectangle(Plane=PlaneXY(0, 0, 0), XSize=dimensions.UDimension, YSize=dimensions.VDimension, Radius=0)  # -> Rectangle, Length
dimensions_2 = Dimensions(Surface=surface_2)  # -> UDimension, VDimension
voronoi = Voronoi(Points=populate_geometry, Boundary=rectangle.Rectangle, BruteForceOverride=False)
rectangle_2 = Rectangle(Plane=PlaneXY(0, 0, 0), XSize=dimensions_2.UDimension, YSize=dimensions_2.VDimension, Radius=0)  # -> Rectangle, Length
area = Area(Geometry=voronoi)  # -> Area, Centroid
scale = Scale(Geometry=voronoi, Center=area.Centroid, Factor=Slider(0.91, range=0..1))  # -> Geometry, Transform
unit_z = UnitZ(Factor=Slider(6, range=0..10))
curve = Curve(flatten([scale.Geometry, rectangle.Rectangle]))
populate_2d = Populate2D(Region=rectangle_2.Rectangle, Count=Slider(612, range=0..1000), Seed=Slider(7, range=0..10))
boundary_surfaces = BoundarySurfaces(Edges=curve)
extrude = Extrude(Base=boundary_surfaces, Direction=unit_z)
number_slider_2 = Slider(1, range=0..1)
box = Box(extrude)
merge = Merge()
voronoi_2 = Voronoi(Points=populate_2d, Radius=Slider(3.1, range=0..10), Boundary=rectangle_2.Rectangle, BruteForceOverride=False)
surface_morph = SurfaceMorph(
    Geometry=extrude,
    Reference=box,
    Surface=reparameterize(surface),
    UDomain=number_slider_2,
    VDomain=number_slider_2,
    WDomain=number_slider_2)
area_2 = Area(Geometry=voronoi_2)  # -> Area, Centroid
scale_2 = Scale(Geometry=voronoi_2, Center=area_2.Centroid, Factor=Slider(0.8, range=0..1))  # -> flatten(Geometry), Transform
panel = Panel(area_2.Centroid)
fillet_distance = FilletDistance(Curve=scale_2.Geometry, Distance=Slider(0.275, range=0..10))
curve_2 = Curve([scale_2.Geometry, rectangle_2.Rectangle])
boundary_surfaces_2 = BoundarySurfaces(Edges=curve_2)
unit_z_2 = UnitZ(Factor=Slider(4, range=0..10))
extrude_2 = Extrude(Base=boundary_surfaces_2, Direction=unit_z_2)
number_slider_3 = Slider(1, range=0..1)
box_2 = Box(extrude_2)
surface_morph_2 = SurfaceMorph(
    Geometry=extrude_2,
    Reference=box_2,
    Surface=reparameterize(surface_2),
    UDomain=number_slider_3,
    VDomain=number_slider_3,
    WDomain=number_slider_3)
