# Grasshopper definition TensileRelaxScript.gh (Grasshopper 1.0.7)
# plug-ins: Kangaroo2 Components, MeshEdit Components, Bifocals

srf = Surface([<surface referenced from the Rhino model> x6])
number_slider = Slider(5, range=0..10)

# ---- group: Select edges to match point anchors
crv = Curve([<curve referenced from the Rhino model> x6])

# ----
mesh_uv = MeshSurface(Surface=srf, UCount=number_slider, VCount=Slider(7, range=0..10), Overhang=True, Equalize=False)
mjoin = MeshJoin(Meshes=mesh_uv)
weldvertices = MeshWeldVertices(Mesh=mjoin, Tolerance=0.01)  # -> RuntimeMessage, Mesh
unifynormals = MeshUnifyNormals(Mesh=weldvertices.Mesh)
medges = MeshEdges(Mesh=unifynormals)  # -> NakedEdges, InteriorEdges, NonManifoldEdges

edgelengths = EdgeLengths(Mesh=unifynormals, LengthFactor=Slider(0.6, range=-1..1), Strength=Slider(1, range=0..1))  # -> flatten(EL)

divide = DivideCurve(Curve=crv, Count=number_slider, Kinks=False)  # -> Points, Tangents, Parameters
duppt = RemoveDuplicatePts(Points=flatten(divide.Points), Tolerance=0.01)
anchor = Anchor(Point=flatten(duppt), Strength=10000)

vertexloads = VertexLoads(Mesh=unifynormals, Strength=Slider(0.7, range=0..1))

planarize = Planarize(M=unifynormals, Strength=Slider(270, range=0..500))

# ---- group: easy to forget but necessary for mesh output
show = Show(G=unifynormals)

# ----
bouncysolver = BouncySolver(
    GoalObjects=[vertexloads, show, edgelengths, anchor, planarize],
    Reset=Button(),
    Threshold=0.0001,
    Tolerance=0.0001,
    Damping=0.99,
    Iterations=10,
    On=Toggle(True))  # -> I, V, O

# ---- group: For debugging if the above solver doesnt converge
stepsolver = StepSolver(
    GoalObjects=[show, edgelengths, anchor, planarize, vertexloads],
    Tolerance=0.01,
    Momentum=True,
    Damping=0.99,
    SubIterations=10000,
    Animate=Toggle(False))  # -> I, V, O

# ----
item = ListItem(List=[bouncysolver.O, stepsolver.O], Index=0, Wrap=True)
pa = PlanarityAnalysis(Mesh=item, Max=0.01)  # -> M, P
geo = Geometry(item)
medges_2 = MeshEdges(Mesh=pa.M)  # -> NakedEdges, InteriorEdges, NonManifoldEdges
