# Grasshopper definition Volume_Voronoi.gh (Grasshopper 1.0.8)
# plug-ins: Bifocals, Weaverbird

deconstruct_brep = DeconstructBrep(Brep=<geometry referenced from the Rhino model>)  # -> Faces, Edges, Vertices
brep = Brep(<brep referenced from the Rhino model>)
rectangle = Rectangle(Plane=PlaneXY(0, 0, 0), XSize=Slider(165, range=0..165), YSize=Slider(56, range=0..100), Radius=0)  # -> Rectangle, Length
rectangle_2 = Rectangle(Plane=PlaneXY(0, 0, 0), XSize=Slider(80, range=0..165), YSize=Slider(59, range=0..100), Radius=0)  # -> Rectangle, Length
subd = SubD(<subd referenced from the Rhino model>)
mesh = Mesh(brep)
curve = Curve(deconstruct_brep.Edges)
brep_2 = Brep(<brep referenced from the Rhino model>)
subd_2 = SubD(mesh)
deconstruct_brep_2 = DeconstructBrep(Brep=brep_2)  # -> Faces, Edges, Vertices
subd_edges = SubDEdges(NewFormatting=False)  # -> Line, Edge, Tag, Id
bounding_box = BoundingBox(Content=brep_2, Plane=PlaneXY(0, 0, 0))  # -> Box, Box_2
brep_3 = Brep(brep_2)
area = Area(Geometry=bounding_box.Box)  # -> Area, Centroid
member_index = MemberIndex(Set=subd_edges.Tag, Member="smooth, interior")  # -> Index, Count
scale = Scale(Geometry=bounding_box.Box, Center=area.Centroid, Factor=Slider(1.34, range=1..2))  # -> Geometry, Transform
list_item = ListItem(List=subd_edges.Edge, Index=member_index.Index, Wrap=True)
populate_geometry = PopulateGeometry(Geometry=brep_3, Count=Slider(1462, range=0..2000), Seed=1)
populate_3d = Populate3D(Region=scale.Geometry, Count=Slider(2153, range=0..10000), Seed=1, Points=populate_geometry)
merge = Merge(Data1=populate_3d, Data2=populate_geometry)  # -> flatten(Result)
point_in_brep = PointInBrep(Brep=brep_2, Point=populate_geometry, Strict=False)
cull_pattern = CullPattern(List=merge, CullPattern=point_in_brep)
curve_2 = Curve(deconstruct_brep_2.Edges)
voronoi_3d = Voronoi3D(Points=cull_pattern)  # -> Cells, Boundary
solid_intersection = SolidIntersection(BrepsA=brep_2, BrepsB=graft(voronoi_3d.Cells))  # -> flatten(Result)
brep_4 = Brep(solid_intersection)
brep_edges = BrepEdges(Brep=brep_4)  # -> Naked, flatten(Interior), NonManifold
curve_middle = CurveMiddle(Curve=[brep_edges.Interior, deconstruct_brep_2.Edges])
pull_point = PullPoint(Point=curve_middle, Geometry=curve_2, ClosestOnly=True)  # -> ClosestPoint, Distance, Index
smaller_than = SmallerThan(FirstNumber=pull_point.Distance, SecondNumber=Slider(0.06, range=0..0.1))  # -> SmallerThan, OrEqualTo
cull_pattern_2 = CullPattern(List=brep_edges.Interior, CullPattern=invert(smaller_than.SmallerThan))
end_points = EndPoints(Curve=cull_pattern_2)  # -> Start, End
line = Line(StartPoint=end_points.Start, EndPoint=end_points.End)
removeduplicatelines = RemoveDuplicateLines(Lines=line, Tolerance=0.01)
control_points = ControlPoints(Curve=removeduplicatelines)  # -> Points, Weights, Knots
flatten_tree = FlattenTree(Tree=control_points.Points, Path="{0}")
point_groups = PointGroups(Points=flatten_tree, Distance=Slider(0.24, range=0..1))  # -> Groups, Indices
average = Average(Input=point_groups.Groups)
list_length = ListLength(List=point_groups.Groups)
duplicate_data = DuplicateData(Data=average, Number=list_length, Order=True)  # -> flatten(Data)
replace_items = ReplaceItems(List=flatten_tree, Item=duplicate_data, Indices=flatten(point_groups.Indices), Wrap=False)
unflatten_tree = UnflattenTree(Tree=replace_items, Guide=control_points.Points)
param_viewer = ParamViewer(unflatten_tree)
polyline = PolyLine(Vertices=unflatten_tree, Closed=False)  # -> flatten(Polyline)
multipipe = MultiPipe(
    Curves=polyline,
    NodeSize=Slider(0.2, range=0..10),
    EndOffset=1,
    StrutSize=Slider(6, range=0..100),
    Segment=0,
    KinkAngle=0.6,
    CubeFit=0,
    Caps=0)
mesh_2 = Mesh(multipipe)
weaverbird_s_catmull_clark_subdivision = WeaverbirdsCatmullClarkSubdivision(MeshCurves=mesh_2, Level=Slider(2, range=0..10), SmoothNakedEdges=1)
weaverbird_s_laplacian_smoothing = WeaverbirdsLaplacianSmoothing(MeshCurves=weaverbird_s_catmull_clark_subdivision, Level=Slider(20, range=0..20), SmoothNakedEdges=1, Thin=1)
