# Grasshopper definition Voronoi_with_attractor.gh (Grasshopper 1.0.7)
# plug-ins: Bifocals

yz_plane = YZPlane(Origin=Point(0, 0, 0))
surface = Surface(<surface referenced from the Rhino model>)
dimensions = Dimensions(Surface=surface)  # -> UDimension, VDimension
triangular = Triangular(Plane=yz_plane, Size=Slider(6, range=0..10), ExtentX=Slider(35, range=0..100), ExtentY=Slider(29, range=0..100))  # -> Cells, Points
rectangle = Rectangle(Plane=PlaneXY(0, 0, 0), XSize=dimensions.UDimension, YSize=dimensions.VDimension, Radius=0)  # -> Rectangle, Length
surface_2 = Surface(triangular.Cells)
construct_point = ConstructPoint(XCoordinate=Slider(21, range=0..100), YCoordinate=Slider(41, range=0..100), ZCoordinate=0)
area = Area(Geometry=surface_2)  # -> Area, Centroid
populate_2d = Populate2D(Region=rectangle.Rectangle, Count=Slider(652, range=0..1000), Seed=Slider(7, range=0..10))
closest_point = ClosestPoint(Point=flatten(area.Centroid), Cloud=construct_point)  # -> ClosestPoint, CPIndex, Distance
voronoi = Voronoi(Points=populate_2d, Boundary=rectangle.Rectangle, BruteForceOverride=False)
construct_domain = ConstructDomain(DomainStart=Slider(0.04, range=0..0.1), DomainEnd=Slider(1, range=0..1))
bounds = Bounds(Numbers=closest_point.Distance)
number_slider = Slider(0.89, range=0..1)
area_2 = Area(Geometry=voronoi)  # -> Area, Centroid
remap_numbers = RemapNumbers(Value=closest_point.Distance, Source=bounds, Target=construct_domain)  # -> Mapped, Clipped
scale = Scale(Geometry=flatten(voronoi), Center=flatten(area_2.Centroid), Factor=remap_numbers.Clipped)  # -> Geometry, Transform
curve = Curve([scale.Geometry, rectangle.Rectangle])
unit_z = UnitZ(Factor=Slider(1, range=0..10))
boundary_surfaces = BoundarySurfaces(Edges=curve)
extrude = Extrude(Base=boundary_surfaces, Direction=unit_z)
number_slider_2 = Slider(1, range=0..1)
box = Box(extrude)
surface_morph = SurfaceMorph(
    Geometry=extrude,
    Reference=box,
    Surface=reparameterize(surface),
    UDomain=number_slider_2,
    VDomain=number_slider_2,
    WDomain=number_slider_2)
